# Grasshopper definition bowling-def.gh (Grasshopper 1.0.7)

# DESIGN EXTENTS
# SPACE BTWN COMP.
bounds = Curve(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)

number_slider = Slider(1.5, range=0..10)
# SIZING
bounds_2 = Curve(<curve referenced from the Rhino model>)

number = Number(9.5)
number_2 = Number(4.5)
addition = Addition(A=number, B=number_slider)
addition_2 = Addition(A=number_2, B=number_slider)
num = Number(addition)
num_2 = Number(addition_2)

comp_bound_size_x_in = Panel(num)
# CELL SIZING
comp_bound_size_y_in = Panel(num_2)

bounds_3 = Curve(bounds_2)
explode = Explode(Curve=bounds_3, Recursive=True)  # -> Segments, Vertices
_12 = Number(12)
item = ListItem(List=explode.Segments, Index=0, Wrap=True)  # -> Item, Item1, Item2, Item3
division = Division(A=num, B=_12)
division_2 = Division(A=num_2, B=_12)
y_extent = Curve(item.Item3)
x_extent = Curve(item.Item)
len = Length(Curve=x_extent)
len_2 = Length(Curve=y_extent)
division_3 = Division(A=len_2, B=division_2)
division_4 = Division(A=len, B=division)
divide = DivideCurve(Curve=x_extent, Count=division_4, Kinks=False)  # -> Points, Tangents, Parameters
divide_2 = DivideCurve(Curve=y_extent, Count=division_3, Kinks=False)  # -> Points, Tangents, Parameters

blank_geo = Geometry(<curve referenced from the Rhino model>)

Y = UnitY(Factor=1)
X = UnitX(Factor=1)
line = LineSDL(Start=divide.Points, Direction=Y, Length=len_2)
line_2 = LineSDL(Start=divide_2.Points, Direction=X, Length=len)
weave = Weave(Pattern=[0, 1], Stream0=line, Stream1=line_2, NullGaps=False)
srfsplit = SurfaceSplit(Surface=bounds_2, Curves=weave)
crv = Curve(srfsplit)
area = Area(Geometry=crv)  # -> Area, Centroid
lng = ListLength(List=area.Centroid)
num_3 = Number(lng)

area_2 = Area(Geometry=blank_geo)  # -> Area, Centroid
ln = Line(StartPoint=area_2.Centroid, EndPoint=area.Centroid)
move = Move(Geometry=blank_geo, Motion=ln)  # -> Geometry, Transform
area_3 = Area(Geometry=move.Geometry)  # -> Area, Centroid

# ----
# PERCENT PER COMP.
number_slider_2 = Slider(0.12, range=0..1)

wood_percent = Number(number_slider_2)
led_percent = Number(Slider(0.16, range=0..1))
pin_percent = Number(Slider(0.25, range=0..1))
acoustic_percent = Number(Slider(0.22, range=0..1))
blank_percent = Number(Slider(0.25, range=0..1))
# QUANT (GENERAL)
num_4 = Number(num_3)
component_quantity = Panel(num_4)
num_5 = Number(num_3)

multiplication = Multiplication(A=num_5, B=wood_percent)
multiplication_2 = Multiplication(A=num_5, B=led_percent)
multiplication_3 = Multiplication(A=num_5, B=pin_percent)
multiplication_4 = Multiplication(A=num_5, B=acoustic_percent)
multiplication_5 = Multiplication(A=num_5, B=blank_percent)
wood = Number(multiplication)
led = Number(multiplication_2)
pins = Number(multiplication_3)
acoustic = Number(multiplication_4)
blank = Number(multiplication_5)

ma = MassAddition(Input=[wood_percent, led_percent, pin_percent, acoustic_percent, blank_percent])  # -> Result, PartialResults
# PERCENT VERIF.
must_1 = Panel(ma.Result)

# ----
# COMPONENT QUANTS
components_percent = Panel([wood_percent, led_percent, pin_percent, acoustic_percent, blank_percent])
components_total = Panel([wood, led, pins, acoustic, blank])

# ----
# NUM. OF COMPS.
number_slider_3 = Slider(4, range=0..10)

num_6 = Number(num_3)
# RANDOMNESS MOD.
number_slider_4 = Slider(4, range=0..10)

merge = Merge(Data1=wood_percent, Data2=led_percent, Data3=pin_percent, Data4=acoustic_percent, Data5=blank_percent)
dom = ConstructDomain(DomainStart=Slider(0, range=0..100), DomainEnd=number_slider_3)
random_by_percentage = GhPythonScript(Domain=dom, Percents=merge, N=num_6, Seed=number_slider_4, Inclusive=1)  # -> a; inputs Percents: list, Seed: Int32, Inclusive: Boolean
# ---------- random_by_percentage: Python ----------
"""Random integer list with controlled percentages.
Inputs:
  Domain (Interval or [start,end])
  Percents (list of floats) – length must equal number of integers in domain
  N (int) – length of output list
  Seed (int) – randomness seed
  Inclusive (bool) – True -> include end, False -> exclude end
Output:
  a (list[int]) – randomized labels with exact counts
"""

__author__ = "FHarker"
__version__ = "2025.09.26"

import math, random

# --- helpers ---------------------------------------------------------------
def coerce_interval_to_int_ends(dom, inclusive=True):
    """Return (start, stop) with stop exclusive for Python range()."""
    if hasattr(dom, "T0") and hasattr(dom, "T1"):  # Rhino.Geometry.Interval
        s, e = dom.T0, dom.T1
    else:  # assume a 2-item sequence [start, end]
        s, e = dom[0], dom[1]
    s = int(math.floor(float(s)))
    e = int(math.floor(float(e)))
    if inclusive:
        return s, e + 1  # make end exclusive
    return s, e

def normalize_counts(total, percents):
    """Convert percents to integer counts that sum to total (largest-frac rule)."""
    ps = [float(p) for p in percents]
    s = sum(ps)
    if s <= 0:
        raise Exception("Percents must sum to a positive value.")
    ps = [p / s for p in ps]
    raw  = [p * total for p in ps]
    base = [int(math.floor(x)) for x in raw]
    rem  = int(total - sum(base))
    # give leftovers to largest fractional parts
    fracs = sorted(((raw[i] - base[i], i) for i in range(len(raw))), reverse=True)
    for j in range(rem):
        _, idx = fracs[j]
        base[idx] += 1
    return base

# --- coerce inputs ---------------------------------------------------------
Inclusive = bool(Inclusive)
start, stop = coerce_interval_to_int_ends(Domain, Inclusive)
values = list(range(start, stop))  # pure ints
k = len(values)
if k <= 0:
    raise Exception("Domain is empty. Check start/end and Inclusive flag.")

P = [float(p) for p in (Percents or [])]

# convenience: if user provides k-1 percents, fill the last as remainder (before normalize)
if len(P) == k - 1:
    P.append(max(0.0, 1.0 - sum(P)))

if len(P) != k:
    raise Exception("Length of Percents ({}) must equal number of integers in domain ({})."
                    .format(len(P), k))

N = int(round(float(N)))
Seed = 0 if Seed is None else int(round(float(Seed)))

# --- build randomized label list with exact counts -------------------------
counts = normalize_counts(N, P)  # list[int], sums to N

labels = []
for val, cnt in zip(values, counts):
    c = int(cnt)
    if c > 0:
        labels.extend([val] * c)

random.seed(Seed)
random.shuffle(labels)

a = labels  # list[int] length N
# ---------- end random_by_percentage ----------
sift = SiftPattern(List=area.Centroid, SiftPattern=random_by_percentage)  # -> flatten(Output0), flatten(Output1), flatten(Output2), flatten(Output3), flatten(Output4)
acoustic_locations = Point(sift.Output3)
wood_locations = Point(sift.Output0)
blank_locations = Point(sift.Output4)
wood_move_bound = Curve(<curve referenced from the Rhino model>)
led_move_bound = Curve(<curve referenced from the Rhino model>)
pin_move_bound = Curve(<curve referenced from the Rhino model>)
acoustic_move_bound = Curve(<curve referenced from the Rhino model>)
blank_move_bound = Curve(<curve referenced from the Rhino model>)
led_locations = Point(sift.Output1)
pin_locations = Point(sift.Output2)
area_4 = Area(Geometry=wood_move_bound)  # -> Area, Centroid
area_5 = Area(Geometry=pin_move_bound)  # -> Area, Centroid
area_6 = Area(Geometry=acoustic_move_bound)  # -> Area, Centroid
area_7 = Area(Geometry=led_move_bound)  # -> Area, Centroid
area_8 = Area(Geometry=blank_move_bound)  # -> Area, Centroid
ln_2 = Line(StartPoint=area_7.Centroid, EndPoint=led_locations)
ln_3 = Line(StartPoint=area_4.Centroid, EndPoint=wood_locations)
ln_4 = Line(StartPoint=area_5.Centroid, EndPoint=pin_locations)
ln_5 = Line(StartPoint=area_6.Centroid, EndPoint=acoustic_locations)
ln_6 = Line(StartPoint=area_8.Centroid, EndPoint=blank_locations)

# ----
# COMP. GEOMETRIES
wood_geo = Geometry(<brep referenced from the Rhino model>)
wood_led_geo = Geometry([<brep referenced from the Rhino model> x2])
acoustic_geo = Geometry(<brep referenced from the Rhino model>)
pin_geo = Geometry([<brep referenced from the Rhino model> x2])
blank_geo_2 = Geometry(<curve referenced from the Rhino model>)

move_2 = Move(Geometry=wood_geo, Motion=ln_3)  # -> Geometry, Transform
move_3 = Move(Geometry=graft(wood_led_geo), Motion=ln_2)  # -> Geometry, Transform
move_4 = Move(Geometry=graft(pin_geo), Motion=ln_4)  # -> Geometry, Transform
move_5 = Move(Geometry=acoustic_geo, Motion=ln_5)  # -> Geometry, Transform
move_6 = Move(Geometry=blank_geo_2, Motion=ln_6)  # -> Geometry, Transform

wood_led_geo_2 = Geometry(move_3.Geometry)
pin_geo_2 = Geometry(move_4.Geometry)
acoustic_geo_2 = Geometry(move_5.Geometry)
blank_geo_3 = Geometry(move_6.Geometry)
# FINAL OUTPUTS
wood_geo_2 = Geometry(move_2.Geometry)
