# Grasshopper definition building-facade.gh (Grasshopper 1.0.7)

crv = Curve(<curve referenced from the Rhino model>)
crv_2 = Curve(crv)
pop2d = Populate2D(Region=crv_2, Count=Slider(888, range=0..1000), Seed=Slider(3, range=0..10))
pt = Point(pop2d)

voronoi = Voronoi(Points=pt, Boundary=crv_2, BruteForceOverride=False)
crv_3 = Curve(<curve referenced from the Rhino model>)
area = Area(Geometry=voronoi)  # -> Area, Centroid
curve_attractor = CurveAttractor(C=crv_3, P=area.Centroid, A=Slider(0.22, range=0..1), B=Slider(0.77, range=0..1))  # -> R, points_on_curve_2
scale = Scale(Geometry=voronoi, Center=area.Centroid, Factor=curve_attractor.R)  # -> Geometry, Transform
crv_4 = Curve(scale.Geometry)

crv_5 = Curve(<curve referenced from the Rhino model>)
curve_attractor_2 = CurveAttractor(C=crv_5, P=pt, A=Slider(0, range=0..100), B=Slider(1, range=0..1))  # -> R, points_on_curve_2
division = Division(A=Slider(3, range=0..10), B=Slider(38, range=0..100))
larger = LargerThan(FirstNumber=curve_attractor_2.R, SecondNumber=division)  # -> LargerThan, OrEqualTo
cull = CullPattern(List=pt, CullPattern=invert(larger.LargerThan))
cull_2 = CullPattern(List=pt, CullPattern=larger.LargerThan)
culln = CullNth(List=cull, CullFrequency=Slider(2, range=0..10))
pt_2 = Point(flatten([cull_2, culln]))

crv_6 = Curve(<curve referenced from the Rhino model>)
crv_7 = Curve(<curve referenced from the Rhino model>)
crv_8 = Curve(<curve referenced from the Rhino model>)
bbx = BrepBrep(BrepA=crv_7, BrepB=crv_4)  # -> Curves, Points
bbx_2 = BrepBrep(BrepA=crv_8, BrepB=crv_4)  # -> Curves, Points
bbx_3 = BrepBrep(BrepA=crv_6, BrepB=crv_4)  # -> Curves, Points
crv_9 = Curve(bbx.Curves)
crv_10 = Curve(bbx_3.Curves)
crv_11 = Curve(bbx_2.Curves)

voronoi_2 = Voronoi(Points=pt_2, Boundary=crv_2, BruteForceOverride=False)
crv_12 = Curve(<curve referenced from the Rhino model>)
area_2 = Area(Geometry=voronoi_2)  # -> Area, Centroid
curve_attractor_3 = CurveAttractor(C=crv_12, P=area_2.Centroid, A=Slider(0.22, range=0..1), B=Slider(0.77, range=0..1))  # -> R, points_on_curve_2
scale_2 = Scale(Geometry=voronoi_2, Center=area_2.Centroid, Factor=curve_attractor_3.R)  # -> Geometry, Transform
crv_13 = Curve(scale_2.Geometry)

crv_14 = Curve(<curve referenced from the Rhino model>)
curve_attractor_4 = CurveAttractor(C=crv_14, P=pt_2, A=Slider(0, range=0..100), B=Slider(1, range=0..1))  # -> R, points_on_curve_2
division_2 = Division(A=Slider(6, range=0..10), B=Slider(38, range=0..100))
larger_2 = LargerThan(FirstNumber=curve_attractor_4.R, SecondNumber=division_2)  # -> LargerThan, OrEqualTo
cull_3 = CullPattern(List=pt_2, CullPattern=invert(larger_2.LargerThan))
cull_4 = CullPattern(List=pt_2, CullPattern=larger_2.LargerThan)
culln_2 = CullNth(List=cull_3, CullFrequency=Slider(2, range=0..10))
pt_3 = Point([cull_4, culln_2])
pt_4 = Point(flatten(pt_3))

crv_15 = Curve(<curve referenced from the Rhino model>)
crv_16 = Curve(<curve referenced from the Rhino model>)
crv_17 = Curve(<curve referenced from the Rhino model>)
bbx_4 = BrepBrep(BrepA=crv_16, BrepB=crv_13)  # -> Curves, Points
bbx_5 = BrepBrep(BrepA=crv_17, BrepB=crv_13)  # -> Curves, Points
bbx_6 = BrepBrep(BrepA=crv_15, BrepB=crv_13)  # -> Curves, Points
crv_18 = Curve(bbx_4.Curves)
crv_19 = Curve(bbx_6.Curves)
crv_20 = Curve(bbx_5.Curves)
crv_21 = Curve([crv_18, crv_19])
crv_22 = Curve(crv_20)

crv_23 = Curve(<curve referenced from the Rhino model>)
curve_attractor_5 = CurveAttractor(C=crv_23, P=pt_4, A=Slider(0, range=0..100), B=Slider(1, range=0..1))  # -> R, points_on_curve_2
division_3 = Division(A=Slider(9, range=0..10), B=Slider(38, range=0..100))
larger_3 = LargerThan(FirstNumber=curve_attractor_5.R, SecondNumber=division_3)  # -> LargerThan, OrEqualTo
cull_5 = CullPattern(List=pt_4, CullPattern=invert(larger_3.LargerThan))
cull_6 = CullPattern(List=pt_4, CullPattern=larger_3.LargerThan)
culln_3 = CullNth(List=cull_5, CullFrequency=Slider(2, range=0..10))
pt_5 = Point(flatten([cull_6, culln_3]))

voronoi_3 = Voronoi(Points=pt_4, Boundary=crv_2, BruteForceOverride=False)
crv_24 = Curve(<curve referenced from the Rhino model>)
area_3 = Area(Geometry=voronoi_3)  # -> Area, Centroid
curve_attractor_6 = CurveAttractor(C=crv_24, P=area_3.Centroid, A=Slider(0.22, range=0..1), B=Slider(0.77, range=0..1))  # -> R, points_on_curve_2
scale_3 = Scale(Geometry=voronoi_3, Center=area_3.Centroid, Factor=curve_attractor_6.R)  # -> Geometry, Transform
crv_25 = Curve(scale_3.Geometry)

crv_26 = Curve(<curve referenced from the Rhino model>)
crv_27 = Curve(<curve referenced from the Rhino model>)
crv_28 = Curve(<curve referenced from the Rhino model>)
crv_29 = Curve(crv_25)
bbx_7 = BrepBrep(BrepA=crv_27, BrepB=crv_29)  # -> Curves, Points
bbx_8 = BrepBrep(BrepA=crv_28, BrepB=crv_29)  # -> Curves, Points
bbx_9 = BrepBrep(BrepA=crv_26, BrepB=crv_29)  # -> Curves, Points
crv_30 = Curve(bbx_7.Curves)
crv_31 = Curve(bbx_9.Curves)
crv_32 = Curve(bbx_8.Curves)

voronoi_4 = Voronoi(Points=pt_5, Boundary=crv_2, BruteForceOverride=False)
crv_33 = Curve(<curve referenced from the Rhino model>)
area_4 = Area(Geometry=voronoi_4)  # -> Area, Centroid
curve_attractor_7 = CurveAttractor(C=crv_33, P=area_4.Centroid, A=Slider(0.22, range=0..1), B=Slider(0.77, range=0..1))  # -> R, points_on_curve_2
scale_4 = Scale(Geometry=voronoi_4, Center=area_4.Centroid, Factor=curve_attractor_7.R)  # -> Geometry, Transform
crv_34 = Curve(scale_4.Geometry)

pt_6 = Point(flatten(pt_5))
crv_35 = Curve(<curve referenced from the Rhino model>)
curve_attractor_8 = CurveAttractor(C=crv_35, P=pt_6, A=Slider(0, range=0..100), B=Slider(1, range=0..1))  # -> R, points_on_curve_2
division_4 = Division(A=Slider(12, range=0..100), B=Slider(38, range=0..100))
larger_4 = LargerThan(FirstNumber=curve_attractor_8.R, SecondNumber=division_4)  # -> LargerThan, OrEqualTo
cull_7 = CullPattern(List=pt_6, CullPattern=invert(larger_4.LargerThan))
cull_8 = CullPattern(List=pt_6, CullPattern=larger_4.LargerThan)
culln_4 = CullNth(List=cull_7, CullFrequency=Slider(2, range=0..10))
pt_7 = Point(flatten([cull_8, culln_4]))

crv_36 = Curve(<curve referenced from the Rhino model>)
crv_37 = Curve(<curve referenced from the Rhino model>)
crv_38 = Curve(<curve referenced from the Rhino model>)
crv_39 = Curve(crv_34)
bbx_10 = BrepBrep(BrepA=crv_37, BrepB=crv_39)  # -> Curves, Points
bbx_11 = BrepBrep(BrepA=crv_38, BrepB=crv_39)  # -> Curves, Points
bbx_12 = BrepBrep(BrepA=crv_36, BrepB=crv_39)  # -> Curves, Points
crv_40 = Curve(bbx_10.Curves)
crv_41 = Curve(bbx_12.Curves)
crv_42 = Curve(bbx_11.Curves)

voronoi_5 = Voronoi(Points=pt_7, Boundary=crv_2, BruteForceOverride=False)
crv_43 = Curve(<curve referenced from the Rhino model>)
area_5 = Area(Geometry=voronoi_5)  # -> Area, Centroid
curve_attractor_9 = CurveAttractor(C=crv_43, P=area_5.Centroid, A=Slider(0.22, range=0..1), B=Slider(0.77, range=0..1))  # -> R, points_on_curve_2
scale_5 = Scale(Geometry=voronoi_5, Center=area_5.Centroid, Factor=curve_attractor_9.R)  # -> Geometry, Transform
crv_44 = Curve(scale_5.Geometry)

crv_45 = Curve(<curve referenced from the Rhino model>)
crv_46 = Curve(<curve referenced from the Rhino model>)
crv_47 = Curve(<curve referenced from the Rhino model>)
crv_48 = Curve(crv_44)
bbx_13 = BrepBrep(BrepA=crv_46, BrepB=crv_48)  # -> Curves, Points
bbx_14 = BrepBrep(BrepA=crv_47, BrepB=crv_48)  # -> Curves, Points
bbx_15 = BrepBrep(BrepA=crv_45, BrepB=crv_48)  # -> Curves, Points
crv_49 = Curve(bbx_13.Curves)
crv_50 = Curve(bbx_15.Curves)
crv_51 = Curve(bbx_14.Curves)

# ==== cluster CurveAttractor: Utility
C = ClusterInput()
P = ClusterInput()
x = ClusterInput()
A = ClusterInput()
B = ClusterInput()
crv_cp = CurveClosestPoint(Point=P, Curve=C)  # -> Point, Parameter, Distance
dom = ConstructDomain(DomainStart=A, DomainEnd=B)
bnd = Bounds(Numbers=crv_cp.Distance)
remap = RemapNumbers(Value=crv_cp.Distance, Source=bnd, Target=dom)  # -> Mapped, Clipped
R = ClusterOutput(remap.Mapped)
points_on_curve = Point(crv_cp.Point)
points_on_curve_2 = ClusterOutput(points_on_curve)
