# Grasshopper definition split-geo-planes-build-definition.gh (Grasshopper 1.0.7)
# plug-ins: OpenNest

# ----
# PRE-REQUISITE INPUTS
geo = Geometry(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)
geo_2 = Geometry(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)
geo_3 = Geometry(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)
geo_4 = Geometry(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)

geo_5 = Geometry([geo, geo_3, geo_2, geo_4])
# HEIGHT OF OBJ. W/O BASE (FT)
number_slider = Slider(6.9, range=0..10)

# ----
# SCALE (GENERAL)
bbox = BoundingBox(Content=geo, Plane=PlaneXY(0, 0, 0))  # -> Box, Box_2
debox = DeconstructBox(Box=bbox.Box)  # -> Plane, X, Y, Z
num = Number(debox.Z)
division = Division(A=number_slider, B=num)
scale = Scale(Geometry=geo_5, Center=Point(0, 0, 0), Factor=division)  # -> Geometry, Transform
item = ListItem(List=scale.Geometry, Index=0, Wrap=True)  # -> Item, Item1, Item2, Item3
geo_6 = Geometry(item.Item3)
geo_7 = Geometry(item.Item)
geo_8 = Geometry(item.Item1)
geo_9 = Geometry(item.Item2)

# ----
# DIST. BTWN CONTOURS (IN)
number_slider_2 = Slider(1.25, range=0..100)
# CNTR. DIRECTION
pt = Point(Point(1, 0, 0))

# ----
# CONTOURS
num_2 = Number(12)
division_2 = Division(A=number_slider_2, B=num_2)
contour = Contour(Shape=geo_7, Point=Point(0, 0, 0), Direction=pt, Distance=division_2)  # -> flatten(Contours)
crv = Curve(contour)

number_slider_3 = Slider(0.125, range=0..1)  # disabled
# MATERIAL THICKNESS (IN)
number_slider_4 = Slider(12, range=0..100)  # disabled

# ----
# EXTRUSION/MAT. THICKNESS
crv_2 = Curve(crv)  # disabled
boundary = BoundarySurfaces(Edges=crv_2)  # disabled
srf = Surface(boundary)  # disabled
division_3 = Division(A=number_slider_3, B=number_slider_4)  # disabled
num_3 = Number(2)  # disabled
division_4 = Division(A=division_3, B=num_3)  # disabled
X = UnitX(Factor=division_3)  # disabled
neg = Negative(Value=division_4)  # disabled
extr = Extrude(Base=srf, Direction=X)  # disabled
X_2 = UnitX(Factor=neg)  # disabled
move = Move(Geometry=extr, Motion=X_2)  # -> Geometry, Transform; disabled

# ----
# SPACE BTW. ITEMS (FT)
number_slider_5 = Slider(0.125, range=0..1)

# ----
# STOCK MAT. SIZE
number_slider_6 = Slider(10, range=0..100)

crv_3 = Curve(crv)
area = Area(Geometry=crv_3)  # -> Area, Centroid
# GEOS. TO PACK AND MAT. SIZE
yz = YZPlane(Origin=area.Centroid)
pack = PackObjects(Geo=crv_3, Plane=yz, X=number_slider_5, Y=1, Tolerabce=0)  # -> Geo, Transformation
pt_2 = Point(Point(0, 0, 0))
bbox_2 = BoundingBox(Content=pack.Geo, Plane=PlaneXY(0, 0, 0), UnionBox=True)  # -> Box, Box_2
rectangle = Rectangle(Plane=pt_2, XSize=number_slider_6, YSize=Slider(5, range=0..100), Radius=0)  # -> Rectangle, Length
debox_2 = DeconstructBox(Box=bbox_2.Box)  # -> Plane, X, Y, Z
num_4 = Number(debox_2.Y)

# ----
# SPLIT LOCATION AND QTY.
number_slider_7 = Slider(3, range=0..10)

division_5 = Division(A=num_4, B=number_slider_7)
neg_2 = Negative(Value=division_5)
num_5 = Number(0)
# GEOS. SPLIT FOR PACKING
num_6 = Number(0)
Y = UnitY(Factor=neg_2)
pt_3 = ConstructPoint(XCoordinate=num_5, YCoordinate=neg_2, ZCoordinate=num_5)
pt_4 = ConstructPoint(XCoordinate=debox_2.X, YCoordinate=neg_2, ZCoordinate=num_6)
arrlinear = LinearArray(Geometry=pt_3, Direction=Y, Count=number_slider_7)  # -> Geometry, Transform
arrlinear_2 = LinearArray(Geometry=pt_4, Direction=Y, Count=number_slider_7)  # -> Geometry, Transform
ln = Line(StartPoint=arrlinear.Geometry, EndPoint=arrlinear_2.Geometry)

geo_10 = Geometry(move.Geometry)  # disabled
# ITERATIONS (CAUTION)
number_slider_8 = Slider(1, range=0..10)  # disabled
# DIST. BTWN CONTOURS (IN)
number_slider_9 = Slider(1.11, range=0..10)

# ----
# GEO PACKING
srfsplit = SurfaceSplit(Surface=pack.Geo, Curves=ln)  # -> flatten(Fragments); disabled
num_7 = Number(12)
crv_4 = Curve(srfsplit)  # disabled
division_6 = Division(A=number_slider_9, B=num_7)
opennest = OpenNest(
    Sheets=rectangle.Rectangle,
    Geo=crv_4,
    Spacing=division_6,
    Placement=1,
    Tolerance=0.1,
    Rotations=4,
    Iterations=number_slider_8,
    Seed=1,
    Reset=True,
    Run=False)  # -> Sheets, Geo, ID, Transform, IDS; disabled

crv_5 = Curve(opennest.Sheets)
crv_6 = Curve(opennest.Geo)

area_2 = Area(Geometry=crv_5)  # -> Area, Centroid
lng = ListLength(List=crv_5)
area_3 = Area(Geometry=crv_6)  # -> Area, Centroid
ma = MassAddition(Input=area_2.Area)  # -> Result, PartialResults
ma_2 = MassAddition(Input=area_3.Area)  # -> Result, PartialResults
# ANALYTICS TOOLS
division_7 = Division(A=ma_2.Result, B=ma.Result)
subtraction = Subtraction(A=ma.Result, B=ma_2.Result)
multiplication = Multiplication(A=division_7, B=100)

total_sheet_area_sqft = Panel(ma.Result)
percentage_waste = Panel(multiplication)
# CONDITIONS: MAX. HEIGHT
# 10' - 0"
# 
# # OF PANEL SPLITS
# 3
# 
# PANEL SPACING
# 1.25"
# 
# SHEET SIZE
# 5' X 10'
# 
# ***NOTE: ALL CALCULATIONS FOR ONE STATUE***
qty_sheets = Panel(lng)
cut_area_sqft = Panel(ma_2.Result)
area_waste_sqft = Panel(subtraction)

# ----
# PRE-REQUISITE INPUTS
geo_11 = Geometry(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)
geo_12 = Geometry(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)
geo_13 = Geometry(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)
geo_14 = Geometry(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)

geo_15 = Geometry([geo_11, geo_14, geo_12, geo_13])
# HEIGHT OF OBJ. W/O BASE (FT)
number_slider_10 = Slider(8.5, range=0..10)

# ----
# SCALE (GENERAL)
bbox_3 = BoundingBox(Content=geo_11, Plane=PlaneXY(0, 0, 0))  # -> Box, Box_2
debox_3 = DeconstructBox(Box=bbox_3.Box)  # -> Plane, X, Y, Z
num_8 = Number(debox_3.Z)
division_8 = Division(A=number_slider_10, B=num_8)
scale_2 = Scale(Geometry=geo_15, Center=Point(0, 0, 0), Factor=division_8)  # -> Geometry, Transform
item_2 = ListItem(List=scale_2.Geometry, Index=0, Wrap=True)  # -> Item, Item1, Item2, Item3
geo_16 = Geometry(item_2.Item3)
geo_17 = Geometry(item_2.Item)
geo_18 = Geometry(item_2.Item1)
geo_19 = Geometry(item_2.Item2)

# ----
# BASE INSET DIST. (IN)
number_slider_11 = Slider(4, range=0..10)

num_9 = Number(12)
division_9 = Division(A=number_slider_11, B=num_9)
Z = UnitZ(Factor=division_9)
neg_3 = Negative(Value=Z)
# GEO MOVE
move_2 = Move(Geometry=geo_17, Motion=neg_3)  # -> Geometry, Transform
geo_20 = Geometry(move_2.Geometry)

# ----
# DIST. BTWN CONTOURS (IN)
number_slider_12 = Slider(2, range=0..100)
# CNTR. DIRECTION
pt_5 = Point(Point(1, 0, 0))

# ----
# CONTOURS
num_10 = Number(12)
division_10 = Division(A=number_slider_12, B=num_10)
contour_2 = Contour(Shape=geo_20, Point=Point(0, 0, 0), Direction=pt_5, Distance=division_10)  # -> flatten(Contours)
crv_7 = Curve(contour_2)

boundary_2 = BoundarySurfaces(Edges=crv_7)
shapein = ShapeInBrep(Brep=geo_14, Shape=boundary_2)
num_11 = Number(1)
# CULL SURFS.
equals = Equality(FirstNumber=shapein, SecondNumber=num_11)  # -> Equality, Inequality
cull = CullPattern(List=boundary_2, CullPattern=equals.Equality)

number_slider_13 = Slider(0.125, range=0..1)  # disabled
# MATERIAL THICKNESS (IN)
number_slider_14 = Slider(12, range=0..100)  # disabled

# ----
# EXTRUSION/MAT. THICKNESS
crv_8 = Curve(crv_7)  # disabled
boundary_3 = BoundarySurfaces(Edges=crv_8)  # disabled
srf_2 = Surface(boundary_3)  # disabled
division_11 = Division(A=number_slider_13, B=number_slider_14)  # disabled
num_12 = Number(2)  # disabled
division_12 = Division(A=division_11, B=num_12)  # disabled
X_3 = UnitX(Factor=division_11)  # disabled
neg_4 = Negative(Value=division_12)  # disabled
extr_2 = Extrude(Base=srf_2, Direction=X_3)  # disabled
X_4 = UnitX(Factor=neg_4)  # disabled
move_3 = Move(Geometry=extr_2, Motion=X_4)  # -> Geometry, Transform; disabled

srf_3 = Surface(cull)
geo_21 = Geometry(move_3.Geometry)  # disabled
