# Grasshopper definition louver-fence.gh (Grasshopper 1.0.7)

curve_a = Curve(<curve referenced from the Rhino model>)
# BASE CURVE INPUTS
curve_c = Curve(<curve referenced from the Rhino model>)
curve_b = Curve(<curve referenced from the Rhino model>)

curve_a_2 = Curve(<curve referenced from the Rhino model>)
curve_b_2 = Curve(<curve referenced from the Rhino model>)
# BASE CURVE INPUTS
curve_c_2 = Curve(<curve referenced from the Rhino model>)

# ----
# LOUVER SPACING DISTANCE
number_slider = Slider(18, range=0..100)
num = Number(number_slider)

# ----
# LOUVER SPACING DISTANCE
number_slider_2 = Slider(18, range=0..100)
num_2 = Number(number_slider_2)

crv = Curve(curve_b)
divdist = DivideDistance(Curve=crv, Distance=num)  # -> flatten(Points), flatten(Tangents), Parameters
lng = ListLength(List=divdist.Points)
panel = Panel(lng)

crv_2 = Curve(curve_c)
divdist_2 = DivideDistance(Curve=crv_2, Distance=num)  # -> flatten(Points), flatten(Tangents), Parameters
lng_2 = ListLength(List=divdist_2.Points)
panel_2 = Panel(lng_2)

# ----
# CURVE-ATTRACTED EXTRUSION
# CURVE AND POINTS
crv_3 = Curve(curve_a)
divdist_3 = DivideDistance(Curve=crv_3, Distance=num)  # -> flatten(Points), flatten(Tangents), Parameters
lng_3 = ListLength(List=divdist_3.Points)
panel_3 = Panel(lng_3)

crv_4 = Curve(curve_b_2)
divdist_4 = DivideDistance(Curve=crv_4, Distance=num_2)  # -> flatten(Points), flatten(Tangents), Parameters
lng_4 = ListLength(List=divdist_4.Points)
panel_4 = Panel(lng_4)

crv_5 = Curve(curve_c_2)
divdist_5 = DivideDistance(Curve=crv_5, Distance=num_2)  # -> flatten(Points), flatten(Tangents), Parameters
lng_5 = ListLength(List=divdist_5.Points)
panel_5 = Panel(lng_5)

# ----
# POINT-ATTRACTED EXTRUSION
# CURVE AND POINTS
crv_6 = Curve(curve_a_2)
divdist_6 = DivideDistance(Curve=crv_6, Distance=num_2)  # -> flatten(Points), flatten(Tangents), Parameters
lng_6 = ListLength(List=divdist_6.Points)
panel_6 = Panel(lng_6)

pt = Point(divdist.Points)
vec = Vector(divdist.Tangents)

pt_2 = Point(divdist_3.Points)
vec_2 = Vector(divdist_3.Tangents)

pt_3 = Point(divdist_2.Points)
vec_3 = Vector(divdist_2.Tangents)

pt_4 = Point(divdist_4.Points)
vec_4 = Vector(divdist_4.Tangents)

pt_5 = Point(divdist_6.Points)
vec_5 = Vector(divdist_6.Tangents)

pt_6 = Point(divdist_5.Points)
vec_6 = Vector(divdist_5.Tangents)

ma = MassAddition(Input=[panel_3, panel, panel_2])  # -> Result, PartialResults
ma_2 = MassAddition(Input=[panel_6, panel_4, panel_5])  # -> Result, PartialResults
panel_7 = Panel(ma_2.Result)

pt_7 = Point(pt_3)
vec_7 = Vector(vec_3)

pt_8 = Point(pt)
vec_8 = Vector(vec)

pt_9 = Point(pt_6)
vec_9 = Vector(vec_6)

pt_10 = Point(pt_4)
vec_10 = Vector(vec_4)

# ----
# LOUVER PLACEMENT
pt_11 = Point(pt_2)
vec_11 = Vector(vec_2)

# ----
# LOUVER PLACEMENT
pt_12 = Point(pt_5)
vec_12 = Vector(vec_5)

# ----
# LOUVER DIMENSIONS
number_slider_3 = Slider(4, range=0..100)

# ----
# LOUVER DIMENSIONS
number_slider_4 = Slider(4, range=0..100)

num_3 = Number(Slider(10, range=0..100))
num_4 = Number(number_slider_3)

int = Integer(90)
rotate = Rotate(Geometry=vec_7, Angle=degrees(int), Plane=PlaneXY(0, 0, 0))  # -> Geometry, Transform
pt_13 = Point(rotate.Geometry)
line = LineSDL(Start=pt_7, Direction=pt_13, Length=num_3)
end = EndPoints(Curve=line)  # -> Start, End
line_2 = LineSDL(Start=end.End, Direction=vec_7, Length=num_4)
end_2 = EndPoints(Curve=line_2)  # -> Start, End
rec_3pt = Rectangle3Pt(PointA=end.Start, PointB=end.End, PointC=end_2.End)  # -> Rectangle, Length
area = Area(Geometry=rec_3pt.Rectangle)  # -> Area, Centroid
ln = Line(StartPoint=area.Centroid, EndPoint=pt_7)
move = Move(Geometry=rec_3pt.Rectangle, Motion=ln)  # -> Geometry, Transform
srf = Surface(move.Geometry)
srf_2 = Surface(srf)

int_2 = Integer(90)
rotate_2 = Rotate(Geometry=vec_8, Angle=degrees(int_2), Plane=PlaneXY(0, 0, 0))  # -> Geometry, Transform
pt_14 = Point(rotate_2.Geometry)
line_3 = LineSDL(Start=pt_8, Direction=pt_14, Length=num_3)
end_3 = EndPoints(Curve=line_3)  # -> Start, End
line_4 = LineSDL(Start=end_3.End, Direction=vec_8, Length=num_4)
end_4 = EndPoints(Curve=line_4)  # -> Start, End
rec_3pt_2 = Rectangle3Pt(PointA=end_3.Start, PointB=end_3.End, PointC=end_4.End)  # -> Rectangle, Length
area_2 = Area(Geometry=rec_3pt_2.Rectangle)  # -> Area, Centroid
ln_2 = Line(StartPoint=area_2.Centroid, EndPoint=pt_8)
move_2 = Move(Geometry=rec_3pt_2.Rectangle, Motion=ln_2)  # -> Geometry, Transform
srf_3 = Surface(move_2.Geometry)
srf_4 = Surface(srf_3)

int_3 = Integer(90)
rotate_3 = Rotate(Geometry=vec_11, Angle=degrees(int_3), Plane=PlaneXY(0, 0, 0))  # -> Geometry, Transform
pt_15 = Point(rotate_3.Geometry)
line_5 = LineSDL(Start=pt_11, Direction=pt_15, Length=num_3)
end_5 = EndPoints(Curve=line_5)  # -> Start, End
line_6 = LineSDL(Start=end_5.End, Direction=vec_11, Length=num_4)
end_6 = EndPoints(Curve=line_6)  # -> Start, End
rec_3pt_3 = Rectangle3Pt(PointA=end_5.Start, PointB=end_5.End, PointC=end_6.End)  # -> Rectangle, Length
area_3 = Area(Geometry=rec_3pt_3.Rectangle)  # -> Area, Centroid
ln_3 = Line(StartPoint=area_3.Centroid, EndPoint=pt_11)
move_3 = Move(Geometry=rec_3pt_3.Rectangle, Motion=ln_3)  # -> Geometry, Transform
srf_5 = Surface(move_3.Geometry)
srf_6 = Surface(srf_5)

num_5 = Number(Slider(10, range=0..100))
num_6 = Number(number_slider_4)

int_4 = Integer(90)
rotate_4 = Rotate(Geometry=vec_9, Angle=degrees(int_4), Plane=PlaneXY(0, 0, 0))  # -> Geometry, Transform
pt_16 = Point(rotate_4.Geometry)
line_7 = LineSDL(Start=pt_9, Direction=pt_16, Length=num_5)
end_7 = EndPoints(Curve=line_7)  # -> Start, End
line_8 = LineSDL(Start=end_7.End, Direction=vec_9, Length=num_6)
end_8 = EndPoints(Curve=line_8)  # -> Start, End
rec_3pt_4 = Rectangle3Pt(PointA=end_7.Start, PointB=end_7.End, PointC=end_8.End)  # -> Rectangle, Length
area_4 = Area(Geometry=rec_3pt_4.Rectangle)  # -> Area, Centroid
ln_4 = Line(StartPoint=area_4.Centroid, EndPoint=pt_9)
move_4 = Move(Geometry=rec_3pt_4.Rectangle, Motion=ln_4)  # -> Geometry, Transform
srf_7 = Surface(move_4.Geometry)
srf_8 = Surface(srf_7)

int_5 = Integer(90)
rotate_5 = Rotate(Geometry=vec_10, Angle=degrees(int_5), Plane=PlaneXY(0, 0, 0))  # -> Geometry, Transform
pt_17 = Point(rotate_5.Geometry)
line_9 = LineSDL(Start=pt_10, Direction=pt_17, Length=num_5)
end_9 = EndPoints(Curve=line_9)  # -> Start, End
line_10 = LineSDL(Start=end_9.End, Direction=vec_10, Length=num_6)
end_10 = EndPoints(Curve=line_10)  # -> Start, End
rec_3pt_5 = Rectangle3Pt(PointA=end_9.Start, PointB=end_9.End, PointC=end_10.End)  # -> Rectangle, Length
area_5 = Area(Geometry=rec_3pt_5.Rectangle)  # -> Area, Centroid
ln_5 = Line(StartPoint=area_5.Centroid, EndPoint=pt_10)
move_5 = Move(Geometry=rec_3pt_5.Rectangle, Motion=ln_5)  # -> Geometry, Transform
srf_9 = Surface(move_5.Geometry)
srf_10 = Surface(srf_9)

int_6 = Integer(90)
rotate_6 = Rotate(Geometry=vec_12, Angle=degrees(int_6), Plane=PlaneXY(0, 0, 0))  # -> Geometry, Transform
pt_18 = Point(rotate_6.Geometry)
line_11 = LineSDL(Start=pt_12, Direction=pt_18, Length=num_5)
end_11 = EndPoints(Curve=line_11)  # -> Start, End
line_12 = LineSDL(Start=end_11.End, Direction=vec_12, Length=num_6)
end_12 = EndPoints(Curve=line_12)  # -> Start, End
rec_3pt_6 = Rectangle3Pt(PointA=end_11.Start, PointB=end_11.End, PointC=end_12.End)  # -> Rectangle, Length
area_6 = Area(Geometry=rec_3pt_6.Rectangle)  # -> Area, Centroid
ln_6 = Line(StartPoint=area_6.Centroid, EndPoint=pt_12)
move_6 = Move(Geometry=rec_3pt_6.Rectangle, Motion=ln_6)  # -> Geometry, Transform
srf_11 = Surface(move_6.Geometry)
srf_12 = Surface(srf_11)

crv_7 = Curve(<curve referenced from the Rhino model>)
# REMOVAL ATTRACTOR
crv_8 = Curve(<curve referenced from the Rhino model>)
mirror = MirrorCurve(Geometry=crv_7, Curve=crv_8, Tangent=True)
crv_9 = Curve(mirror)
crv_10 = Curve(crv_7)

crv_11 = Curve(<curve referenced from the Rhino model>)
# REMOVAL ATTRACTOR
crv_12 = Curve(<curve referenced from the Rhino model>)
mirror_2 = MirrorCurve(Geometry=crv_11, Curve=crv_12, Tangent=True)
crv_13 = Curve(mirror_2)
crv_14 = Curve(crv_11)

crv_15 = Curve(crv_13)
crv_16 = Curve(crv_14)

# ----
# ITEMS TO REMOVE
number_slider_5 = Slider(0.025, range=0..1)
num_7 = Number(number_slider_5)

srf_13 = Surface(srf_6)
area_7 = Area(Geometry=srf_13)  # -> Area, Centroid
curve_attractor = CurveAttractor(C=crv_10, P=area_7.Centroid, A=Slider(0, range=0..100), B=Slider(1, range=0..1))  # -> R, points_on_curve_2
num_8 = Number(curve_attractor.R)
bnd = Bounds(Numbers=num_8)
remap = RemapNumbers(Value=num_8, Source=bnd, Target=Domain(0, 1))  # -> Mapped, Clipped
smaller = SmallerThan(FirstNumber=remap.Mapped, SecondNumber=num_7)  # -> SmallerThan, OrEqualTo
cull = CullPattern(List=srf_13, CullPattern=invert(smaller.SmallerThan))
srf_14 = Surface(cull)

srf_15 = Surface(srf_2)
area_8 = Area(Geometry=srf_15)  # -> Area, Centroid
curve_attractor_2 = CurveAttractor(C=crv_9, P=area_8.Centroid, A=Slider(0, range=0..100), B=Slider(1, range=0..1))  # -> R, points_on_curve_2
num_9 = Number(curve_attractor_2.R)
bnd_2 = Bounds(Numbers=num_9)
remap_2 = RemapNumbers(Value=num_9, Source=bnd_2, Target=Domain(0, 1))  # -> Mapped, Clipped
smaller_2 = SmallerThan(FirstNumber=remap_2.Mapped, SecondNumber=num_7)  # -> SmallerThan, OrEqualTo
cull_2 = CullPattern(List=srf_15, CullPattern=invert(smaller_2.SmallerThan))
srf_16 = Surface(cull_2)

# ----
# ITEMS TO REMOVE
number_slider_6 = Slider(0.025, range=0..1)
num_10 = Number(number_slider_6)

srf_17 = Surface(srf_12)
area_9 = Area(Geometry=srf_17)  # -> Area, Centroid
curve_attractor_3 = CurveAttractor(C=crv_16, P=area_9.Centroid, A=Slider(0, range=0..100), B=Slider(1, range=0..1))  # -> R, points_on_curve_2
num_11 = Number(curve_attractor_3.R)
bnd_3 = Bounds(Numbers=num_11)
remap_3 = RemapNumbers(Value=num_11, Source=bnd_3, Target=Domain(0, 1))  # -> Mapped, Clipped
smaller_3 = SmallerThan(FirstNumber=remap_3.Mapped, SecondNumber=num_10)  # -> SmallerThan, OrEqualTo
cull_3 = CullPattern(List=srf_17, CullPattern=invert(smaller_3.SmallerThan))
srf_18 = Surface(cull_3)

srf_19 = Surface(srf_8)
area_10 = Area(Geometry=srf_19)  # -> Area, Centroid
curve_attractor_4 = CurveAttractor(C=crv_15, P=area_10.Centroid, A=Slider(0, range=0..100), B=Slider(1, range=0..1))  # -> R, points_on_curve_2
num_12 = Number(curve_attractor_4.R)
bnd_4 = Bounds(Numbers=num_12)
remap_4 = RemapNumbers(Value=num_12, Source=bnd_4, Target=Domain(0, 1))  # -> Mapped, Clipped
smaller_4 = SmallerThan(FirstNumber=remap_4.Mapped, SecondNumber=num_10)  # -> SmallerThan, OrEqualTo
cull_4 = CullPattern(List=srf_19, CullPattern=invert(smaller_4.SmallerThan))
srf_20 = Surface(cull_4)

# ----
# LOUVER EXTRUSION/ATTRACTORS
number_slider_7 = Slider(16, range=0..100)

crv_17 = Curve(<curve referenced from the Rhino model>)
crv_18 = Curve(<curve referenced from the Rhino model>)
mirror_3 = MirrorCurve(Geometry=crv_17, Curve=crv_18, Tangent=True)
crv_19 = Curve(mirror_3)
crv_20 = Curve(<curve referenced from the Rhino model>)
crv_21 = Curve(crv_17)
crv_22 = Curve(crv_19)
crv_23 = Curve(crv_20)
_12 = Integer(12)
multiplication = Multiplication(A=Slider(5, range=0..100), B=_12)
multiplication_2 = Multiplication(A=number_slider_7, B=_12)
num_13 = Number(multiplication_2)
num_14 = Number(multiplication)

# ----
# LOUVER EXTRUSION/ATTRACTORS
number_slider_8 = Slider(16, range=0..100)

srf_21 = Surface(srf_4)
area_11 = Area(Geometry=srf_21)  # -> Area, Centroid
curve_attractor_5 = CurveAttractor(C=crv_23, P=area_11.Centroid, A=num_14, B=num_13)  # -> R, points_on_curve_2
num_15 = Number(curve_attractor_5.R)
Z = UnitZ(Factor=num_15)
extr = Extrude(Base=srf_21, Direction=Z)
brep = Brep(extr)

# ----
# VARIABLE EXTRUSIONS
srf_22 = Surface(srf_14)
area_12 = Area(Geometry=srf_22)  # -> Area, Centroid
curve_attractor_6 = CurveAttractor(C=crv_21, P=area_12.Centroid, A=num_14, B=num_13)  # -> R, points_on_curve_2
num_16 = Number(curve_attractor_6.R)
Z_2 = UnitZ(Factor=num_16)
extr_2 = Extrude(Base=srf_22, Direction=Z_2)
brep_2 = Brep(extr_2)

srf_23 = Surface(srf_16)
area_13 = Area(Geometry=srf_23)  # -> Area, Centroid
curve_attractor_7 = CurveAttractor(C=crv_22, P=area_13.Centroid, A=num_14, B=num_13)  # -> R, points_on_curve_2
num_17 = Number(curve_attractor_7.R)
Z_3 = UnitZ(Factor=num_17)
extr_3 = Extrude(Base=srf_23, Direction=Z_3)
brep_3 = Brep(extr_3)

num_18 = Number(Slider(0.4, range=0..1))
num_19 = Number(Slider(0.4, range=0..1))
num_20 = Number(Slider(0.4, range=0..1))

_12_2 = Integer(12)
multiplication_3 = Multiplication(A=Slider(5, range=0..100), B=_12_2)
multiplication_4 = Multiplication(A=number_slider_8, B=_12_2)
num_21 = Number(multiplication_4)
num_22 = Number(multiplication_3)

# ----
# COST PER LIN. FT.
number_slider_9 = Slider(16, range=0..100)
num_23 = Number(number_slider_9)

# ----
# COST PER LIN. FT.
number_slider_10 = Slider(16, range=0..100)
num_24 = Number(number_slider_10)

ma_3 = MassAddition(Input=num_15)  # -> Result, PartialResults
_12_3 = Integer(12)
division = Division(A=ma_3.Result, B=_12_3)
multiplication_5 = Multiplication(A=division, B=num_23)
linear_units = Panel(division)
est_cost = Panel(multiplication_5)

# ----
# MATERIAL AND COST ANALYSIS
ma_4 = MassAddition(Input=num_16)  # -> Result, PartialResults
_12_4 = Integer(12)
division_2 = Division(A=ma_4.Result, B=_12_4)
multiplication_6 = Multiplication(A=division_2, B=num_23)
linear_units_2 = Panel(division_2)
est_cost_2 = Panel(multiplication_6)

_12_5 = Integer(12)

ma_5 = MassAddition(Input=num_17)  # -> Result, PartialResults
division_3 = Division(A=ma_5.Result, B=_12_5)
multiplication_7 = Multiplication(A=division_3, B=num_23)
linear_units_3 = Panel(division_3)
est_cost_3 = Panel(multiplication_7)

_12_6 = Integer(12)
ma_6 = MassAddition(Input=[linear_units_2, linear_units, linear_units_3])  # -> Result, PartialResults
ma_7 = MassAddition(Input=[est_cost_2, est_cost, est_cost_3])  # -> Result, PartialResults
brep_4 = Brep(brep_2)
brep_5 = Brep(brep)
brep_6 = Brep(brep_3)
panel_8 = Panel(ma.Result)
# FINAL OUTPUTS
# MATERIAL QUANT.
linear_footage = Panel(ma_6.Result)
# ESTIMATED COST
est_cost_4 = Panel(ma_7.Result)
# FINAL GEOMETRIES
brep_7 = Brep([brep_4, brep_5, brep_6])

curve_a_3 = Curve(<curve referenced from the Rhino model>)
# BASE CURVE INPUTS
curve_c_3 = Curve(<curve referenced from the Rhino model>)
curve_b_3 = Curve(<curve referenced from the Rhino model>)

# ----
# LOUVER SPACING DISTANCE
number_slider_11 = Slider(18, range=0..100)
num_25 = Number(number_slider_11)

crv_24 = Curve(curve_b_3)
divdist_7 = DivideDistance(Curve=crv_24, Distance=num_25)  # -> flatten(Points), flatten(Tangents), Parameters
lng_7 = ListLength(List=divdist_7.Points)
panel_9 = Panel(lng_7)

crv_25 = Curve(curve_c_3)
divdist_8 = DivideDistance(Curve=crv_25, Distance=num_25)  # -> flatten(Points), flatten(Tangents), Parameters
lng_8 = ListLength(List=divdist_8.Points)
panel_10 = Panel(lng_8)

# ----
# CURVE AND POINTS
crv_26 = Curve(curve_a_3)
divdist_9 = DivideDistance(Curve=crv_26, Distance=num_25)  # -> flatten(Points), flatten(Tangents), Parameters
lng_9 = ListLength(List=divdist_9.Points)
panel_11 = Panel(lng_9)

pt_19 = Point(divdist_7.Points)
vec_13 = Vector(divdist_7.Tangents)

pt_20 = Point(divdist_9.Points)
vec_14 = Vector(divdist_9.Tangents)

pt_21 = Point(divdist_8.Points)
vec_15 = Vector(divdist_8.Tangents)

ma_8 = MassAddition(Input=[panel_11, panel_9, panel_10])  # -> Result, PartialResults
panel_12 = Panel(ma_8.Result)

pt_22 = Point(pt_21)
vec_16 = Vector(vec_15)

pt_23 = Point(pt_19)
vec_17 = Vector(vec_13)

# ----
# LOUVER PLACEMENT
pt_24 = Point(pt_20)
vec_18 = Vector(vec_14)

# ----
# LOUVER DIMENSIONS
number_slider_12 = Slider(4, range=0..100)

num_26 = Number(Slider(10, range=0..100))
num_27 = Number(number_slider_12)

int_7 = Integer(90)
rotate_7 = Rotate(Geometry=vec_16, Angle=degrees(int_7), Plane=PlaneXY(0, 0, 0))  # -> Geometry, Transform
pt_25 = Point(rotate_7.Geometry)
line_13 = LineSDL(Start=pt_22, Direction=pt_25, Length=num_26)
end_13 = EndPoints(Curve=line_13)  # -> Start, End
line_14 = LineSDL(Start=end_13.End, Direction=vec_16, Length=num_27)
end_14 = EndPoints(Curve=line_14)  # -> Start, End
rec_3pt_7 = Rectangle3Pt(PointA=end_13.Start, PointB=end_13.End, PointC=end_14.End)  # -> Rectangle, Length
area_14 = Area(Geometry=rec_3pt_7.Rectangle)  # -> Area, Centroid
ln_7 = Line(StartPoint=area_14.Centroid, EndPoint=pt_22)
move_7 = Move(Geometry=rec_3pt_7.Rectangle, Motion=ln_7)  # -> Geometry, Transform
srf_24 = Surface(move_7.Geometry)
srf_25 = Surface(srf_24)

int_8 = Integer(90)
rotate_8 = Rotate(Geometry=vec_17, Angle=degrees(int_8), Plane=PlaneXY(0, 0, 0))  # -> Geometry, Transform
pt_26 = Point(rotate_8.Geometry)
line_15 = LineSDL(Start=pt_23, Direction=pt_26, Length=num_26)
end_15 = EndPoints(Curve=line_15)  # -> Start, End
line_16 = LineSDL(Start=end_15.End, Direction=vec_17, Length=num_27)
end_16 = EndPoints(Curve=line_16)  # -> Start, End
rec_3pt_8 = Rectangle3Pt(PointA=end_15.Start, PointB=end_15.End, PointC=end_16.End)  # -> Rectangle, Length
area_15 = Area(Geometry=rec_3pt_8.Rectangle)  # -> Area, Centroid
ln_8 = Line(StartPoint=area_15.Centroid, EndPoint=pt_23)
move_8 = Move(Geometry=rec_3pt_8.Rectangle, Motion=ln_8)  # -> Geometry, Transform
srf_26 = Surface(move_8.Geometry)
srf_27 = Surface(srf_26)

int_9 = Integer(90)
rotate_9 = Rotate(Geometry=vec_18, Angle=degrees(int_9), Plane=PlaneXY(0, 0, 0))  # -> Geometry, Transform
pt_27 = Point(rotate_9.Geometry)
line_17 = LineSDL(Start=pt_24, Direction=pt_27, Length=num_26)
end_17 = EndPoints(Curve=line_17)  # -> Start, End
line_18 = LineSDL(Start=end_17.End, Direction=vec_18, Length=num_27)
end_18 = EndPoints(Curve=line_18)  # -> Start, End
rec_3pt_9 = Rectangle3Pt(PointA=end_17.Start, PointB=end_17.End, PointC=end_18.End)  # -> Rectangle, Length
area_16 = Area(Geometry=rec_3pt_9.Rectangle)  # -> Area, Centroid
ln_9 = Line(StartPoint=area_16.Centroid, EndPoint=pt_24)
move_9 = Move(Geometry=rec_3pt_9.Rectangle, Motion=ln_9)  # -> Geometry, Transform
srf_28 = Surface(move_9.Geometry)
srf_29 = Surface(srf_28)

crv_27 = Curve(<curve referenced from the Rhino model>)
# REMOVAL ATTRACTOR
crv_28 = Curve(<curve referenced from the Rhino model>)
mirror_4 = MirrorCurve(Geometry=crv_27, Curve=crv_28, Tangent=True)
crv_29 = Curve(crv_27)
crv_30 = Curve(mirror_4)

crv_31 = Curve(crv_29)
crv_32 = Curve(crv_30)

# ----
# ITEMS TO REMOVE
number_slider_13 = Slider(0.025, range=0..1)
num_28 = Number(number_slider_13)

srf_30 = Surface(srf_29)
area_17 = Area(Geometry=srf_30)  # -> Area, Centroid
curve_attractor_8 = CurveAttractor(C=crv_31, P=area_17.Centroid, A=Slider(0, range=0..100), B=Slider(1, range=0..1))  # -> R, points_on_curve_2
num_29 = Number(curve_attractor_8.R)
bnd_5 = Bounds(Numbers=num_29)
remap_5 = RemapNumbers(Value=num_29, Source=bnd_5, Target=Domain(0, 1))  # -> Mapped, Clipped
smaller_5 = SmallerThan(FirstNumber=remap_5.Mapped, SecondNumber=num_28)  # -> SmallerThan, OrEqualTo
cull_5 = CullPattern(List=srf_30, CullPattern=invert(smaller_5.SmallerThan))
srf_31 = Surface(cull_5)

srf_32 = Surface(srf_25)
area_18 = Area(Geometry=srf_32)  # -> Area, Centroid
curve_attractor_9 = CurveAttractor(C=crv_32, P=area_18.Centroid, A=Slider(0, range=0..100), B=Slider(1, range=0..1))  # -> R, points_on_curve_2
num_30 = Number(curve_attractor_9.R)
bnd_6 = Bounds(Numbers=num_30)
remap_6 = RemapNumbers(Value=num_30, Source=bnd_6, Target=Domain(0, 1))  # -> Mapped, Clipped
smaller_6 = SmallerThan(FirstNumber=remap_6.Mapped, SecondNumber=num_28)  # -> SmallerThan, OrEqualTo
cull_6 = CullPattern(List=srf_32, CullPattern=invert(smaller_6.SmallerThan))
srf_33 = Surface(cull_6)

# ----
# LOUVER EXTRUSION/ATTRACTORS
number_slider_14 = Slider(16, range=0..100)

crv_33 = Curve(<curve referenced from the Rhino model>)
crv_34 = Curve(<curve referenced from the Rhino model>)
mirror_5 = MirrorCurve(Geometry=crv_33, Curve=crv_34, Tangent=True)
crv_35 = Curve(<curve referenced from the Rhino model>)
crv_36 = Curve(crv_33)
crv_37 = Curve(mirror_5)
crv_38 = Curve(crv_35)
_12_7 = Integer(12)
multiplication_8 = Multiplication(A=Slider(5, range=0..100), B=_12_7)
multiplication_9 = Multiplication(A=number_slider_14, B=_12_7)
num_31 = Number(multiplication_9)
num_32 = Number(multiplication_8)

# ----
# LOUVER EXTRUSION/ATTRACTORS
number_slider_15 = Slider(16, range=0..100)

srf_34 = Surface(srf_27)
area_19 = Area(Geometry=srf_34)  # -> Area, Centroid
curve_attractor_10 = CurveAttractor(C=crv_38, P=area_19.Centroid, A=num_32, B=num_31)  # -> R, points_on_curve_2
num_33 = Number(curve_attractor_10.R)
Z_4 = UnitZ(Factor=num_33)
extr_4 = Extrude(Base=srf_34, Direction=Z_4)
brep_8 = Brep(extr_4)

# ----
# CURVE-ATTRACTED EXTRUSION
# VARIABLE EXTRUSIONS
srf_35 = Surface(srf_31)
area_20 = Area(Geometry=srf_35)  # -> Area, Centroid
curve_attractor_11 = CurveAttractor(C=crv_36, P=area_20.Centroid, A=num_32, B=num_31)  # -> R, points_on_curve_2
num_34 = Number(curve_attractor_11.R)
Z_5 = UnitZ(Factor=num_34)
extr_5 = Extrude(Base=srf_35, Direction=Z_5)
brep_9 = Brep(extr_5)

srf_36 = Surface(srf_33)
area_21 = Area(Geometry=srf_36)  # -> Area, Centroid
curve_attractor_12 = CurveAttractor(C=crv_37, P=area_21.Centroid, A=num_32, B=num_31)  # -> R, points_on_curve_2
num_35 = Number(curve_attractor_12.R)
Z_6 = UnitZ(Factor=num_35)
extr_6 = Extrude(Base=srf_36, Direction=Z_6)
brep_10 = Brep(extr_6)

num_36 = Number(Slider(0.4, range=0..1))
num_37 = Number(Slider(0.4, range=0..1))
num_38 = Number(Slider(0.4, range=0..1))

_12_8 = Integer(12)
multiplication_10 = Multiplication(A=Slider(5, range=0..100), B=_12_8)
multiplication_11 = Multiplication(A=number_slider_15, B=_12_8)
num_39 = Number(multiplication_11)
num_40 = Number(multiplication_10)

# ----
# COST PER LIN. FT.
number_slider_16 = Slider(16, range=0..100)
num_41 = Number(number_slider_16)

# ----
# COST PER LIN. FT.
number_slider_17 = Slider(16, range=0..100)
num_42 = Number(number_slider_17)

ma_9 = MassAddition(Input=num_33)  # -> Result, PartialResults
_12_9 = Integer(12)
division_4 = Division(A=ma_9.Result, B=_12_9)
multiplication_12 = Multiplication(A=division_4, B=num_41)
linear_units_4 = Panel(division_4)
est_cost_5 = Panel(multiplication_12)

# ----
# MATERIAL AND COST ANALYSIS
ma_10 = MassAddition(Input=num_34)  # -> Result, PartialResults
_12_10 = Integer(12)
division_5 = Division(A=ma_10.Result, B=_12_10)
multiplication_13 = Multiplication(A=division_5, B=num_41)
linear_units_5 = Panel(division_5)
est_cost_6 = Panel(multiplication_13)

_12_11 = Integer(12)

ma_11 = MassAddition(Input=num_35)  # -> Result, PartialResults
division_6 = Division(A=ma_11.Result, B=_12_11)
multiplication_14 = Multiplication(A=division_6, B=num_41)
linear_units_6 = Panel(division_6)
est_cost_7 = Panel(multiplication_14)

_12_12 = Integer(12)
ma_12 = MassAddition(Input=[linear_units_5, linear_units_4, linear_units_6])  # -> Result, PartialResults
ma_13 = MassAddition(Input=[est_cost_6, est_cost_5, est_cost_7])  # -> Result, PartialResults
brep_11 = Brep(brep_9)
brep_12 = Brep(brep_8)
brep_13 = Brep(brep_10)
# FINAL OUTPUTS
# MATERIAL QUANT.
linear_footage_2 = Panel(ma_12.Result)
# ESTIMATED COST
est_cost_8 = Panel(ma_13.Result)
# FINAL GEOMETRIES
brep_14 = Brep([brep_11, brep_12, brep_13])

# ----
# VARIABLE EXTRUSIONS
srf_37 = Surface(srf_18)
eval = EvaluateCurve(Curve=reparameterize(crv_6), Parameter=num_19)  # -> Point, Tangent, Angle
area_22 = Area(Geometry=srf_37)  # -> Area, Centroid
point_attractor = PointAttractor(A_2=eval.Point, B_2=area_22.Centroid, A=num_22, B=num_21)

num_43 = Number(point_attractor)

Z_7 = UnitZ(Factor=num_43)
extr_7 = Extrude(Base=srf_37, Direction=Z_7)
brep_15 = Brep(extr_7)

# ----
# MATERIAL AND COST ANALYSIS
ma_14 = MassAddition(Input=num_43)  # -> Result, PartialResults
_12_13 = Integer(12)
division_7 = Division(A=ma_14.Result, B=_12_13)
multiplication_15 = Multiplication(A=division_7, B=num_24)
linear_units_7 = Panel(division_7)
est_cost_9 = Panel(multiplication_15)

brep_16 = Brep(brep_15)

srf_38 = Surface(srf_10)
eval_2 = EvaluateCurve(Curve=reparameterize(crv_4), Parameter=num_18)  # -> Point, Tangent, Angle
area_23 = Area(Geometry=srf_38)  # -> Area, Centroid
point_attractor_2 = PointAttractor(A_2=eval_2.Point, B_2=area_23.Centroid, A=num_22, B=num_21)

num_44 = Number(point_attractor_2)

Z_8 = UnitZ(Factor=num_44)
extr_8 = Extrude(Base=srf_38, Direction=Z_8)
brep_17 = Brep(extr_8)

ma_15 = MassAddition(Input=num_44)  # -> Result, PartialResults
_12_14 = Integer(12)
division_8 = Division(A=ma_15.Result, B=_12_14)
multiplication_16 = Multiplication(A=division_8, B=num_24)
linear_units_8 = Panel(division_8)
est_cost_10 = Panel(multiplication_16)

brep_18 = Brep(brep_17)

srf_39 = Surface(srf_20)
eval_3 = EvaluateCurve(Curve=reparameterize(crv_5), Parameter=num_20)  # -> Point, Tangent, Angle
area_24 = Area(Geometry=srf_39)  # -> Area, Centroid
point_attractor_3 = PointAttractor(A_2=eval_3.Point, B_2=area_24.Centroid, A=num_22, B=num_21)

num_45 = Number(point_attractor_3)

Z_9 = UnitZ(Factor=num_45)
extr_9 = Extrude(Base=srf_39, Direction=Z_9)
brep_19 = Brep(extr_9)

ma_16 = MassAddition(Input=num_45)  # -> Result, PartialResults
division_9 = Division(A=ma_16.Result, B=_12_6)
multiplication_17 = Multiplication(A=division_9, B=num_24)
linear_units_9 = Panel(division_9)
est_cost_11 = Panel(multiplication_17)

ma_17 = MassAddition(Input=[linear_units_7, linear_units_8, linear_units_9])  # -> Result, PartialResults
ma_18 = MassAddition(Input=[est_cost_9, est_cost_10, est_cost_11])  # -> Result, PartialResults
brep_20 = Brep(brep_19)
# FINAL OUTPUTS
# MATERIAL QUANT.
linear_footage_3 = Panel(ma_17.Result)
# ESTIMATED COST
est_cost_12 = Panel(ma_18.Result)
# FINAL GEOMETRIES
brep_21 = Brep([brep_16, brep_18, brep_20])

# ----
# POINT-ATTRACTED EXTRUSION
# VARIABLE EXTRUSIONS
srf_40 = Surface(srf_31)
eval_4 = EvaluateCurve(Curve=reparameterize(crv_26), Parameter=num_37)  # -> Point, Tangent, Angle
area_25 = Area(Geometry=srf_40)  # -> Area, Centroid
point_attractor_4 = PointAttractor(A_2=eval_4.Point, B_2=area_25.Centroid, A=num_40, B=num_39)

num_46 = Number(point_attractor_4)

Z_10 = UnitZ(Factor=num_46)
extr_10 = Extrude(Base=srf_40, Direction=Z_10)
brep_22 = Brep(extr_10)

# ----
# MATERIAL AND COST ANALYSIS
ma_19 = MassAddition(Input=num_46)  # -> Result, PartialResults
_12_15 = Integer(12)
division_10 = Division(A=ma_19.Result, B=_12_15)
multiplication_18 = Multiplication(A=division_10, B=num_42)
linear_units_10 = Panel(division_10)
est_cost_13 = Panel(multiplication_18)

brep_23 = Brep(brep_22)

srf_41 = Surface(srf_27)
eval_5 = EvaluateCurve(Curve=reparameterize(crv_24), Parameter=num_36)  # -> Point, Tangent, Angle
area_26 = Area(Geometry=srf_41)  # -> Area, Centroid
point_attractor_5 = PointAttractor(A_2=eval_5.Point, B_2=area_26.Centroid, A=num_40, B=num_39)

num_47 = Number(point_attractor_5)

Z_11 = UnitZ(Factor=num_47)
extr_11 = Extrude(Base=srf_41, Direction=Z_11)
brep_24 = Brep(extr_11)

ma_20 = MassAddition(Input=num_47)  # -> Result, PartialResults
_12_16 = Integer(12)
division_11 = Division(A=ma_20.Result, B=_12_16)
multiplication_19 = Multiplication(A=division_11, B=num_42)
linear_units_11 = Panel(division_11)
est_cost_14 = Panel(multiplication_19)

brep_25 = Brep(brep_24)

srf_42 = Surface(srf_33)
eval_6 = EvaluateCurve(Curve=reparameterize(crv_25), Parameter=num_38)  # -> Point, Tangent, Angle
area_27 = Area(Geometry=srf_42)  # -> Area, Centroid
point_attractor_6 = PointAttractor(A_2=eval_6.Point, B_2=area_27.Centroid, A=num_40, B=num_39)

num_48 = Number(point_attractor_6)

Z_12 = UnitZ(Factor=num_48)
extr_12 = Extrude(Base=srf_42, Direction=Z_12)
brep_26 = Brep(extr_12)

ma_21 = MassAddition(Input=num_48)  # -> Result, PartialResults
division_12 = Division(A=ma_21.Result, B=_12_12)
multiplication_20 = Multiplication(A=division_12, B=num_42)
linear_units_12 = Panel(division_12)
est_cost_15 = Panel(multiplication_20)

ma_22 = MassAddition(Input=[linear_units_10, linear_units_11, linear_units_12])  # -> Result, PartialResults
ma_23 = MassAddition(Input=[est_cost_13, est_cost_14, est_cost_15])  # -> Result, PartialResults
brep_27 = Brep(brep_26)
# FINAL OUTPUTS
# MATERIAL QUANT.
linear_footage_4 = Panel(ma_22.Result)
# ESTIMATED COST
est_cost_16 = Panel(ma_23.Result)
# FINAL GEOMETRIES
brep_28 = Brep([brep_23, brep_25, brep_27])

# ==== cluster PointAttractor: Utility
A = ClusterInput()
x = ClusterInput()
A_2 = ClusterInput()
B = ClusterInput()
B_2 = ClusterInput()
dist = Distance(PointA=A_2, PointB=B_2)
dom = ConstructDomain(DomainStart=A, DomainEnd=B)
bnd = Bounds(Numbers=dist)
remap = RemapNumbers(Value=dist, Source=bnd, Target=dom)  # -> Mapped, Clipped
R = ClusterOutput(remap.Mapped)

# ==== cluster CurveAttractor: Utility
C = ClusterInput()
P = ClusterInput()
x = ClusterInput()
A = ClusterInput()
B = ClusterInput()
crv_cp = CurveClosestPoint(Point=P, Curve=C)  # -> Point, Parameter, Distance
dom = ConstructDomain(DomainStart=A, DomainEnd=B)
bnd = Bounds(Numbers=crv_cp.Distance)
remap = RemapNumbers(Value=crv_cp.Distance, Source=bnd, Target=dom)  # -> Mapped, Clipped
R = ClusterOutput(remap.Mapped)
points_on_curve = Point(crv_cp.Point)
points_on_curve_2 = ClusterOutput(points_on_curve)
