# Grasshopper definition alexandria-project-grasshopper.gh (Grasshopper 1.0.7)

# ----
# GRID ATTRIBUTES
number_slider = Slider(24, range=0..100)
pt = Point(Point(0, 0, 0))

hex_grid_generator = HexGridGenerator(origin_point=pt, cell_scale=Slider(2, range=0..10), x_axis_extent=Slider(24, range=0..100), y_axis_extent=number_slider)  # -> grid_cell_curves_2, grid_area_centroids

# ----
# PATTERN ATTRIBUTES
number_slider_2 = Slider(0.15, range=0..1)

pattern_3_4_6 = Pattern346(
    grid_cell_curves=hex_grid_generator.grid_cell_curves_2,
    grid_cell_area_centroids=hex_grid_generator.grid_area_centroids,
    interior_cell_scale=Slider(0.59, range=0..1),
    point_on_curve=number_slider_2)  # -> pattern_curves_2, pattern_area_centroids_2, grid_cell_area_centroids_4

# ----
# ATTRACTOR ATTRIBUTES
number_slider_3 = Slider(0.88, range=0..1)
crv = Curve(<curve referenced from the Rhino model>)

curve_attractor = CurveAttractor(C=crv, P=pattern_3_4_6.pattern_area_centroids_2, A=Slider(0.22, range=0..1), B=number_slider_3)  # -> R, points_on_curve_2

scale = Scale(Geometry=pattern_3_4_6.pattern_curves_2, Center=pattern_3_4_6.pattern_area_centroids_2, Factor=curve_attractor.R)  # -> Geometry, Transform
# FINAL
crv_2 = Curve(scale.Geometry)

# ==== cluster HexGridGenerator: Grid Gen
y_axis_extent = ClusterInput()
x_axis_extent = ClusterInput()
origin_point = ClusterInput()
cell_scale = ClusterInput()
y_axis_extent_2 = Number(y_axis_extent)
x_axis_extent_2 = Number(x_axis_extent)
cell_scale_2 = Number(cell_scale)
origin_point_2 = Point(origin_point)
division = Division(XAxisExtent=x_axis_extent_2, B=cell_scale_2)
division_2 = Division(YAxisExtent=y_axis_extent_2, B=cell_scale_2)
hexgrid = Hexagonal(Plane=origin_point_2, Size=cell_scale_2, ExtentX=division, ExtentY=division_2)  # -> Cells, Points
grid_cell_curves = Curve(flatten(hexgrid.Cells))
area = Area(Geometry=grid_cell_curves)  # -> Area, flatten(GridAreaCentroids)
grid_area_centroids = ClusterOutput(area.GridAreaCentroids)
grid_cell_curves_2 = ClusterOutput(grid_cell_curves)

# ==== cluster Pattern346: Pattern Component
grid_cell_curves = ClusterInput()
grid_cell_area_centroids = ClusterInput()
grid_cell_curves_2 = Curve(grid_cell_curves)
interior_cell_scale = ClusterInput()
point_on_curve = ClusterInput()
item = ListItem(List=flatten(grid_cell_curves_2), Index=0, Wrap=True)
area = Area(Geometry=item)  # -> Area, Centroid
grid_eval_tool = GridEvalTool(grid_cell_curves=item, grid_cell_area_centroids=area.Centroid, grid_cell_scale=Slider(1, range=0..1))  # -> grid_cell_curves_5, grid_cell_vertices_2, grid_cell_midpoints_2, grid_cell_area_centroids_3
explode = Explode(Curve=grid_eval_tool.grid_cell_curves_5, Recursive=True)  # -> Segments, Vertices
interior_cell_scale_2 = Number(interior_cell_scale)
crv = Curve(explode.Segments)
point_on_curve_2 = Number(point_on_curve)
grid_cell_area_centroids_2 = Point(flatten(grid_cell_area_centroids))
pt = Point(grid_eval_tool.grid_cell_vertices_2)
pt_2 = Point(grid_eval_tool.grid_cell_midpoints_2)
eval = EvaluateCurve(Curve=reparameterize(crv), Parameter=point_on_curve_2)  # -> Point, Tangent, Angle
avr = Average(Input=pt_2)
ln = Line(StartPoint=avr, EndPoint=pt_2)
ln_2 = Line(StartPoint=avr, EndPoint=pt)
eval_2 = EvaluateCurve(Curve=reparameterize(ln), Parameter=interior_cell_scale_2)  # -> Point, Tangent, Angle
pattern_area_centroid = Point(avr)
eval_3 = EvaluateCurve(Curve=reparameterize(ln_2), Parameter=interior_cell_scale_2)  # -> Point, Tangent, Angle
voronoi = Voronoi(Points=flatten([eval_2.Point, eval.Point, eval_3.Point]), BruteForceOverride=False)
bbx = BrepBrep(BrepA=item, BrepB=voronoi)  # -> flatten(Curves), Points
ln_3 = Line(StartPoint=pattern_area_centroid, EndPoint=grid_cell_area_centroids_2)
move = Move(Geometry=bbx.Curves, Motion=graft(ln_3))  # -> Geometry, Transform
pattern_curves = Curve(flatten(move.Geometry))
area_2 = Area(Geometry=move.Geometry)  # -> Area, Centroid
pattern_area_centroids = Point(flatten(area_2.Centroid))
avr_2 = Average(Input=area_2.Centroid)
pattern_curves_2 = ClusterOutput(pattern_curves)
pattern_area_centroids_2 = ClusterOutput(pattern_area_centroids)
grid_cell_area_centroids_3 = Point(flatten(avr_2))
grid_cell_area_centroids_4 = ClusterOutput(grid_cell_area_centroids_3)

# ==== cluster CurveAttractor: Utility
C = ClusterInput()
P = ClusterInput()
x = ClusterInput()
A = ClusterInput()
B = ClusterInput()
crv_cp = CurveClosestPoint(Point=P, Curve=C)  # -> Point, Parameter, Distance
dom = ConstructDomain(DomainStart=A, DomainEnd=B)
bnd = Bounds(Numbers=crv_cp.Distance)
remap = RemapNumbers(Value=crv_cp.Distance, Source=bnd, Target=dom)  # -> Mapped, Clipped
R = ClusterOutput(remap.Mapped)
points_on_curve = Point(crv_cp.Point)
points_on_curve_2 = ClusterOutput(points_on_curve)

# ==== cluster GridEvalTool: Grid Gen
grid_cell_area_centroids = ClusterInput()
grid_cell_curves = ClusterInput()
grid_cell_scale = ClusterInput()
grid_cell_area_centroids_2 = Point(grid_cell_area_centroids)
grid_cell_curves_2 = Curve(grid_cell_curves)
grid_cell_scale_2 = Number(grid_cell_scale)
scale = Scale(Geometry=grid_cell_curves_2, Center=grid_cell_area_centroids_2, Factor=grid_cell_scale_2)  # -> Geometry, Transform
grid_cell_curves_3 = Curve(scale.Geometry)
grid_cell_curves_4 = Curve(scale.Geometry)
disc = Discontinuity(Curve=grid_cell_curves_3, Level=1)  # -> Points, Parameters
explode = Explode(Curve=grid_cell_curves_3, Recursive=True)  # -> Segments, Vertices
grid_cell_vertices = Point(disc.Points)
midpt = CurveMiddle(Curve=explode.Segments)
grid_cell_midpoints = Point(midpt)
grid_cell_curves_5 = ClusterOutput(grid_cell_curves_4)
grid_cell_vertices_2 = ClusterOutput(grid_cell_vertices)
grid_cell_area_centroids_3 = ClusterOutput(grid_cell_area_centroids_2)
grid_cell_midpoints_2 = ClusterOutput(grid_cell_midpoints)
