# Grasshopper definition alexandria-abstraction-work-definition.gh (Grasshopper 1.0.7)

number_slider = Slider(14, range=0..100)
origin_point = Point(Point(0, 0, 0))
hex_grid_generator = HexGridGenerator(
    origin_point=origin_point,
    cell_scale=number_slider,
    x_axis_extent=Slider(170, range=0..1000),
    y_axis_extent=Slider(110, range=0..1000))  # -> flatten(grid_cell_curves_2), flatten(grid_area_centroids)
multiplication = Multiplication(A=number_slider, B=Slider(0.72, range=0..1))
pattern_4_5_7 = Pattern457(
    grid_cell_curves=hex_grid_generator.grid_cell_curves_2,
    grid_cell_area_centroids=hex_grid_generator.grid_area_centroids,
    interior_cell_scale_a=Slider(0.34, range=0..1),
    interior_cell_scale_b=multiplication,
    interior_subdivisions=Slider(3, range=0..10),
    point_on_curve=Slider(0.48, range=0..1))  # -> flatten(pattern_curves_2), flatten(pattern_area_centroids_2), flatten(grid_cell_area_centroids_4)
crv = Curve(<curve referenced from the Rhino model>)
curve_attractor = CurveAttractor(C=crv, P=pattern_4_5_7.pattern_area_centroids_2, A=Slider(0.73, range=0..1), B=Slider(0.13, range=0..1))  # -> R, points_on_curve_2
scale = Scale(Geometry=pattern_4_5_7.pattern_curves_2, Center=pattern_4_5_7.pattern_area_centroids_2, Factor=curve_attractor.R)  # -> Geometry, Transform

construct_rectangle = ConstructRectangle(x_axis_extent=Slider(170, range=0..1000), y_axis_extent=Slider(110, range=0..1000))
number_slider_2 = Slider(25, range=0..100)
explode = Explode(Curve=construct_rectangle, Recursive=True)  # -> Segments, Vertices
item = ListItem(List=explode.Segments, Index=0, Wrap=True)  # -> Item, Item1, Item2, Item3
series = Series(Start=Slider(7, range=0..10), Step=1, Count=10)
item_2 = ListItem(List=series, Index=0, Wrap=True)  # -> Item, Item1, Item2, Item3
random = Random(Range=Domain(0, 1), Number=number_slider_2, Seed=item_2.Item)
random_2 = Random(Range=Domain(0, 1), Number=number_slider_2, Seed=item_2.Item1)
random_3 = Random(Range=Domain(0, 1), Number=number_slider_2, Seed=item_2.Item2)
random_4 = Random(Range=Domain(0, 1), Number=number_slider_2, Seed=item_2.Item3)
eval = EvaluateCurve(Curve=reparameterize(item.Item), Parameter=random)  # -> Point, Tangent, Angle
eval_2 = EvaluateCurve(Curve=reparameterize(item.Item1), Parameter=random_2)  # -> Point, Tangent, Angle
eval_3 = EvaluateCurve(Curve=reparameterize(item.Item2), Parameter=random_3)  # -> Point, Tangent, Angle
eval_4 = EvaluateCurve(Curve=reparameterize(item.Item3), Parameter=random_4)  # -> Point, Tangent, Angle
ln = Line(StartPoint=eval.Point, EndPoint=eval_2.Point)
ln_2 = Line(StartPoint=eval.Point, EndPoint=eval_3.Point)
ln_3 = Line(StartPoint=eval.Point, EndPoint=eval_4.Point)
ln_4 = Line(StartPoint=eval_2.Point, EndPoint=eval_3.Point)
ln_5 = Line(StartPoint=eval_2.Point, EndPoint=eval_4.Point)
ln_6 = Line(StartPoint=eval_3.Point, EndPoint=eval_4.Point)
crv_2 = Curve(ln)
crv_3 = Curve(ln_2)
crv_4 = Curve(ln_3)
crv_5 = Curve(ln_4)
crv_6 = Curve(ln_5)
crv_7 = Curve(ln_6)
crv_8 = Curve([crv_3, crv_6, crv_2, crv_4, crv_5, crv_7])
srfsplit = SurfaceSplit(Surface=construct_rectangle, Curves=crv_8)
crv_9 = Curve(srfsplit)
area = Area(Geometry=crv_9)  # -> Area, Centroid
scale_2 = Scale(Geometry=crv_9, Center=area.Centroid, Factor=Slider(0.66, range=0..1))  # -> Geometry, Transform

# ==== cluster HexGridGenerator: Grid Gen
y_axis_extent = ClusterInput()
x_axis_extent = ClusterInput()
origin_point = ClusterInput()
cell_scale = ClusterInput()
y_axis_extent_2 = Number(y_axis_extent)
x_axis_extent_2 = Number(x_axis_extent)
cell_scale_2 = Number(cell_scale)
origin_point_2 = Point(origin_point)
division = Division(XAxisExtent=x_axis_extent_2, B=cell_scale_2)
division_2 = Division(YAxisExtent=y_axis_extent_2, B=cell_scale_2)
hexgrid = Hexagonal(Plane=origin_point_2, Size=cell_scale_2, ExtentX=division, ExtentY=division_2)  # -> Cells, Points
grid_cell_curves = Curve(hexgrid.Cells)
area = Area(Geometry=grid_cell_curves)  # -> Area, GridAreaCentroids
grid_area_centroids = ClusterOutput(area.GridAreaCentroids)
grid_cell_curves_2 = ClusterOutput(grid_cell_curves)

# ==== cluster Pattern457: Pattern Component
grid_cell_curves = ClusterInput()
grid_cell_area_centroids = ClusterInput()
grid_cell_curves_2 = Curve(grid_cell_curves)
interior_cell_scale_a = ClusterInput()
interior_cell_scale_b = ClusterInput()
interior_subdivisions = ClusterInput()
point_on_curve = ClusterInput()
item = ListItem(List=flatten(grid_cell_curves_2), Index=0, Wrap=True)
area = Area(Geometry=item)  # -> Area, Centroid
grid_eval_tool = GridEvalTool(grid_cell_curves=item, grid_cell_area_centroids=area.Centroid, grid_cell_scale=Slider(1, range=0..1))  # -> grid_cell_curves_5, grid_cell_vertices_2, grid_cell_midpoints_2, grid_cell_area_centroids_3
explode = Explode(Curve=grid_eval_tool.grid_cell_curves_5, Recursive=True)  # -> Segments, Vertices
pt = Point(grid_eval_tool.grid_cell_vertices_2)
grid_cell_area_centroids_2 = Point(flatten(grid_cell_area_centroids))
point_on_curve_2 = Number(point_on_curve)
subtraction = Subtraction(A=Slider(1, range=0..1), B=point_on_curve_2)
dispatch = Dispatch(List=explode.Segments, DispatchPattern=[True, False])  # -> ListA, ListB
crv = Curve(dispatch.ListB)
crv_2 = Curve(dispatch.ListA)
avr = Average(Input=pt)
eval = EvaluateCurve(Curve=reparameterize(crv_2), Parameter=point_on_curve_2)  # -> Point, Tangent, Angle
eval_2 = EvaluateCurve(Curve=reparameterize(crv), Parameter=subtraction)  # -> Point, Tangent, Angle
interior_cell_scale_a_2 = Number(interior_cell_scale_a)
interior_cell_scale_b_2 = Number(interior_cell_scale_b)
interior_subdivisions_2 = Number(interior_subdivisions)
ln = Line(StartPoint=avr, EndPoint=pt)
pattern_area_centroid = Point(avr)
pt_2 = Point([eval.Point, eval_2.Point])
eval_3 = EvaluateCurve(Curve=reparameterize(ln), Parameter=interior_cell_scale_a_2)  # -> Point, Tangent, Angle
cir = Circle(Plane=avr, Radius=interior_cell_scale_b_2)
divide = DivideCurve(Curve=cir, Count=interior_subdivisions_2, Kinks=False)  # -> Points, Tangents, Parameters
voronoi = Voronoi(Points=flatten([divide.Points, eval_3.Point, pt_2]), BruteForceOverride=False)
bbx = BrepBrep(BrepA=item, BrepB=voronoi)  # -> flatten(Curves), Points
ln_2 = Line(StartPoint=pattern_area_centroid, EndPoint=grid_cell_area_centroids_2)
move = Move(Geometry=bbx.Curves, Motion=graft(ln_2))  # -> Geometry, Transform
area_2 = Area(Geometry=move.Geometry)  # -> Area, Centroid
pattern_curves = Curve(move.Geometry)
pattern_area_centroids = Point(area_2.Centroid)
avr_2 = Average(Input=area_2.Centroid)
pattern_curves_2 = ClusterOutput(pattern_curves)
pattern_area_centroids_2 = ClusterOutput(pattern_area_centroids)
grid_cell_area_centroids_3 = Point(avr_2)
grid_cell_area_centroids_4 = ClusterOutput(grid_cell_area_centroids_3)

# ==== cluster CurveAttractor: Utility
C = ClusterInput()
P = ClusterInput()
x = ClusterInput()
A = ClusterInput()
B = ClusterInput()
crv_cp = CurveClosestPoint(Point=P, Curve=C)  # -> Point, Parameter, Distance
dom = ConstructDomain(DomainStart=A, DomainEnd=B)
bnd = Bounds(Numbers=crv_cp.Distance)
remap = RemapNumbers(Value=crv_cp.Distance, Source=bnd, Target=dom)  # -> Mapped, Clipped
R = ClusterOutput(remap.Mapped)
points_on_curve = Point(crv_cp.Point)
points_on_curve_2 = ClusterOutput(points_on_curve)

# ==== cluster ConstructRectangle: Constructed Base
origin_point = OriginPoint(Point(0, 0, 0))
y_axis_extent = ClusterInput()
x_axis_extent = ClusterInput()
rectangle = Rectangle(OriginPoint=origin_point, XAxisExtent=x_axis_extent, YAxisExtent=y_axis_extent, Radius=Slider(0, range=0..100))  # -> Rectangle, Length
R = ClusterOutput(rectangle.Rectangle)

# ==== cluster GridEvalTool: Grid Gen
grid_cell_area_centroids = ClusterInput()
grid_cell_curves = ClusterInput()
grid_cell_scale = ClusterInput()
grid_cell_area_centroids_2 = Point(grid_cell_area_centroids)
grid_cell_curves_2 = Curve(grid_cell_curves)
grid_cell_scale_2 = Number(grid_cell_scale)
scale = Scale(Geometry=grid_cell_curves_2, Center=grid_cell_area_centroids_2, Factor=grid_cell_scale_2)  # -> Geometry, Transform
grid_cell_curves_3 = Curve(scale.Geometry)
grid_cell_curves_4 = Curve(scale.Geometry)
disc = Discontinuity(Curve=grid_cell_curves_3, Level=1)  # -> Points, Parameters
explode = Explode(Curve=grid_cell_curves_3, Recursive=True)  # -> Segments, Vertices
grid_cell_vertices = Point(disc.Points)
midpt = CurveMiddle(Curve=explode.Segments)
grid_cell_midpoints = Point(midpt)
grid_cell_curves_5 = ClusterOutput(grid_cell_curves_4)
grid_cell_vertices_2 = ClusterOutput(grid_cell_vertices)
grid_cell_area_centroids_3 = ClusterOutput(grid_cell_area_centroids_2)
grid_cell_midpoints_2 = ClusterOutput(grid_cell_midpoints)
