# Grasshopper definition office-fence-facade.gh (Grasshopper 1.0.7)
# plug-ins: ClipperComponents

pt = Point(Point(0, 0, 0))
pt_2 = Point(Point(0, 0, 0))
pt_3 = Point(Point(0, 0, 0))
pt_4 = Point(Point(0, 0, 0))
pt_5 = Point(Point(0, 0, 0))
pt_6 = Point(Point(0, 0, 0))
pt_7 = Point(Point(0, 0, 0))
pt_8 = Point(Point(0, 0, 0))
hex_grid_generator = HexGridGenerator(
    origin_point=pt,
    cell_scale=Slider(0.5, range=0..10),
    x_axis_extent=Slider(22, range=0..100),
    y_axis_extent=Slider(5, range=0..100))  # -> grid_cell_curves_2, grid_area_centroids
hex_grid_generator_2 = HexGridGenerator(
    origin_point=pt_2,
    cell_scale=Slider(0.5, range=0..10),
    x_axis_extent=Slider(22, range=0..100),
    y_axis_extent=Slider(5, range=0..100))  # -> grid_cell_curves_2, grid_area_centroids
hex_grid_generator_3 = HexGridGenerator(
    origin_point=pt_3,
    cell_scale=Slider(0.5, range=0..10),
    x_axis_extent=Slider(22, range=0..100),
    y_axis_extent=Slider(5, range=0..100))  # -> grid_cell_curves_2, grid_area_centroids
hex_grid_generator_4 = HexGridGenerator(
    origin_point=pt_4,
    cell_scale=Slider(0.5, range=0..10),
    x_axis_extent=Slider(22, range=0..100),
    y_axis_extent=Slider(5, range=0..100))  # -> grid_cell_curves_2, grid_area_centroids
hex_grid_generator_5 = HexGridGenerator(
    origin_point=pt_5,
    cell_scale=Slider(0.5, range=0..10),
    x_axis_extent=Slider(22, range=0..100),
    y_axis_extent=Slider(5, range=0..100))  # -> grid_cell_curves_2, grid_area_centroids
hex_grid_generator_6 = HexGridGenerator(
    origin_point=pt_6,
    cell_scale=Slider(0.5, range=0..10),
    x_axis_extent=Slider(22, range=0..100),
    y_axis_extent=Slider(5, range=0..100))  # -> grid_cell_curves_2, grid_area_centroids
hex_grid_generator_7 = HexGridGenerator(
    origin_point=pt_7,
    cell_scale=Slider(0.5, range=0..10),
    x_axis_extent=Slider(22, range=0..100),
    y_axis_extent=Slider(5, range=0..100))  # -> grid_cell_curves_2, grid_area_centroids
hex_grid_generator_8 = HexGridGenerator(
    origin_point=pt_8,
    cell_scale=Slider(0.5, range=0..10),
    x_axis_extent=Slider(22, range=0..100),
    y_axis_extent=Slider(5, range=0..100))  # -> grid_cell_curves_2, grid_area_centroids
genome_a_type_1 = GenomeAType1(grid_cell_curve=hex_grid_generator.grid_cell_curves_2, grid_cell_area_centroid=hex_grid_generator.grid_area_centroids)  # -> pattern_curves_2, pattern_area_centroids_2
genome_a_type_2 = GenomeAType2(
    grid_cell_curve=hex_grid_generator_2.grid_cell_curves_2,
    grid_cell_area_centroid=hex_grid_generator_2.grid_area_centroids)  # -> pattern_curves_2, pattern_area_centroids_2
genome_a_type_3 = GenomeAType3(
    grid_cell_curve=hex_grid_generator_3.grid_cell_curves_2,
    grid_cell_area_centroid=hex_grid_generator_3.grid_area_centroids)  # -> pattern_curves_2, pattern_area_centroids_2
genome_a_type_4 = GenomeAType4(
    grid_cell_curve=hex_grid_generator_4.grid_cell_curves_2,
    grid_cell_area_centroid=hex_grid_generator_4.grid_area_centroids)  # -> pattern_curves_2, pattern_area_centroids_2
genome_a_type_5 = GenomeAType5(
    grid_cell_curve=hex_grid_generator_5.grid_cell_curves_2,
    grid_cell_area_centroid=hex_grid_generator_5.grid_area_centroids)  # -> pattern_curves_2, pattern_area_centroids_2
genome_a_type_6 = GenomeAType6(
    grid_cell_curve=hex_grid_generator_6.grid_cell_curves_2,
    grid_cell_area_centroid=hex_grid_generator_6.grid_area_centroids,
    evaluation_point=Slider(0.37, range=0..1))  # -> pattern_curves_2, pattern_area_centroids_2
genome_a_type_7 = GenomeAType7(
    grid_cell_curve=hex_grid_generator_7.grid_cell_curves_2,
    grid_cell_area_centroid=hex_grid_generator_7.grid_area_centroids,
    evaluation_point=Slider(0.29, range=0..1))  # -> pattern_curves_2, pattern_area_centroids_2
genome_a_type_8 = GenomeAType8(
    grid_cell_curve=hex_grid_generator_8.grid_cell_curves_2,
    grid_cell_area_centroid=hex_grid_generator_8.grid_area_centroids,
    cell_scale=Slider(0.675, range=0..1))  # -> pattern_curves_2, pattern_area_centroids_2

pt_9 = Point(Point(0, 0, 0))
pt_10 = Point(Point(0, 0, 0))
pt_11 = Point(Point(0, 0, 0))
hex_grid_generator_9 = HexGridGenerator(
    origin_point=pt_9,
    cell_scale=Slider(0.5, range=0..10),
    x_axis_extent=Slider(22, range=0..100),
    y_axis_extent=Slider(5, range=0..100))  # -> grid_cell_curves_2, grid_area_centroids
hex_grid_generator_10 = HexGridGenerator(
    origin_point=pt_10,
    cell_scale=Slider(0.5, range=0..10),
    x_axis_extent=Slider(22, range=0..100),
    y_axis_extent=Slider(5, range=0..100))  # -> grid_cell_curves_2, grid_area_centroids
hex_grid_generator_11 = HexGridGenerator(
    origin_point=pt_11,
    cell_scale=Slider(0.5, range=0..10),
    x_axis_extent=Slider(22, range=0..100),
    y_axis_extent=Slider(5, range=0..100))  # -> grid_cell_curves_2, grid_area_centroids
pt_12 = Point(Point(0, 0, 0))
pt_13 = Point(Point(0, 0, 0))
pt_14 = Point(Point(0, 0, 0))

# ---- group: Random Seed Generator
random = Random(Range=Domain(0, 100), Number=Slider(3, range=0..10), Seed=Slider(5, range=0..100), Integers=True)
item = ListItem(List=random, Index=0, Wrap=True)  # -> Item, Item1, Item2

# ----
number_slider = Slider(6, range=0..10)
number_slider_2 = Slider(22, range=0..100)
hex_grid_generator_12 = HexGridGenerator(
    origin_point=pt_12,
    cell_scale=Slider(1.5, range=0..10),
    x_axis_extent=Slider(22, range=0..100),
    y_axis_extent=Slider(5, range=0..100))  # -> flatten(grid_cell_curves_2), flatten(grid_area_centroids)
hex_grid_generator_13 = HexGridGenerator(
    origin_point=pt_13,
    cell_scale=Slider(1.5, range=0..10),
    x_axis_extent=Slider(22, range=0..100),
    y_axis_extent=Slider(5, range=0..100))  # -> flatten(grid_cell_curves_2), flatten(grid_area_centroids)
hex_grid_generator_14 = HexGridGenerator(
    origin_point=pt_14,
    cell_scale=Slider(1.5, range=0..10),
    x_axis_extent=Slider(22, range=0..100),
    y_axis_extent=Slider(5, range=0..100))  # -> flatten(grid_cell_curves_2), flatten(grid_area_centroids)
crv = Curve(<curve referenced from the Rhino model>)

number_slider_3 = Slider(12, range=0..100)
explode = Explode(Curve=crv, Recursive=True)  # -> Segments, Vertices
random_2 = Random(Range=Domain(0, 1), Number=number_slider_3, Seed=Slider(5, range=0..10))
random_3 = Random(Range=Domain(0, 1), Number=number_slider_3, Seed=Slider(3, range=0..10))
random_4 = Random(Range=Domain(0, 1), Number=number_slider_3, Seed=Slider(2, range=0..10))
random_5 = Random(Range=Domain(0, 1), Number=number_slider_3, Seed=Slider(4, range=0..10))
item_2 = ListItem(List=explode.Segments, Index=0, Wrap=True)  # -> Item, Item1, Item2, Item3
eval = EvaluateCurve(Curve=reparameterize(item_2.Item), Parameter=random_2)  # -> Point, Tangent, Angle
eval_2 = EvaluateCurve(Curve=reparameterize(item_2.Item1), Parameter=random_3)  # -> Point, Tangent, Angle
eval_3 = EvaluateCurve(Curve=reparameterize(item_2.Item2), Parameter=random_4)  # -> Point, Tangent, Angle
eval_4 = EvaluateCurve(Curve=reparameterize(item_2.Item3), Parameter=random_5)  # -> Point, Tangent, Angle
ln = Line(StartPoint=eval.Point, EndPoint=eval_3.Point)
ln_2 = Line(StartPoint=eval_2.Point, EndPoint=eval_4.Point)
ln_3 = Line(StartPoint=eval_3.Point, EndPoint=eval_4.Point)
ln_4 = Line(StartPoint=eval.Point, EndPoint=eval_2.Point)
ln_5 = Line(StartPoint=eval.Point, EndPoint=eval_4.Point)
ln_6 = Line(StartPoint=eval_2.Point, EndPoint=eval_3.Point)
line = Line([ln, ln_2, ln_3, ln_5, ln_6])
merge = Merge(Data1=crv, Data2=line)  # -> flatten(Result)
line_offset_width_2x = Slider(0.037, range=0..1)
xy = XYPlane(Origin=Point(0, 0, 0))
polyoffset = PolylineOffset(Polylines=merge, Distance=line_offset_width_2x, Plane=xy, Tolerance=0.01, ClosedFillet=2, OpenFillet=0, Miter=2)  # -> Contour, Holes
crv_2 = Curve(polyoffset.Contour)
crv_3 = Curve(polyoffset.Holes)

crv_4 = Curve(<curve referenced from the Rhino model>)
multiplication = Multiplication(A=number_slider_2, B=number_slider)

pt_15 = Point(Point(0, 0, 0))
hex_grid_generator_15 = HexGridGenerator(
    origin_point=pt_15,
    cell_scale=Slider(0.5, range=0..10),
    x_axis_extent=Slider(25, range=0..100),
    y_axis_extent=Slider(5, range=0..100))  # -> grid_cell_curves_2, grid_area_centroids
genome_a_type_7_2 = GenomeAType7_3(
    grid_cell_curve=hex_grid_generator_15.grid_cell_curves_2,
    grid_cell_area_centroid=hex_grid_generator_15.grid_area_centroids,
    evaluation_point=Slider(0.3, range=0..1),
    cell_scale=Slider(0.58, range=0..1))  # -> pattern_curves_2, pattern_area_centroids_2
crv_5 = Curve(genome_a_type_7_2.pattern_curves_2)
crv_6 = Curve(<curve referenced from the Rhino model>)
crv_7 = Curve(crv_5)
area = Area(Geometry=crv_7)  # -> Area, Centroid
curve_attractor = CurveAttractor(C=crv_6, P=area.Centroid, A=Slider(0.2, range=0..1), B=Slider(0.8, range=0..1))  # -> R, points_on_curve_2
scale = Scale(Geometry=crv_7, Center=area.Centroid, Factor=curve_attractor.R)  # -> Geometry, Transform
crv_8 = Curve(scale.Geometry)
lng = ListLength(List=crv_8)
crv_9 = Curve(crv_8)
random_6 = Random(Range=Domain(0, 1), Number=lng, Seed=Slider(33, range=0..100))
round = Round(Number=random_6)  # -> Nearest, Floor, Ceiling
cull = CullPattern(List=crv_9, CullPattern=invert(round.Nearest))
culln = CullNth(List=cull, CullFrequency=Slider(2, range=0..10))
cull_2 = CullPattern(List=crv_9, CullPattern=round.Nearest)
crv_10 = Curve(flatten([cull_2, culln]))

genome_a_type_1_2 = GenomeAType1_4(
    grid_cell_curve=hex_grid_generator_9.grid_cell_curves_2,
    grid_cell_area_centroid=hex_grid_generator_9.grid_area_centroids,
    cell_scale=Slider(0.745, range=0..1))  # -> pattern_curves_2, pattern_area_centroids_2
genome_a_type_1_3 = GenomeAType1_5(
    grid_cell_curve=hex_grid_generator_10.grid_cell_curves_2,
    grid_cell_area_centroid=hex_grid_generator_10.grid_area_centroids,
    cell_scale=Slider(0.7, range=0..1))  # -> pattern_curves_2, pattern_area_centroids_2
multiplication_2 = Multiplication(A=multiplication, B=number_slider)
rec = Rectangle(crv_4)
genome_a_type_1_4 = GenomeAType1_3(
    grid_cell_curve=hex_grid_generator_11.grid_cell_curves_2,
    grid_cell_area_centroid=hex_grid_generator_11.grid_area_centroids,
    cell_scale=Slider(0.738, range=0..1))  # -> pattern_curves_2, pattern_area_centroids_2
pop2d = Populate2D(Region=rec, Count=number_slider_2, Seed=item.Item)
pop2d_2 = Populate2D(Region=rec, Count=multiplication, Seed=item.Item1)
pop2d_3 = Populate2D(Region=rec, Count=multiplication_2, Seed=item.Item2)
pattern_2_3_6 = Pattern236(
    grid_cell_curves=hex_grid_generator_12.grid_cell_curves_2,
    grid_cell_area_centroids=hex_grid_generator_12.grid_area_centroids,
    interior_cell_scale=Slider(0.56, range=0..1),
    point_on_curve=Slider(0.16, range=0..1))  # -> flatten(pattern_curves_2), flatten(pattern_area_centroids_2), flatten(grid_cell_area_centroids_4)
pattern_4_5 = Pattern45(
    grid_cell_curves=hex_grid_generator_13.grid_cell_curves_2,
    grid_cell_area_centroids=hex_grid_generator_13.grid_area_centroids,
    interior_cell_scale_a=Slider(0.16, range=0..1),
    interior_cell_scale_b=Slider(0.5, range=0..1),
    interior_subdivisions=Slider(4, range=0..10))  # -> flatten(pattern_curves_2), flatten(pattern_area_centroids_2), grid_cell_area_centroids_4
pattern_1_2_5 = Pattern125(
    grid_cell_curves=hex_grid_generator_14.grid_cell_curves_2,
    grid_cell_area_centroids=hex_grid_generator_14.grid_area_centroids,
    interior_cell_scale=Slider(0.55, range=0..1),
    interior_subdivisions=Slider(8, range=0..10))  # -> flatten(pattern_curves_2), flatten(pattern_area_centroids_2), grid_cell_area_centroids_4

pt_16 = Point(Point(0, 0, 0))
pt_17 = Point(Point(0, 0, 0))
pt_18 = Point(Point(0, 0, 0))
pt_19 = Point(Point(0, 0, 0))
hex_grid_generator_16 = HexGridGenerator(
    origin_point=pt_16,
    cell_scale=Slider(0.5, range=0..10),
    x_axis_extent=Slider(22, range=0..100),
    y_axis_extent=Slider(5, range=0..100))  # -> grid_cell_curves_2, grid_area_centroids
hex_grid_generator_17 = HexGridGenerator(
    origin_point=pt_17,
    cell_scale=Slider(0.5, range=0..10),
    x_axis_extent=Slider(22, range=0..100),
    y_axis_extent=Slider(5, range=0..100))  # -> grid_cell_curves_2, grid_area_centroids
hex_grid_generator_18 = HexGridGenerator(
    origin_point=pt_18,
    cell_scale=Slider(0.5, range=0..10),
    x_axis_extent=Slider(22, range=0..100),
    y_axis_extent=Slider(5, range=0..100))  # -> grid_cell_curves_2, grid_area_centroids
hex_grid_generator_19 = HexGridGenerator(
    origin_point=pt_19,
    cell_scale=Slider(0.5, range=0..10),
    x_axis_extent=Slider(22, range=0..100),
    y_axis_extent=Slider(5, range=0..100))  # -> grid_cell_curves_2, grid_area_centroids
genome_b_type_2 = GenomeAType2_3(
    grid_cell_curve=hex_grid_generator_17.grid_cell_curves_2,
    grid_cell_area_centroid=hex_grid_generator_17.grid_area_centroids,
    evaluation_point=Slider(0.41, range=0..1),
    cell_scale=Slider(0.38, range=0..1),
    scaled_split_evaluation_point=Slider(0.23, range=0..1))  # -> pattern_curves_2, pattern_area_centroids_2
genome_b_type_1 = GenomeAType1_2(
    grid_cell_curve=hex_grid_generator_16.grid_cell_curves_2,
    grid_cell_area_centroid=hex_grid_generator_16.grid_area_centroids,
    cell_scale=Slider(0.61, range=0..1))  # -> pattern_curves_2, pattern_area_centroids_2
genome_b_type_2_2 = GenomeAType2_2(
    grid_cell_curve=hex_grid_generator_18.grid_cell_curves_2,
    grid_cell_area_centroid=hex_grid_generator_18.grid_area_centroids,
    cell_scale=Slider(0.28, range=0..1))  # -> pattern_curves_2, pattern_area_centroids_2
genome_b_type_2_3 = GenomeAType2_4(
    grid_cell_curve=hex_grid_generator_19.grid_cell_curves_2,
    grid_cell_area_centroid=hex_grid_generator_19.grid_area_centroids,
    evaluation_point=Slider(0.55, range=0..1),
    cell_scale=Slider(0.34, range=0..1))  # -> pattern_curves_2, pattern_area_centroids_2

vorgroup = VoronoiGroups(Boundary=rec, Generation1=pop2d, Generation2=pop2d_2, Generation3=pop2d_3)  # -> Diagram1, Diagram2, Diagram3
crv_11 = Curve(vorgroup.Diagram1)
crv_12 = Curve(vorgroup.Diagram2)
crv_13 = Curve(vorgroup.Diagram3)
pt_20 = Point(Point(0, 0, 0))
pt_21 = Point(pattern_4_5.pattern_area_centroids_2)
pt_22 = Point(pattern_1_2_5.pattern_area_centroids_2)
pt_23 = Point(pattern_2_3_6.pattern_area_centroids_2)
crv_14 = Curve(crv_13)
hex_grid_generator_20 = HexGridGenerator(
    origin_point=pt_20,
    cell_scale=Slider(0.5, range=0..10),
    x_axis_extent=Slider(22, range=0..100),
    y_axis_extent=Slider(5, range=0..100))  # -> grid_cell_curves_2, grid_area_centroids
area_2 = Area(Geometry=crv_14)  # -> Area, Centroid
lng_2 = ListLength(List=pt_21)
lng_3 = ListLength(List=pt_23)
lng_4 = ListLength(List=pt_22)
crv_15 = Curve(<curve referenced from the Rhino model>)
crv_16 = Curve(<curve referenced from the Rhino model>)
crv_17 = Curve(<curve referenced from the Rhino model>)
curve_attractor_2 = CurveAttractor(C=crv_16, P=area_2.Centroid, A=Slider(0.33, range=0..1), B=Slider(0.77, range=0..1))  # -> R, points_on_curve_2
division = Division(A=lng_2, B=Slider(8, range=0..10))
division_2 = Division(A=lng_3, B=Slider(2, range=0..10))
division_3 = Division(A=lng_4, B=Slider(10, range=0..10))
genome_b_type_1_2 = GenomeAType1_6(
    grid_cell_curve=hex_grid_generator_20.grid_cell_curves_2,
    grid_cell_area_centroid=hex_grid_generator_20.grid_area_centroids,
    cell_scale=Slider(0.34, range=0..1))  # -> pattern_curves_2, pattern_area_centroids_2
reduce = RandomReduce(List=pt_21, Reduction=division, Seed=Slider(6, range=0..10))
reduce_2 = RandomReduce(List=pt_23, Reduction=division_2, Seed=Slider(6, range=0..10))
reduce_3 = RandomReduce(List=pt_22, Reduction=division_3, Seed=Slider(9, range=0..10))
crv_18 = Curve(<curve referenced from the Rhino model>)
scale_2 = Scale(Geometry=crv_14, Center=area_2.Centroid, Factor=curve_attractor_2.R)  # -> Geometry, Transform

pt_24 = Point(Point(0, 0, 0))
pt_25 = Point(Point(0, 0, 0))
hex_grid_generator_21 = HexGridGenerator(
    origin_point=pt_24,
    cell_scale=Slider(0.5, range=0..10),
    x_axis_extent=Slider(22, range=0..100),
    y_axis_extent=Slider(5, range=0..100))  # -> grid_cell_curves_2, grid_area_centroids
hex_grid_generator_22 = HexGridGenerator(
    origin_point=pt_25,
    cell_scale=Slider(0.5, range=0..10),
    x_axis_extent=Slider(22, range=0..100),
    y_axis_extent=Slider(5, range=0..100))  # -> grid_cell_curves_2, grid_area_centroids
genome_c_type_1 = GenomeCType1(
    grid_cell_curve=hex_grid_generator_21.grid_cell_curves_2,
    grid_cell_area_centroid=hex_grid_generator_21.grid_area_centroids)  # -> pattern_curves_2, pattern_area_centroids_2
genome_c_type_2 = GenomeCType1_2(
    grid_cell_curve=hex_grid_generator_22.grid_cell_curves_2,
    grid_cell_area_centroid=hex_grid_generator_22.grid_area_centroids,
    cell_scale=Slider(0.37, range=0..1))  # -> pattern_curves_2, pattern_area_centroids_2

crv_19 = Curve([crv_3, crv_2])
crv_20 = Curve(scale_2.Geometry)
area_3 = Area(Geometry=crv_20)  # -> Area, Centroid
vorgroup_2 = VoronoiGroups(Boundary=crv_18, Generation1=reduce_2, Generation2=reduce, Generation3=reduce_3)  # -> Diagram1, Diagram2, Diagram3
avr = Average(Input=area_3.Area)
crv_21 = Curve(vorgroup_2.Diagram3)
crv_22 = Curve(vorgroup_2.Diagram1)
crv_23 = Curve(vorgroup_2.Diagram2)
multiplication_3 = Multiplication(A=avr, B=Slider(0.25, range=0..10))
area_4 = Area(Geometry=crv_22)  # -> Area, Centroid
area_5 = Area(Geometry=crv_23)  # -> Area, Centroid
area_6 = Area(Geometry=crv_21)  # -> Area, Centroid
smaller = SmallerThan(FirstNumber=multiplication_3, SecondNumber=area_3.Area)  # -> SmallerThan, OrEqualTo
cull_3 = CullPattern(List=crv_20, CullPattern=invert(smaller.SmallerThan))
cull_4 = CullPattern(List=crv_20, CullPattern=smaller.SmallerThan)
crv_24 = Curve([crv_22, crv_23, crv_21])
lng_5 = ListLength(List=cull_3)
division_4 = Division(A=lng_5, B=Slider(3, range=0..10))
area_7 = Area(Geometry=crv_24)  # -> Area, Centroid
reduce_4 = RandomReduce(List=cull_3, Reduction=division_4, Seed=1)
crv_25 = Curve(<curve referenced from the Rhino model>)
curve_attractor_3 = CurveAttractor(C=crv_25, P=area_7.Centroid, A=Slider(0.33, range=0..1), B=Slider(0.77, range=0..1))  # -> R, points_on_curve_2
crv_26 = Curve(crv_11)
crv_27 = Curve(crv_12)
crv_28 = Curve([cull_4, reduce_4])
crv_29 = Curve(<curve referenced from the Rhino model>)
crv_30 = Curve(crv_10)
scale_3 = Scale(Geometry=crv_24, Center=area_7.Centroid, Factor=curve_attractor_3.R)  # -> Geometry, Transform
area_8 = Area(Geometry=crv_29)  # -> Area, Centroid
bbox = BoundingBox(Content=crv_30, Plane=PlaneXY(0, 0, 0), UnionBox=True)  # -> Box, Box_2

# ---- group: Random Seed Generator
random_7 = Random(Range=Domain(0, 100), Number=Slider(3, range=0..10), Seed=Slider(5, range=0..100), Integers=True)
item_3 = ListItem(List=random_7, Index=0, Wrap=True)  # -> Item, Item1, Item2

# ----
number_slider_4 = Slider(8, range=0..10)
number_slider_5 = Slider(18, range=0..100)
pt_26 = Point(Point(0, 0, 0))
crv_31 = Curve(scale_3.Geometry)
pt_27 = Point(Point(0, 0, 0))
crv_32 = Curve(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)
area_9 = Area(Geometry=crv_31)  # -> Area, Centroid
area_10 = Area(Geometry=bbox.Box)  # -> Area, Centroid
ln_7 = Line(StartPoint=area_10.Centroid, EndPoint=area_8.Centroid)
pt_28 = Point(Point(0, 0, 0))
multiplication_4 = Multiplication(A=number_slider_5, B=number_slider_4)
pt_29 = Point(Point(0, 0, 0))
pt_30 = Point(Point(0, 0, 0))
multiplication_5 = Multiplication(A=multiplication_4, B=number_slider_4)
rec_2 = Rectangle(crv_32)
hex_grid_generator_23 = HexGridGenerator(
    origin_point=pt_26,
    cell_scale=Slider(0.5, range=0..10),
    x_axis_extent=Slider(25, range=0..100),
    y_axis_extent=Slider(5, range=0..100))  # -> grid_cell_curves_2, grid_area_centroids
hex_grid_generator_24 = HexGridGenerator(
    origin_point=pt_27,
    cell_scale=Slider(0.8, range=0..10),
    x_axis_extent=Slider(22, range=0..100),
    y_axis_extent=Slider(5, range=0..100))  # -> grid_cell_curves_2, grid_area_centroids
avr_2 = Average(Input=area_9.Area)
move = Move(Geometry=crv_30, Motion=ln_7)  # -> Geometry, Transform
pop2d_4 = Populate2D(Region=rec_2, Count=number_slider_5, Seed=item_3.Item)
multiplication_6 = Multiplication(A=avr_2, B=Slider(0.517, range=0..10))
pop2d_5 = Populate2D(Region=rec_2, Count=multiplication_4, Seed=item_3.Item1)
pop2d_6 = Populate2D(Region=rec_2, Count=multiplication_5, Seed=item_3.Item2)
hex_grid_generator_25 = HexGridGenerator(
    origin_point=pt_28,
    cell_scale=Slider(0.5, range=0..10),
    x_axis_extent=Slider(25, range=0..100),
    y_axis_extent=Slider(5, range=0..100))  # -> grid_cell_curves_2, grid_area_centroids
hex_grid_generator_26 = HexGridGenerator(
    origin_point=pt_29,
    cell_scale=Slider(0.5, range=0..10),
    x_axis_extent=Slider(25, range=0..100),
    y_axis_extent=Slider(5, range=0..100))  # -> grid_cell_curves_2, grid_area_centroids
hex_grid_generator_27 = HexGridGenerator(
    origin_point=pt_30,
    cell_scale=Slider(0.8, range=0..10),
    x_axis_extent=Slider(22, range=0..100),
    y_axis_extent=Slider(5, range=0..100))  # -> grid_cell_curves_2, grid_area_centroids
smaller_2 = SmallerThan(FirstNumber=multiplication_6, SecondNumber=area_9.Area)  # -> SmallerThan, OrEqualTo
weave = Weave(Pattern=[0, 1, 2], Stream0=pop2d_4, Stream1=pop2d_5, Stream2=pop2d_6, NullGaps=False)
cull_5 = CullPattern(List=crv_31, CullPattern=invert(smaller_2.SmallerThan))
cull_6 = CullPattern(List=crv_31, CullPattern=smaller_2.SmallerThan)
genome_a_type_x = GenomeATypeX_2(
    grid_cell_curve=hex_grid_generator_24.grid_cell_curves_2,
    grid_cell_area_centroid=hex_grid_generator_24.grid_area_centroids,
    cell_scale=Slider(0.415, range=0..1))  # -> pattern_curves_2, pattern_area_centroids_2
genome_a_type_8_2 = GenomeAType8(
    grid_cell_curve=hex_grid_generator_25.grid_cell_curves_2,
    grid_cell_area_centroid=hex_grid_generator_25.grid_area_centroids,
    cell_scale=Slider(0.589, range=0..1))  # -> pattern_curves_2, pattern_area_centroids_2
lng_6 = ListLength(List=cull_5)
genome_a_type_7_3 = GenomeAType7(
    grid_cell_curve=hex_grid_generator_26.grid_cell_curves_2,
    grid_cell_area_centroid=hex_grid_generator_26.grid_area_centroids,
    evaluation_point=Slider(0.17, range=0..1))  # -> pattern_curves_2, pattern_area_centroids_2
voronoi = Voronoi(Points=weave, Boundary=rec_2, BruteForceOverride=False)
genome_a_type_x_2 = GenomeATypeX(
    grid_cell_curve=hex_grid_generator_27.grid_cell_curves_2,
    grid_cell_area_centroid=hex_grid_generator_27.grid_area_centroids,
    cell_scale=Slider(0.313, range=0..1))  # -> pattern_curves_2, pattern_area_centroids_2
division_5 = Division(A=lng_6, B=Slider(2, range=0..10))
genome_a_type_1_5 = GenomeAType1_4(
    grid_cell_curve=hex_grid_generator_23.grid_cell_curves_2,
    grid_cell_area_centroid=hex_grid_generator_23.grid_area_centroids,
    cell_scale=Slider(0.874, range=0..1))  # -> pattern_curves_2, pattern_area_centroids_2
crv_33 = Curve(<curve referenced from the Rhino model>)
reduce_5 = RandomReduce(List=cull_5, Reduction=division_5, Seed=1)
area_11 = Area(Geometry=genome_a_type_x.pattern_curves_2)  # -> Area, Centroid
crv_34 = Curve(<curve referenced from the Rhino model>)
crv_35 = Curve(voronoi)
curve_attractor_4 = CurveAttractor(C=crv_33, P=genome_a_type_8_2.pattern_area_centroids_2, A=Slider(0.6, range=0..1), B=Slider(0.2, range=0..1))  # -> R, points_on_curve_2
area_12 = Area(Geometry=genome_a_type_7_3.pattern_curves_2)  # -> Area, Centroid
cset = CreateSet(List=area_11.Area)  # -> Set, Map
crv_36 = Curve([cull_6, reduce_5])
area_13 = Area(Geometry=genome_a_type_x_2.pattern_curves_2)  # -> Area, Centroid
area_14 = Area(Geometry=genome_a_type_1_5.pattern_curves_2)  # -> Area, Centroid
cset_2 = CreateSet(List=area_12.Area)  # -> Set, Map
area_15 = Area(Geometry=crv_35)  # -> Area, Centroid
cset_3 = CreateSet(List=area_13.Area)  # -> Set, Map
sift = SiftPattern(List=genome_a_type_x.pattern_curves_2, SiftPattern=cset.Map)  # -> Output0, Output1
crv_37 = Curve(<curve referenced from the Rhino model>)
crv_38 = Curve(<curve referenced from the Rhino model>)
crv_39 = Curve(<curve referenced from the Rhino model>)
scale_4 = Scale(
    Geometry=genome_a_type_8_2.pattern_curves_2,
    Center=genome_a_type_8_2.pattern_area_centroids_2,
    Factor=curve_attractor_4.R)  # -> Geometry, Transform
sift_2 = SiftPattern(List=genome_a_type_7_3.pattern_curves_2, SiftPattern=cset_2.Map)  # -> Output0, Output1
crv_40 = Curve(sift.Output0)
crv_41 = Curve(sift.Output1)
sift_3 = SiftPattern(List=genome_a_type_x_2.pattern_curves_2, SiftPattern=cset_3.Map)  # -> Output0, Output1
curve_attractor_5 = CurveAttractor(C=crv_38, P=area_15.Centroid, A=Slider(0.15, range=0..1), B=Slider(0.77, range=0..1))  # -> R, points_on_curve_2
number_slider_6 = Slider(0.6, range=0..1)
number_slider_7 = Slider(0.2, range=0..1)
crv_42 = Curve(sift_2.Output0)
crv_43 = Curve(sift_2.Output1)
crv_44 = Curve(scale_4.Geometry)
lng_7 = ListLength(List=crv_44)
crv_45 = Curve(sift_3.Output0)
crv_46 = Curve(sift_3.Output1)
runion = RegionUnion(Curves=crv_42)
number_slider_8 = Slider(0.6, range=0..1)
crv_47 = Curve(<curve referenced from the Rhino model>)
crv_48 = Curve(<curve referenced from the Rhino model>)
division_6 = Division(A=lng_7, B=Slider(6, range=0..10))
number_slider_9 = Slider(0.2, range=0..1)
area_16 = Area(Geometry=crv_41)  # -> Area, Centroid
area_17 = Area(Geometry=runion)  # -> Area, Centroid
area_18 = Area(Geometry=crv_43)  # -> Area, Centroid
crv_49 = Curve(<curve referenced from the Rhino model>)
number_slider_10 = Slider(0.6, range=0..1)
number_slider_11 = Slider(0.2, range=0..1)
curve_attractor_6 = CurveAttractor(C=crv_47, P=area_17.Centroid, A=number_slider_6, B=number_slider_7)  # -> R, points_on_curve_2
scale_5 = Scale(Geometry=crv_35, Center=area_15.Centroid, Factor=curve_attractor_5.R)  # -> Geometry, Transform
area_19 = Area(Geometry=crv_46)  # -> Area, Centroid
area_20 = Area(Geometry=crv_40)  # -> Area, Centroid
curve_attractor_7 = CurveAttractor(C=crv_47, P=area_18.Centroid, A=number_slider_7, B=number_slider_6)  # -> R, points_on_curve_2
crv_50 = Curve(<curve referenced from the Rhino model>)
curve_attractor_8 = CurveAttractor(C=crv_48, P=area_14.Centroid, A=Slider(0.2, range=0..1), B=Slider(0.6, range=0..1))  # -> R, points_on_curve_2
curve_attractor_9 = CurveAttractor(C=crv_49, P=area_20.Centroid, A=number_slider_8, B=number_slider_9)  # -> R, points_on_curve_2
curve_attractor_10 = CurveAttractor(C=crv_49, P=area_16.Centroid, A=number_slider_9, B=number_slider_8)  # -> R, points_on_curve_2
area_21 = Area(Geometry=crv_45)  # -> Area, Centroid
crv_51 = Curve(scale_5.Geometry)
reduce_6 = RandomReduce(List=crv_44, Reduction=division_6, Seed=Slider(5, range=0..10))
curve_attractor_11 = CurveAttractor(C=crv_50, P=area_21.Centroid, A=number_slider_10, B=number_slider_11)  # -> R, points_on_curve_2
curve_attractor_12 = CurveAttractor(C=crv_50, P=area_19.Centroid, A=number_slider_11, B=number_slider_10)  # -> R, points_on_curve_2
scale_6 = Scale(Geometry=runion, Center=area_17.Centroid, Factor=curve_attractor_6.R)  # -> Geometry, Transform
scale_7 = Scale(Geometry=crv_43, Center=area_18.Centroid, Factor=curve_attractor_7.R)  # -> Geometry, Transform
crv_52 = Curve(reduce_6)
scale_8 = Scale(Geometry=genome_a_type_1_5.pattern_curves_2, Center=area_14.Centroid, Factor=curve_attractor_8.R)  # -> Geometry, Transform
crv_53 = Curve(scale_6.Geometry)
scale_9 = Scale(Geometry=crv_40, Center=area_20.Centroid, Factor=curve_attractor_9.R)  # -> Geometry, Transform
crv_54 = Curve(scale_7.Geometry)
scale_10 = Scale(Geometry=crv_41, Center=area_16.Centroid, Factor=curve_attractor_10.R)  # -> Geometry, Transform
lng_8 = ListLength(List=crv_53)
lng_9 = ListLength(List=crv_54)
division_7 = Division(A=lng_8, B=Slider(4, range=0..10))
crv_55 = Curve(scale_8.Geometry)
crv_56 = Curve(scale_9.Geometry)
division_8 = Division(A=lng_9, B=Slider(6, range=0..10))
lng_10 = ListLength(List=crv_55)
crv_57 = Curve(scale_10.Geometry)
scale_11 = Scale(Geometry=crv_45, Center=area_21.Centroid, Factor=curve_attractor_11.R)  # -> Geometry, Transform
lng_11 = ListLength(List=crv_56)
scale_12 = Scale(Geometry=crv_46, Center=area_19.Centroid, Factor=curve_attractor_12.R)  # -> Geometry, Transform
lng_12 = ListLength(List=crv_57)
division_9 = Division(A=lng_10, B=Slider(6, range=0..10))
division_10 = Division(A=lng_11, B=Slider(4, range=0..10))
division_11 = Division(A=lng_12, B=Slider(6, range=0..10))
crv_58 = Curve(scale_11.Geometry)
crv_59 = Curve(crv_51)
crv_60 = Curve(scale_12.Geometry)
lng_13 = ListLength(List=crv_58)
crv_61 = Curve([crv_57, crv_56])
lng_14 = ListLength(List=crv_60)
reduce_7 = RandomReduce(List=crv_53, Reduction=division_7, Seed=1)
reduce_8 = RandomReduce(List=crv_54, Reduction=division_8, Seed=Slider(5, range=0..10))
division_12 = Division(A=lng_13, B=Slider(4, range=0..10))
area_22 = Area(Geometry=crv_59)  # -> Area, Centroid
division_13 = Division(A=lng_14, B=Slider(6, range=0..10))
reduce_9 = RandomReduce(List=crv_55, Reduction=division_9, Seed=Slider(5, range=0..10))
crv_62 = Curve(reduce_7)
reduce_10 = RandomReduce(List=crv_56, Reduction=division_10, Seed=1)
crv_63 = Curve(reduce_8)
reduce_11 = RandomReduce(List=crv_57, Reduction=division_11, Seed=Slider(5, range=0..10))
avr_3 = Average(Input=area_22.Area)
crv_64 = Curve(reduce_9)
crv_65 = Curve(reduce_10)
crv_66 = Curve([crv_62, crv_63])
crv_67 = Curve(reduce_11)
reduce_12 = RandomReduce(List=crv_58, Reduction=division_12, Seed=1)
reduce_13 = RandomReduce(List=crv_60, Reduction=division_13, Seed=Slider(5, range=0..10))
multiplication_7 = Multiplication(A=avr_3, B=Slider(0.616, range=0..10))
crv_68 = Curve([crv_65, crv_67])
crv_69 = Curve(reduce_12)
crv_70 = Curve(reduce_13)
smaller_3 = SmallerThan(FirstNumber=multiplication_7, SecondNumber=area_22.Area)  # -> SmallerThan, OrEqualTo
crv_71 = Curve([crv_69, crv_70])
cull_7 = CullPattern(List=crv_59, CullPattern=invert(smaller_3.SmallerThan))
lng_15 = ListLength(List=cull_7)
division_14 = Division(A=lng_15, B=Slider(4, range=0..10))
reduce_14 = RandomReduce(List=cull_7, Reduction=division_14, Seed=1)
cull_8 = CullPattern(List=crv_59, CullPattern=smaller_3.SmallerThan)
crv_72 = Curve([reduce_14, cull_8])
pt_31 = Point(Point(0, 0, 0))
pt_32 = Point(Point(0, 0, 0))

pt_33 = Point(Point(0, 0, 0))
hex_grid_generator_28 = HexGridGenerator(
    origin_point=pt_33,
    cell_scale=Slider(0.5, range=0..10),
    x_axis_extent=Slider(25, range=0..100),
    y_axis_extent=Slider(5, range=0..100))  # -> grid_cell_curves_2, grid_area_centroids
genome_a_type_7_4 = GenomeAType7_2(
    grid_cell_curve=hex_grid_generator_28.grid_cell_curves_2,
    grid_cell_area_centroid=hex_grid_generator_28.grid_area_centroids,
    evaluation_point=Slider(0.3, range=0..1),
    cell_scale=Slider(0.58, range=0..1))  # -> pattern_curves_2, pattern_area_centroids_2
crv_73 = Curve(genome_a_type_7_4.pattern_curves_2)
number_slider_12 = Slider(0.8, range=0..1)
number_slider_13 = Slider(0.2, range=0..1)
area_23 = Area(Geometry=crv_73)  # -> Area, Centroid
cset_4 = CreateSet(List=area_23.Area)  # -> Set, Map
crv_74 = Curve(<curve referenced from the Rhino model>)
sift_4 = SiftPattern(List=crv_73, SiftPattern=cset_4.Map)  # -> Output0, Output1
crv_75 = Curve(sift_4.Output1)
crv_76 = Curve(sift_4.Output0)
area_24 = Area(Geometry=crv_75)  # -> Area, Centroid
area_25 = Area(Geometry=crv_76)  # -> Area, Centroid
curve_attractor_13 = CurveAttractor(C=crv_74, P=area_25.Centroid, A=number_slider_13, B=number_slider_12)  # -> R, points_on_curve_2
curve_attractor_14 = CurveAttractor(C=crv_74, P=area_24.Centroid, A=number_slider_13, B=number_slider_12)  # -> R, points_on_curve_2
scale_13 = Scale(Geometry=crv_75, Center=area_24.Centroid, Factor=curve_attractor_14.R)  # -> Geometry, Transform
scale_14 = Scale(Geometry=crv_76, Center=area_25.Centroid, Factor=curve_attractor_13.R)  # -> Geometry, Transform
crv_77 = Curve(scale_13.Geometry)
crv_78 = Curve(scale_14.Geometry)
null = NullItem(Item=crv_77)  # -> reverse(NullFlags), InvalidFlags, Description
null_2 = NullItem(Item=crv_78)  # -> reverse(NullFlags), InvalidFlags, Description
cull_9 = CullPattern(List=crv_77, CullPattern=null.NullFlags)
cull_10 = CullPattern(List=crv_78, CullPattern=null_2.NullFlags)
weave_2 = Weave(Pattern=[0, 1], Stream0=cull_9, Stream1=cull_10, NullGaps=False)
lng_16 = ListLength(List=weave_2)
crv_79 = Curve(weave_2)
random_8 = Random(Range=Domain(0, 1), Number=lng_16, Seed=Slider(33, range=0..100))
round_2 = Round(Number=random_8)  # -> Nearest, Floor, Ceiling
cull_11 = CullPattern(List=crv_79, CullPattern=invert(round_2.Nearest))
culln_2 = CullNth(List=cull_11, CullFrequency=Slider(2, range=0..10))
cull_12 = CullPattern(List=crv_79, CullPattern=round_2.Nearest)
crv_80 = Curve(flatten([cull_12, culln_2]))

hex_grid_generator_29 = HexGridGenerator(
    origin_point=pt_31,
    cell_scale=Slider(0.8, range=0..10),
    x_axis_extent=Slider(25, range=0..100),
    y_axis_extent=Slider(5, range=0..100))  # -> grid_cell_curves_2, grid_area_centroids
hex_grid_generator_30 = HexGridGenerator(
    origin_point=pt_32,
    cell_scale=Slider(0.8, range=0..10),
    x_axis_extent=Slider(25, range=0..100),
    y_axis_extent=Slider(5, range=0..100))  # -> grid_cell_curves_2, grid_area_centroids
genome_a_type_8_3 = GenomeAType8_2(
    grid_cell_curve=hex_grid_generator_29.grid_cell_curves_2,
    grid_cell_area_centroid=hex_grid_generator_29.grid_area_centroids,
    cell_scale=Slider(0.536, range=0..1))  # -> pattern_curves_2, pattern_area_centroids_2
genome_a_type_8_4 = GenomeAType8(
    grid_cell_curve=hex_grid_generator_30.grid_cell_curves_2,
    grid_cell_area_centroid=hex_grid_generator_30.grid_area_centroids,
    cell_scale=Slider(0.705, range=0..1))  # -> pattern_curves_2, pattern_area_centroids_2
crv_81 = Curve(<curve referenced from the Rhino model>)
crv_82 = Curve(<curve referenced from the Rhino model>)
curve_attractor_15 = CurveAttractor(C=crv_81, P=genome_a_type_8_3.pattern_area_centroids_2, A=Slider(0.6, range=0..1), B=Slider(0.2, range=0..1))  # -> R, points_on_curve_2
curve_attractor_16 = CurveAttractor(C=crv_82, P=genome_a_type_8_4.pattern_area_centroids_2, A=Slider(0.6, range=0..1), B=Slider(0.2, range=0..1))  # -> R, points_on_curve_2
scale_15 = Scale(
    Geometry=genome_a_type_8_3.pattern_curves_2,
    Center=genome_a_type_8_3.pattern_area_centroids_2,
    Factor=curve_attractor_15.R)  # -> Geometry, Transform
scale_16 = Scale(
    Geometry=genome_a_type_8_4.pattern_curves_2,
    Center=genome_a_type_8_4.pattern_area_centroids_2,
    Factor=curve_attractor_16.R)  # -> Geometry, Transform
crv_83 = Curve(scale_15.Geometry)
crv_84 = Curve(scale_16.Geometry)
lng_17 = ListLength(List=crv_83)
lng_18 = ListLength(List=crv_84)
division_15 = Division(A=lng_17, B=Slider(4, range=0..10))
division_16 = Division(A=lng_18, B=Slider(6, range=0..10))
reduce_15 = RandomReduce(List=crv_83, Reduction=division_15, Seed=Slider(5, range=0..10))
reduce_16 = RandomReduce(List=crv_84, Reduction=division_16, Seed=Slider(5, range=0..10))
crv_85 = Curve(<curve referenced from the Rhino model>)
crv_86 = Curve(<curve referenced from the Rhino model>)
crv_87 = Curve(crv_83)
crv_88 = Curve(reduce_16)
area_26 = Area(Geometry=crv_85)  # -> Area, Centroid
area_27 = Area(Geometry=crv_86)  # -> Area, Centroid
bbox_2 = BoundingBox(Content=crv_87, Plane=PlaneXY(0, 0, 0), UnionBox=True)  # -> Box, Box_2
bbox_3 = BoundingBox(Content=crv_88, Plane=PlaneXY(0, 0, 0), UnionBox=True)  # -> Box, Box_2
area_28 = Area(Geometry=bbox_2.Box)  # -> Area, Centroid
ln_8 = Line(StartPoint=area_28.Centroid, EndPoint=area_26.Centroid)
area_29 = Area(Geometry=bbox_3.Box)  # -> Area, Centroid
ln_9 = Line(StartPoint=area_29.Centroid, EndPoint=area_27.Centroid)
move_2 = Move(Geometry=crv_87, Motion=ln_8)  # -> Geometry, Transform
move_3 = Move(Geometry=crv_88, Motion=ln_9)  # -> Geometry, Transform
crv_89 = Curve(<curve referenced from the Rhino model>)
crv_90 = Curve(crv_80)
area_30 = Area(Geometry=crv_89)  # -> Area, Centroid
bbox_4 = BoundingBox(Content=crv_90, Plane=PlaneXY(0, 0, 0), UnionBox=True)  # -> Box, Box_2
area_31 = Area(Geometry=bbox_4.Box)  # -> Area, Centroid
ln_10 = Line(StartPoint=area_31.Centroid, EndPoint=area_30.Centroid)
move_4 = Move(Geometry=crv_90, Motion=ln_10)  # -> Geometry, Transform

# ==== cluster HexGridGenerator: Grid Gen
y_axis_extent = ClusterInput()
x_axis_extent = ClusterInput()
in = ClusterInput()  # "---------------------"
origin_point = ClusterInput()
cell_scale = ClusterInput()
y_axis_extent_2 = Number(y_axis_extent)
x_axis_extent_2 = Number(x_axis_extent)
cell_scale_2 = Number(cell_scale)
origin_point_2 = Point(origin_point)
division = Division(XAxisExtent=x_axis_extent_2, B=cell_scale_2)
division_2 = Division(YAxisExtent=y_axis_extent_2, B=cell_scale_2)
hexgrid = Hexagonal(Plane=origin_point_2, Size=cell_scale_2, ExtentX=division, ExtentY=division_2)  # -> Cells, Points
grid_cell_curves = Curve(hexgrid.Cells)
area = Area(Geometry=grid_cell_curves)  # -> Area, GridAreaCentroids
grid_area_centroids = ClusterOutput(area.GridAreaCentroids)
grid_cell_curves_2 = ClusterOutput(grid_cell_curves)

# ==== cluster GenomeAType2: Pattern Component
grid_cell_area_centroid = ClusterInput()
grid_cell_curve = ClusterInput()
pattern_generator_tool = PATTERNGENERATORTOOL(grid_cell_curve=grid_cell_curve, grid_cell_area_centroid=grid_cell_area_centroid)  # -> grid_cell_curves_2, grid_cell_2, grid_cell_area_centroids_2, grid_cell_area_centroid_4, x_7, midpoint_2, vertex_2, split_midpoint_a_2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
ln = Line(StartPoint=pattern_generator_tool.vertex_2, EndPoint=pattern_generator_tool.area_centroid_2)
srfsplit = SurfaceSplit(GridCell=pattern_generator_tool.grid_cell_2, PatternCurves=ln)
ln_2 = Line(
    CellAreaCentroid=pattern_generator_tool.grid_cell_area_centroid_4,
    CellAreaCentroids=pattern_generator_tool.grid_cell_area_centroids_2)
move = Move(Geometry=srfsplit, Motion=graft(ln_2))  # -> flatten(Geometry), Transform
area = Area(Geometry=move.Geometry)  # -> Area, Centroid
pattern_area_centroids = Point(area.Centroid)
pattern_curves = Curve(move.Geometry)
pattern_area_centroids_2 = ClusterOutput(pattern_area_centroids)
pattern_curves_2 = ClusterOutput(pattern_curves)

# ==== cluster GenomeAType1: Pattern Component
grid_cell_area_centroid = ClusterInput()
grid_cell_curve = ClusterInput()
number_slider = Slider(0.63, range=0..1)
pattern_generator_tool = PatternGeneratorTool(
    grid_cell_curve=grid_cell_curve,
    grid_cell_area_centroid=grid_cell_area_centroid,
    eval_point=number_slider,
    cell_scale=number_slider)  # -> grid_cell_curves_2, grid_cell_2, scaled_grid_cell_2, grid_cell_area_centroids_2, grid_cell_area_centroid_4, x_7, midpoint_2, vertex_2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
ln = Line(StartPoint=pattern_generator_tool.midpoint_2, EndPoint=pattern_generator_tool.area_centroid_2)
srfsplit = SurfaceSplit(GridCell=pattern_generator_tool.grid_cell_2, PatternCurves=ln)
ln_2 = Line(
    CellAreaCentroid=pattern_generator_tool.grid_cell_area_centroid_4,
    CellAreaCentroids=pattern_generator_tool.grid_cell_area_centroids_2)
move = Move(Geometry=srfsplit, Motion=graft(ln_2))  # -> flatten(Geometry), Transform
area = Area(Geometry=move.Geometry)  # -> Area, Centroid
pattern_area_centroids = Point(area.Centroid)
pattern_curves = Curve(move.Geometry)
pattern_area_centroids_2 = ClusterOutput(pattern_area_centroids)
pattern_curves_2 = ClusterOutput(pattern_curves)

# ==== cluster GenomeAType3: Pattern Component
grid_cell_area_centroid = ClusterInput()
grid_cell_curve = ClusterInput()
pattern_generator_tool = PATTERNGENERATORTOOL(grid_cell_curve=grid_cell_curve, grid_cell_area_centroid=grid_cell_area_centroid)  # -> grid_cell_curves_2, grid_cell_2, grid_cell_area_centroids_2, grid_cell_area_centroid_4, x_7, midpoint_2, vertex_2, split_midpoint_a_2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
ln = Line(StartPoint=pattern_generator_tool.split_midpoint_a_2, EndPoint=pattern_generator_tool.area_centroid_2)
srfsplit = SurfaceSplit(GridCell=pattern_generator_tool.grid_cell_2, PatternCurves=ln)
ln_2 = Line(
    CellAreaCentroid=pattern_generator_tool.grid_cell_area_centroid_4,
    CellAreaCentroids=pattern_generator_tool.grid_cell_area_centroids_2)
move = Move(Geometry=srfsplit, Motion=graft(ln_2))  # -> flatten(Geometry), Transform
area = Area(Geometry=move.Geometry)  # -> Area, Centroid
pattern_area_centroids = Point(area.Centroid)
pattern_curves = Curve(move.Geometry)
pattern_area_centroids_2 = ClusterOutput(pattern_area_centroids)
pattern_curves_2 = ClusterOutput(pattern_curves)

# ==== cluster GenomeAType4: Pattern Component
grid_cell_area_centroid = ClusterInput()
grid_cell_curve = ClusterInput()
pattern_generator_tool = PATTERNGENERATORTOOL(grid_cell_curve=grid_cell_curve, grid_cell_area_centroid=grid_cell_area_centroid)  # -> grid_cell_curves_2, grid_cell_2, grid_cell_area_centroids_2, grid_cell_area_centroid_4, x_7, midpoint_2, vertex_2, split_midpoint_a_2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
ln = Line(StartPoint=pattern_generator_tool.split_vertex_a_2, EndPoint=pattern_generator_tool.area_centroid_2)
srfsplit = SurfaceSplit(GridCell=pattern_generator_tool.grid_cell_2, PatternCurves=ln)
ln_2 = Line(
    CellAreaCentroid=pattern_generator_tool.grid_cell_area_centroid_4,
    CellAreaCentroids=pattern_generator_tool.grid_cell_area_centroids_2)
move = Move(Geometry=srfsplit, Motion=graft(ln_2))  # -> flatten(Geometry), Transform
area = Area(Geometry=move.Geometry)  # -> Area, Centroid
pattern_area_centroids = Point(area.Centroid)
pattern_curves = Curve(move.Geometry)
pattern_area_centroids_2 = ClusterOutput(pattern_area_centroids)
pattern_curves_2 = ClusterOutput(pattern_curves)

# ==== cluster GenomeAType5: Pattern Component
grid_cell_area_centroid = ClusterInput()
grid_cell_curve = ClusterInput()
pattern_generator_tool = PATTERNGENERATORTOOL(grid_cell_curve=grid_cell_curve, grid_cell_area_centroid=grid_cell_area_centroid)  # -> grid_cell_curves_2, grid_cell_2, grid_cell_area_centroids_2, grid_cell_area_centroid_4, x_7, midpoint_2, vertex_2, split_midpoint_a_2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
ln = Line(StartPoint=pattern_generator_tool.midpoint_2, EndPoint=pattern_generator_tool.area_centroid_2)
ln_2 = Line(StartPoint=pattern_generator_tool.vertex_2, EndPoint=pattern_generator_tool.area_centroid_2)
srfsplit = SurfaceSplit(GridCell=pattern_generator_tool.grid_cell_2, PatternCurves=[ln, ln_2])
ln_3 = Line(
    CellAreaCentroid=pattern_generator_tool.grid_cell_area_centroid_4,
    CellAreaCentroids=pattern_generator_tool.grid_cell_area_centroids_2)
move = Move(Geometry=srfsplit, Motion=graft(ln_3))  # -> flatten(Geometry), Transform
area = Area(Geometry=move.Geometry)  # -> Area, Centroid
pattern_area_centroids = Point(area.Centroid)
pattern_curves = Curve(move.Geometry)
pattern_area_centroids_2 = ClusterOutput(pattern_area_centroids)
pattern_curves_2 = ClusterOutput(pattern_curves)

# ==== cluster GenomeAType6: Pattern Component
grid_cell_area_centroid = ClusterInput()
grid_cell_curve = ClusterInput()
evaluation_point = ClusterInput()
pattern_generator_tool = PATTERNGENERATORTOOL(grid_cell_curve=grid_cell_curve, grid_cell_area_centroid=grid_cell_area_centroid, eval_point=evaluation_point)  # -> grid_cell_curves_2, grid_cell_2, grid_cell_area_centroids_2, grid_cell_area_centroid_4, x_7, midpoint_2, vertex_2, split_midpoint_a_2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
ln = Line(StartPoint=pattern_generator_tool.eval_seg_2, EndPoint=pattern_generator_tool.area_centroid_2)
srfsplit = SurfaceSplit(GridCell=pattern_generator_tool.grid_cell_2, PatternCurves=ln)
ln_2 = Line(
    CellAreaCentroid=pattern_generator_tool.grid_cell_area_centroid_4,
    CellAreaCentroids=pattern_generator_tool.grid_cell_area_centroids_2)
move = Move(Geometry=srfsplit, Motion=graft(ln_2))  # -> flatten(Geometry), Transform
area = Area(Geometry=move.Geometry)  # -> Area, Centroid
pattern_area_centroids = Point(area.Centroid)
pattern_curves = Curve(move.Geometry)
pattern_area_centroids_2 = ClusterOutput(pattern_area_centroids)
pattern_curves_2 = ClusterOutput(pattern_curves)

# ==== cluster GenomeAType7: Pattern Component
grid_cell_area_centroid = ClusterInput()
grid_cell_curve = ClusterInput()
evaluation_point = ClusterInput()
pattern_generator_tool = PATTERNGENERATORTOOL_2(grid_cell_curve=grid_cell_curve, grid_cell_area_centroid=grid_cell_area_centroid, split_eval_point=evaluation_point)  # -> grid_cell_curves_2, grid_cell_2, grid_cell_area_centroids_2, grid_cell_area_centroid_4, x_7, midpoint_2, vertex_2, split_midpoint_a_2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
ln = Line(StartPoint=pattern_generator_tool.split_eval_seg_gen_2, EndPoint=pattern_generator_tool.area_centroid_2)
srfsplit = SurfaceSplit(GridCell=pattern_generator_tool.grid_cell_2, PatternCurves=ln)
ln_2 = Line(
    CellAreaCentroid=pattern_generator_tool.grid_cell_area_centroid_4,
    CellAreaCentroids=pattern_generator_tool.grid_cell_area_centroids_2)
move = Move(Geometry=srfsplit, Motion=graft(ln_2))  # -> flatten(Geometry), Transform
area = Area(Geometry=move.Geometry)  # -> Area, Centroid
pattern_area_centroids = Point(area.Centroid)
pattern_curves = Curve(move.Geometry)
pattern_area_centroids_2 = ClusterOutput(pattern_area_centroids)
pattern_curves_2 = ClusterOutput(pattern_curves)

# ==== cluster GenomeAType8: Pattern Component
grid_cell_area_centroid = ClusterInput()
grid_cell_curve = ClusterInput()
cell_scale = ClusterInput()
pattern_generator_tool = PatternGeneratorTool_2(grid_cell_curve=grid_cell_curve, grid_cell_area_centroid=grid_cell_area_centroid, cell_scale=cell_scale)  # -> grid_cell_curves_2, grid_cell_2, scaled_grid_cell_2, grid_cell_area_centroids_2, grid_cell_area_centroid_4, x_7, midpoint_2, vertex_2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
explode = Explode(Curve=pattern_generator_tool.scaled_grid_cell_2, Recursive=True)  # -> Segments, Vertices
ln = Line(StartPoint=pattern_generator_tool.midpoint_2, EndPoint=pattern_generator_tool.scaled_vertex_2)
ln_2 = Line(StartPoint=pattern_generator_tool.scaled_vertex_2, EndPoint=pattern_generator_tool.area_centroid_2)
ln_3 = Line(
    CellAreaCentroid=pattern_generator_tool.grid_cell_area_centroid_4,
    CellAreaCentroids=pattern_generator_tool.grid_cell_area_centroids_2)
srfsplit = SurfaceSplit(GridCell=pattern_generator_tool.grid_cell_2, PatternCurves=[ln_2, ln])
move = Move(Geometry=srfsplit, Motion=graft(ln_3))  # -> flatten(Geometry), Transform
area = Area(Geometry=move.Geometry)  # -> Area, Centroid
pattern_area_centroids = Point(area.Centroid)
pattern_curves = Curve(move.Geometry)
pattern_area_centroids_2 = ClusterOutput(pattern_area_centroids)
pattern_curves_2 = ClusterOutput(pattern_curves)

# ==== cluster GenomeAType1_2: Pattern Component
cell_scale = ClusterInput()
grid_cell_area_centroid = ClusterInput()
grid_cell_curve = ClusterInput()
pattern_generator_tool = PatternGeneratorTool(grid_cell_curve=grid_cell_curve, grid_cell_area_centroid=grid_cell_area_centroid, cell_scale=cell_scale)  # -> grid_cell_curves_2, grid_cell_2, scaled_grid_cell_2, grid_cell_area_centroids_2, grid_cell_area_centroid_4, x_7, midpoint_2, vertex_2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
pt = Point(pattern_generator_tool.midpoint_2)
pt_2 = Point(pattern_generator_tool.scaled_vertex_2)
weave = Weave(Pattern=[0, 1], Stream0=pt_2, Stream1=pt, NullGaps=False)
ln = Line(
    CellAreaCentroid=pattern_generator_tool.grid_cell_area_centroid_4,
    CellAreaCentroids=pattern_generator_tool.grid_cell_area_centroids_2)
intcrv = Interpolate(Vertices=weave, Degree=Slider(1, range=0..1), Periodic=True, KnotStyle=0)  # -> Curve, Length, Domain
pline = PolyLine(Vertices=weave, Closed=True)
explode = Explode(Curve=pline, Recursive=True)  # -> Segments, Vertices
srfsplit = SurfaceSplit(GridCell=pattern_generator_tool.grid_cell_2, PatternCurves=explode.Segments)
move = Move(Geometry=srfsplit, Motion=graft(ln))  # -> flatten(Geometry), Transform
area = Area(Geometry=move.Geometry)  # -> Area, Centroid
pattern_area_centroids = Point(area.Centroid)
pattern_curves = Curve(move.Geometry)
pattern_area_centroids_2 = ClusterOutput(pattern_area_centroids)
pattern_curves_2 = ClusterOutput(pattern_curves)

# ==== cluster GenomeAType2_2: Pattern Component
cell_scale = ClusterInput()
grid_cell_area_centroid = ClusterInput()
grid_cell_curve = ClusterInput()
pattern_generator_tool = PatternGeneratorTool(grid_cell_curve=grid_cell_curve, grid_cell_area_centroid=grid_cell_area_centroid, cell_scale=cell_scale)  # -> grid_cell_curves_2, grid_cell_2, scaled_grid_cell_2, grid_cell_area_centroids_2, grid_cell_area_centroid_4, x_7, midpoint_2, vertex_2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
pt = Point(pattern_generator_tool.split_vertex_a_2)
pt_2 = Point(pattern_generator_tool.scaled_split_midpoint_a_2)
weave = Weave(Pattern=[0, 1], Stream0=pt, Stream1=pt_2, NullGaps=False)
ln = Line(
    CellAreaCentroid=pattern_generator_tool.grid_cell_area_centroid_4,
    CellAreaCentroids=pattern_generator_tool.grid_cell_area_centroids_2)
intcrv = Interpolate(Vertices=weave, Degree=Slider(1, range=0..1), Periodic=True, KnotStyle=0)  # -> Curve, Length, Domain
pline = PolyLine(Vertices=weave, Closed=True)
explode = Explode(Curve=pline, Recursive=True)  # -> Segments, Vertices
srfsplit = SurfaceSplit(GridCell=pattern_generator_tool.grid_cell_2, PatternCurves=explode.Segments)
move = Move(Geometry=srfsplit, Motion=graft(ln))  # -> flatten(Geometry), Transform
area = Area(Geometry=move.Geometry)  # -> Area, Centroid
pattern_area_centroids = Point(area.Centroid)
pattern_curves = Curve(move.Geometry)
pattern_area_centroids_2 = ClusterOutput(pattern_area_centroids)
pattern_curves_2 = ClusterOutput(pattern_curves)

# ==== cluster GenomeAType2_3: Pattern Component
scaled_split_evaluation_point = ClusterInput()
evaluation_point = ClusterInput()
cell_scale = ClusterInput()
grid_cell_area_centroid = ClusterInput()
grid_cell_curve = ClusterInput()
pattern_generator_tool = PatternGeneratorTool(
    grid_cell_curve=grid_cell_curve,
    grid_cell_area_centroid=grid_cell_area_centroid,
    eval_point=evaluation_point,
    split_eval_point=evaluation_point,
    cell_scale=cell_scale,
    scaled_split_eval_point=scaled_split_evaluation_point)  # -> grid_cell_curves_2, grid_cell_2, scaled_grid_cell_2, grid_cell_area_centroids_2, grid_cell_area_centroid_4, x_7, midpoint_2, vertex_2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
pt = Point(pattern_generator_tool.split_eval_seg_gen_2)
pt_2 = Point(pattern_generator_tool.scaled_split_eval_seg_gen_2)
weave = Weave(Pattern=[0, 1], Stream0=pt_2, Stream1=pt, NullGaps=False)
ln = Line(
    CellAreaCentroid=pattern_generator_tool.grid_cell_area_centroid_4,
    CellAreaCentroids=pattern_generator_tool.grid_cell_area_centroids_2)
intcrv = Interpolate(Vertices=weave, Degree=Slider(1, range=0..1), Periodic=True, KnotStyle=0)  # -> Curve, Length, Domain
pline = PolyLine(Vertices=weave, Closed=True)
explode = Explode(Curve=pline, Recursive=True)  # -> Segments, Vertices
srfsplit = SurfaceSplit(GridCell=pattern_generator_tool.grid_cell_2, PatternCurves=explode.Segments)
move = Move(Geometry=srfsplit, Motion=graft(ln))  # -> flatten(Geometry), Transform
area = Area(Geometry=move.Geometry)  # -> Area, Centroid
pattern_area_centroids = Point(area.Centroid)
pattern_curves = Curve(move.Geometry)
pattern_area_centroids_2 = ClusterOutput(pattern_area_centroids)
pattern_curves_2 = ClusterOutput(pattern_curves)

# ==== cluster GenomeAType2_4: Pattern Component
evaluation_point = ClusterInput()
cell_scale = ClusterInput()
grid_cell_area_centroid = ClusterInput()
grid_cell_curve = ClusterInput()
pattern_generator_tool = PatternGeneratorTool(
    grid_cell_curve=grid_cell_curve,
    grid_cell_area_centroid=grid_cell_area_centroid,
    eval_point=evaluation_point,
    cell_scale=cell_scale)  # -> grid_cell_curves_2, grid_cell_2, scaled_grid_cell_2, grid_cell_area_centroids_2, grid_cell_area_centroid_4, x_7, midpoint_2, vertex_2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
pt = Point(pattern_generator_tool.eval_seg_2)
pt_2 = Point(pattern_generator_tool.scaled_vertex_2)
weave = Weave(Pattern=[0, 1], Stream0=pt_2, Stream1=pt, NullGaps=False)
ln = Line(
    CellAreaCentroid=pattern_generator_tool.grid_cell_area_centroid_4,
    CellAreaCentroids=pattern_generator_tool.grid_cell_area_centroids_2)
intcrv = Interpolate(Vertices=weave, Degree=Slider(1, range=0..1), Periodic=True, KnotStyle=0)  # -> Curve, Length, Domain
pline = PolyLine(Vertices=weave, Closed=True)
explode = Explode(Curve=pline, Recursive=True)  # -> Segments, Vertices
srfsplit = SurfaceSplit(GridCell=pattern_generator_tool.grid_cell_2, PatternCurves=explode.Segments)
move = Move(Geometry=srfsplit, Motion=graft(ln))  # -> flatten(Geometry), Transform
area = Area(Geometry=move.Geometry)  # -> Area, Centroid
pattern_area_centroids = Point(area.Centroid)
pattern_curves = Curve(move.Geometry)
pattern_area_centroids_2 = ClusterOutput(pattern_area_centroids)
pattern_curves_2 = ClusterOutput(pattern_curves)

# ==== cluster GenomeCType1: Pattern Component
grid_cell_area_centroid = ClusterInput()
grid_cell_curve = ClusterInput()
pattern_generator_tool = PatternGeneratorTool(grid_cell_curve=grid_cell_curve, grid_cell_area_centroid=grid_cell_area_centroid)  # -> grid_cell_curves_2, grid_cell_2, scaled_grid_cell_2, grid_cell_area_centroids_2, grid_cell_area_centroid_4, x_7, midpoint_2, vertex_2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
pattern_1_2 = Pattern12()  # -> pattern_curves_2, pattern_area_centroids_2, grid_cell_area_centroids_4
voronoi = Voronoi(Points=flatten([pattern_generator_tool.midpoint_2, pattern_generator_tool.vertex_2]), BruteForceOverride=False)
ln = Line(
    CellAreaCentroid=pattern_generator_tool.grid_cell_area_centroid_4,
    CellAreaCentroids=pattern_generator_tool.grid_cell_area_centroids_2)
bbx = BrepBrep(BrepA=pattern_generator_tool.grid_cell_2, BrepB=voronoi)  # -> flatten(Curves), Points
srfsplit = SurfaceSplit(GridCell=pattern_generator_tool.grid_cell_2, PatternCurves=bbx.Curves)
move = Move(Geometry=srfsplit, Motion=graft(ln))  # -> flatten(Geometry), Transform
area = Area(Geometry=move.Geometry)  # -> Area, Centroid
pattern_area_centroids = Point(area.Centroid)
pattern_curves = Curve(move.Geometry)
pattern_area_centroids_2 = ClusterOutput(pattern_area_centroids)
pattern_curves_2 = ClusterOutput(pattern_curves)

# ==== cluster GenomeCType1_2: Pattern Component
cell_scale = ClusterInput()
grid_cell_area_centroid = ClusterInput()
grid_cell_curve = ClusterInput()
pattern_generator_tool = PatternGeneratorTool(grid_cell_curve=grid_cell_curve, grid_cell_area_centroid=grid_cell_area_centroid, cell_scale=cell_scale)  # -> grid_cell_curves_2, grid_cell_2, scaled_grid_cell_2, grid_cell_area_centroids_2, grid_cell_area_centroid_4, x_7, midpoint_2, vertex_2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
pattern_1_2 = Pattern12()  # -> pattern_curves_2, pattern_area_centroids_2, grid_cell_area_centroids_4
voronoi = Voronoi(Points=flatten([pattern_generator_tool.scaled_vertex_2, pattern_generator_tool.midpoint_2]), BruteForceOverride=False)
ln = Line(
    CellAreaCentroid=pattern_generator_tool.grid_cell_area_centroid_4,
    CellAreaCentroids=pattern_generator_tool.grid_cell_area_centroids_2)
bbx = BrepBrep(BrepA=pattern_generator_tool.grid_cell_2, BrepB=voronoi)  # -> flatten(Curves), Points
move = Move(Geometry=bbx.Curves, Motion=graft(ln))  # -> flatten(Geometry), Transform
area = Area(Geometry=move.Geometry)  # -> Area, Centroid
pattern_area_centroids = Point(area.Centroid)
pattern_curves = Curve(move.Geometry)
pattern_area_centroids_2 = ClusterOutput(pattern_area_centroids)
pattern_curves_2 = ClusterOutput(pattern_curves)

# ==== cluster GenomeAType1_3: Pattern Component
grid_cell_area_centroid = ClusterInput()
grid_cell_curve = ClusterInput()
cell_scale = ClusterInput()
pattern_generator_tool = PatternGeneratorTool_2(grid_cell_curve=grid_cell_curve, grid_cell_area_centroid=grid_cell_area_centroid, cell_scale=cell_scale)  # -> grid_cell_curves_2, grid_cell_2, scaled_grid_cell_2, grid_cell_area_centroids_2, grid_cell_area_centroid_4, x_7, midpoint_2, vertex_2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
explode = Explode(Curve=pattern_generator_tool.scaled_grid_cell_2, Recursive=True)  # -> Segments, Vertices
ln = Line(StartPoint=pattern_generator_tool.midpoint_2, EndPoint=pattern_generator_tool.scaled_vertex_2)
ln_2 = Line(StartPoint=pattern_generator_tool.scaled_midpoint_2, EndPoint=pattern_generator_tool.area_centroid_2)
ln_3 = Line(
    CellAreaCentroid=pattern_generator_tool.grid_cell_area_centroid_4,
    CellAreaCentroids=pattern_generator_tool.grid_cell_area_centroids_2)
srfsplit = SurfaceSplit(GridCell=pattern_generator_tool.grid_cell_2, PatternCurves=[ln_2, explode.Segments, ln])
move = Move(Geometry=srfsplit, Motion=graft(ln_3))  # -> flatten(Geometry), Transform
area = Area(Geometry=move.Geometry)  # -> Area, Centroid
pattern_area_centroids = Point(area.Centroid)
pattern_curves = Curve(move.Geometry)
pattern_area_centroids_2 = ClusterOutput(pattern_area_centroids)
pattern_curves_2 = ClusterOutput(pattern_curves)

# ==== cluster GenomeAType1_4: Pattern Component
grid_cell_area_centroid = ClusterInput()
grid_cell_curve = ClusterInput()
cell_scale = ClusterInput()
pattern_generator_tool = PatternGeneratorTool_2(grid_cell_curve=grid_cell_curve, grid_cell_area_centroid=grid_cell_area_centroid, cell_scale=cell_scale)  # -> grid_cell_curves_2, grid_cell_2, scaled_grid_cell_2, grid_cell_area_centroids_2, grid_cell_area_centroid_4, x_7, midpoint_2, vertex_2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
explode = Explode(Curve=pattern_generator_tool.scaled_grid_cell_2, Recursive=True)  # -> Segments, Vertices
ln = Line(StartPoint=pattern_generator_tool.midpoint_2, EndPoint=pattern_generator_tool.scaled_vertex_2)
ln_2 = Line(StartPoint=pattern_generator_tool.scaled_vertex_2, EndPoint=pattern_generator_tool.area_centroid_2)
ln_3 = Line(
    CellAreaCentroid=pattern_generator_tool.grid_cell_area_centroid_4,
    CellAreaCentroids=pattern_generator_tool.grid_cell_area_centroids_2)
srfsplit = SurfaceSplit(GridCell=pattern_generator_tool.grid_cell_2, PatternCurves=[ln_2, explode.Segments, ln])
move = Move(Geometry=srfsplit, Motion=graft(ln_3))  # -> flatten(Geometry), Transform
area = Area(Geometry=move.Geometry)  # -> Area, Centroid
pattern_area_centroids = Point(area.Centroid)
pattern_curves = Curve(move.Geometry)
pattern_area_centroids_2 = ClusterOutput(pattern_area_centroids)
pattern_curves_2 = ClusterOutput(pattern_curves)

# ==== cluster GenomeAType1_5: Pattern Component
grid_cell_area_centroid = ClusterInput()
grid_cell_curve = ClusterInput()
cell_scale = ClusterInput()
pattern_generator_tool = PatternGeneratorTool_2(grid_cell_curve=grid_cell_curve, grid_cell_area_centroid=grid_cell_area_centroid, cell_scale=cell_scale)  # -> grid_cell_curves_2, grid_cell_2, scaled_grid_cell_2, grid_cell_area_centroids_2, grid_cell_area_centroid_4, x_7, midpoint_2, vertex_2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
explode = Explode(Curve=pattern_generator_tool.scaled_grid_cell_2, Recursive=True)  # -> Segments, Vertices
ln = Line(StartPoint=pattern_generator_tool.vertex_2, EndPoint=pattern_generator_tool.scaled_vertex_2)
ln_2 = Line(StartPoint=pattern_generator_tool.scaled_midpoint_2, EndPoint=pattern_generator_tool.area_centroid_2)
ln_3 = Line(
    CellAreaCentroid=pattern_generator_tool.grid_cell_area_centroid_4,
    CellAreaCentroids=pattern_generator_tool.grid_cell_area_centroids_2)
srfsplit = SurfaceSplit(GridCell=pattern_generator_tool.grid_cell_2, PatternCurves=[ln_2, explode.Segments, ln])
move = Move(Geometry=srfsplit, Motion=graft(ln_3))  # -> flatten(Geometry), Transform
area = Area(Geometry=move.Geometry)  # -> Area, Centroid
pattern_area_centroids = Point(area.Centroid)
pattern_curves = Curve(move.Geometry)
pattern_area_centroids_2 = ClusterOutput(pattern_area_centroids)
pattern_curves_2 = ClusterOutput(pattern_curves)

# ==== cluster GenomeAType1_6: Pattern Component
cell_scale = ClusterInput()
grid_cell_area_centroid = ClusterInput()
grid_cell_curve = ClusterInput()
pattern_generator_tool = PatternGeneratorTool(grid_cell_curve=grid_cell_curve, grid_cell_area_centroid=grid_cell_area_centroid, cell_scale=cell_scale)  # -> grid_cell_curves_2, grid_cell_2, scaled_grid_cell_2, grid_cell_area_centroids_2, grid_cell_area_centroid_4, x_7, midpoint_2, vertex_2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
pt = Point(pattern_generator_tool.midpoint_2)
pt_2 = Point(pattern_generator_tool.scaled_vertex_2)
ln = Line(StartPoint=pattern_generator_tool.midpoint_2, EndPoint=pattern_generator_tool.area_centroid_2)
ln_2 = Line(StartPoint=pattern_generator_tool.scaled_vertex_2, EndPoint=pattern_generator_tool.area_centroid_2)
weave = Weave(Pattern=[0, 1], Stream0=pt_2, Stream1=pt, NullGaps=False)
ln_3 = Line(
    CellAreaCentroid=pattern_generator_tool.grid_cell_area_centroid_4,
    CellAreaCentroids=pattern_generator_tool.grid_cell_area_centroids_2)
intcrv = Interpolate(Vertices=weave, Degree=Slider(1, range=0..1), Periodic=True, KnotStyle=0)  # -> Curve, Length, Domain
pline = PolyLine(Vertices=weave, Closed=True)
explode = Explode(Curve=pline, Recursive=True)  # -> Segments, Vertices
srfsplit = SurfaceSplit(GridCell=pattern_generator_tool.grid_cell_2, PatternCurves=[explode.Segments, ln, ln_2])  # -> flatten(PatternCurves)
move = Move(Geometry=srfsplit, Motion=graft(ln_3))  # -> flatten(Geometry), Transform
area = Area(Geometry=move.Geometry)  # -> Area, Centroid
pattern_area_centroids = Point(area.Centroid)
pattern_curves = Curve(move.Geometry)
pattern_area_centroids_2 = ClusterOutput(pattern_area_centroids)
pattern_curves_2 = ClusterOutput(pattern_curves)

# ==== cluster CurveAttractor: Utility
C = ClusterInput()
P = ClusterInput()
x = ClusterInput()
A = ClusterInput()
B = ClusterInput()
crv_cp = CurveClosestPoint(Point=P, Curve=C)  # -> Point, Parameter, Distance
dom = ConstructDomain(DomainStart=A, DomainEnd=B)
bnd = Bounds(Numbers=crv_cp.Distance)
remap = RemapNumbers(Value=crv_cp.Distance, Source=bnd, Target=dom)  # -> Mapped, Clipped
R = ClusterOutput(remap.Mapped)
points_on_curve = Point(crv_cp.Point)
points_on_curve_2 = ClusterOutput(points_on_curve)

# ==== cluster GenomeATypeX: Pattern Component
grid_cell_area_centroid = ClusterInput()
grid_cell_curve = ClusterInput()
cell_scale = ClusterInput()
pattern_generator_tool = PatternGeneratorTool_2(grid_cell_curve=grid_cell_curve, grid_cell_area_centroid=grid_cell_area_centroid, cell_scale=cell_scale)  # -> grid_cell_curves_2, grid_cell_2, scaled_grid_cell_2, grid_cell_area_centroids_2, grid_cell_area_centroid_4, x_7, midpoint_2, vertex_2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
ln = Line(StartPoint=pattern_generator_tool.midpoint_2, EndPoint=pattern_generator_tool.scaled_vertex_2)
ln_2 = Line(StartPoint=pattern_generator_tool.scaled_vertex_2, EndPoint=pattern_generator_tool.area_centroid_2)
ln_3 = Line(StartPoint=pattern_generator_tool.midpoint_2, EndPoint=pattern_generator_tool.area_centroid_2)
ln_4 = Line(
    CellAreaCentroid=pattern_generator_tool.grid_cell_area_centroid_4,
    CellAreaCentroids=pattern_generator_tool.grid_cell_area_centroids_2)
srfsplit = SurfaceSplit(GridCell=pattern_generator_tool.grid_cell_2, PatternCurves=[ln_2, ln, ln_3])
move = Move(Geometry=srfsplit, Motion=graft(ln_4))  # -> flatten(Geometry), Transform
area = Area(Geometry=move.Geometry)  # -> Area, Centroid
pattern_area_centroids = Point(area.Centroid)
pattern_curves = Curve(move.Geometry)
pattern_area_centroids_2 = ClusterOutput(pattern_area_centroids)
pattern_curves_2 = ClusterOutput(pattern_curves)

# ==== cluster GenomeATypeX_2: Pattern Component
grid_cell_area_centroid = ClusterInput()
grid_cell_curve = ClusterInput()
cell_scale = ClusterInput()
pattern_generator_tool = PatternGeneratorTool_2(grid_cell_curve=grid_cell_curve, grid_cell_area_centroid=grid_cell_area_centroid, cell_scale=cell_scale)  # -> grid_cell_curves_2, grid_cell_2, scaled_grid_cell_2, grid_cell_area_centroids_2, grid_cell_area_centroid_4, x_7, midpoint_2, vertex_2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
ln = Line(StartPoint=pattern_generator_tool.scaled_vertex_2, EndPoint=pattern_generator_tool.area_centroid_2)
ln_2 = Line(StartPoint=pattern_generator_tool.vertex_2, EndPoint=pattern_generator_tool.scaled_vertex_2)
ln_3 = Line(StartPoint=pattern_generator_tool.midpoint_2, EndPoint=pattern_generator_tool.scaled_vertex_2)
srfsplit = SurfaceSplit(GridCell=pattern_generator_tool.grid_cell_2, PatternCurves=[ln, ln_3, ln_2])
ln_4 = Line(
    CellAreaCentroid=pattern_generator_tool.grid_cell_area_centroid_4,
    CellAreaCentroids=pattern_generator_tool.grid_cell_area_centroids_2)
move = Move(Geometry=srfsplit, Motion=graft(ln_4))  # -> flatten(Geometry), Transform
area = Area(Geometry=move.Geometry)  # -> Area, Centroid
pattern_area_centroids = Point(area.Centroid)
pattern_curves = Curve(move.Geometry)
pattern_area_centroids_2 = ClusterOutput(pattern_area_centroids)
pattern_curves_2 = ClusterOutput(pattern_curves)

# ==== cluster GenomeAType7_2: Pattern Component
grid_cell_area_centroid = ClusterInput()
grid_cell_curve = ClusterInput()
evaluation_point = ClusterInput()
cell_scale = ClusterInput()
pattern_generator_tool = PATTERNGENERATORTOOL_2(
    grid_cell_curve=grid_cell_curve,
    grid_cell_area_centroid=grid_cell_area_centroid,
    split_eval_point=evaluation_point,
    cell_scale=cell_scale)  # -> grid_cell_curves_2, grid_cell_2, grid_cell_area_centroids_2, grid_cell_area_centroid_4, x_7, midpoint_2, vertex_2, split_midpoint_a_2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
ln = Line(StartPoint=pattern_generator_tool.split_eval_seg_a_2, EndPoint=pattern_generator_tool.scaled_split_vertex_b_2)
ln_2 = Line(StartPoint=pattern_generator_tool.split_eval_seg_gen_2, EndPoint=pattern_generator_tool.area_centroid_2)
ln_3 = Line(StartPoint=pattern_generator_tool.area_centroid_2, EndPoint=pattern_generator_tool.scaled_split_vertex_b_2)
srfsplit = SurfaceSplit(GridCell=pattern_generator_tool.grid_cell_2, PatternCurves=ln_2)
ln_4 = Line(
    CellAreaCentroid=pattern_generator_tool.grid_cell_area_centroid_4,
    CellAreaCentroids=pattern_generator_tool.grid_cell_area_centroids_2)
move = Move(Geometry=srfsplit, Motion=graft(ln_4))  # -> flatten(Geometry), Transform
area = Area(Geometry=move.Geometry)  # -> Area, Centroid
pattern_area_centroids = Point(area.Centroid)
pattern_curves = Curve(move.Geometry)
pattern_area_centroids_2 = ClusterOutput(pattern_area_centroids)
pattern_curves_2 = ClusterOutput(pattern_curves)

# ==== cluster Pattern236: Pattern Component
grid_cell_curves = ClusterInput()
grid_cell_area_centroids = ClusterInput()
grid_cell_curves_2 = Curve(grid_cell_curves)
interior_cell_scale = ClusterInput()
point_on_curve = ClusterInput()
item = ListItem(List=flatten(grid_cell_curves_2), Index=0, Wrap=True)
area = Area(Geometry=item)  # -> Area, Centroid
grid_eval_tool = GridEvalTool(grid_cell_curves=item, grid_cell_area_centroids=area.Centroid, grid_cell_scale=Slider(1, range=0..1))  # -> grid_cell_curves_5, grid_cell_vertices_2, grid_cell_midpoints_2, grid_cell_area_centroids_3
explode = Explode(Curve=grid_eval_tool.grid_cell_curves_5, Recursive=True)  # -> Segments, Vertices
interior_cell_scale_2 = Number(interior_cell_scale)
crv = Curve(explode.Segments)
point_on_curve_2 = Number(point_on_curve)
grid_cell_area_centroids_2 = Point(flatten(grid_cell_area_centroids))
pt = Point(grid_eval_tool.grid_cell_vertices_2)
pt_2 = Point(grid_eval_tool.grid_cell_midpoints_2)
eval = EvaluateCurve(Curve=reparameterize(crv), Parameter=point_on_curve_2)  # -> Point, Tangent, Angle
avr = Average(Input=pt_2)
ln = Line(StartPoint=avr, EndPoint=pt_2)
pattern_area_centroid = Point(avr)
eval_2 = EvaluateCurve(Curve=reparameterize(ln), Parameter=interior_cell_scale_2)  # -> Point, Tangent, Angle
voronoi = Voronoi(Points=flatten([eval_2.Point, eval.Point, pt]), BruteForceOverride=False)
bbx = BrepBrep(BrepA=item, BrepB=voronoi)  # -> flatten(Curves), Points
ln_2 = Line(StartPoint=pattern_area_centroid, EndPoint=grid_cell_area_centroids_2)
move = Move(Geometry=bbx.Curves, Motion=graft(ln_2))  # -> Geometry, Transform
area_2 = Area(Geometry=move.Geometry)  # -> Area, Centroid
pattern_curves = Curve(move.Geometry)
pattern_area_centroids = Point(area_2.Centroid)
avr_2 = Average(Input=area_2.Centroid)
pattern_curves_2 = ClusterOutput(pattern_curves)
pattern_area_centroids_2 = ClusterOutput(pattern_area_centroids)
grid_cell_area_centroids_3 = Point(avr_2)
grid_cell_area_centroids_4 = ClusterOutput(grid_cell_area_centroids_3)

# ==== cluster Pattern45: Pattern Component
grid_cell_curves = ClusterInput()
grid_cell_area_centroids = ClusterInput()
grid_cell_curves_2 = Curve(grid_cell_curves)
interior_cell_scale_a = ClusterInput()
interior_cell_scale_b = ClusterInput()
interior_subdivisions = ClusterInput()
item = ListItem(List=flatten(grid_cell_curves_2), Index=0, Wrap=True)
area = Area(Geometry=item)  # -> Area, Centroid
grid_eval_tool = GridEvalTool(grid_cell_curves=item, grid_cell_area_centroids=area.Centroid, grid_cell_scale=Slider(1, range=0..1))  # -> grid_cell_curves_5, grid_cell_vertices_2, grid_cell_midpoints_2, grid_cell_area_centroids_3
pt = Point(grid_eval_tool.grid_cell_vertices_2)
grid_cell_area_centroids_2 = Point(flatten(grid_cell_area_centroids))
avr = Average(Input=pt)
interior_cell_scale_a_2 = Number(interior_cell_scale_a)
interior_cell_scale_b_2 = Number(interior_cell_scale_b)
interior_subdivisions_2 = Number(interior_subdivisions)
ln = Line(StartPoint=avr, EndPoint=pt)
pattern_area_centroid = Point(avr)
eval = EvaluateCurve(Curve=reparameterize(ln), Parameter=interior_cell_scale_a_2)  # -> Point, Tangent, Angle
cir = Circle(Plane=avr, Radius=interior_cell_scale_b_2)
divide = DivideCurve(Curve=cir, Count=interior_subdivisions_2, Kinks=False)  # -> Points, Tangents, Parameters
voronoi = Voronoi(Points=flatten([divide.Points, eval.Point]), BruteForceOverride=False)
bbx = BrepBrep(BrepA=item, BrepB=voronoi)  # -> flatten(Curves), Points
ln_2 = Line(StartPoint=pattern_area_centroid, EndPoint=grid_cell_area_centroids_2)
move = Move(Geometry=bbx.Curves, Motion=graft(ln_2))  # -> Geometry, Transform
area_2 = Area(Geometry=move.Geometry)  # -> Area, Centroid
pattern_curves = Curve(move.Geometry)
pattern_area_centroids = Point(area_2.Centroid)
avr_2 = Average(Input=area_2.Centroid)
pattern_curves_2 = ClusterOutput(pattern_curves)
pattern_area_centroids_2 = ClusterOutput(pattern_area_centroids)
grid_cell_area_centroids_3 = Point(avr_2)
grid_cell_area_centroids_4 = ClusterOutput(grid_cell_area_centroids_3)

# ==== cluster Pattern125: Pattern Component
grid_cell_curves = ClusterInput()
grid_cell_area_centroids = ClusterInput()
grid_cell_curves_2 = Curve(grid_cell_curves)
interior_cell_scale = ClusterInput()
interior_subdivisions = ClusterInput()
item = ListItem(List=flatten(grid_cell_curves_2), Index=0, Wrap=True)
area = Area(Geometry=item)  # -> Area, Centroid
grid_eval_tool = GridEvalTool(grid_cell_curves=item, grid_cell_area_centroids=area.Centroid, grid_cell_scale=Slider(1, range=0..1))  # -> grid_cell_curves_5, grid_cell_vertices_2, grid_cell_midpoints_2, grid_cell_area_centroids_3
grid_cell_area_centroids_2 = Point(flatten(grid_cell_area_centroids))
pt = Point(grid_eval_tool.grid_cell_vertices_2)
pt_2 = Point(grid_eval_tool.grid_cell_midpoints_2)
avr = Average(Input=pt_2)
interior_cell_scale_2 = Number(interior_cell_scale)
interior_subdivisions_2 = Number(interior_subdivisions)
pattern_area_centroid = Point(avr)
cir = Circle(Plane=avr, Radius=interior_cell_scale_2)
divide = DivideCurve(Curve=cir, Count=interior_subdivisions_2, Kinks=False)  # -> Points, Tangents, Parameters
voronoi = Voronoi(Points=flatten([pt_2, divide.Points, pt]), BruteForceOverride=False)
bbx = BrepBrep(BrepA=item, BrepB=voronoi)  # -> flatten(Curves), Points
ln = Line(StartPoint=pattern_area_centroid, EndPoint=grid_cell_area_centroids_2)
move = Move(Geometry=bbx.Curves, Motion=graft(ln))  # -> Geometry, Transform
area_2 = Area(Geometry=move.Geometry)  # -> Area, Centroid
pattern_curves = Curve(move.Geometry)
pattern_area_centroids = Point(area_2.Centroid)
avr_2 = Average(Input=area_2.Centroid)
pattern_curves_2 = ClusterOutput(pattern_curves)
pattern_area_centroids_2 = ClusterOutput(pattern_area_centroids)
grid_cell_area_centroids_3 = Point(avr_2)
grid_cell_area_centroids_4 = ClusterOutput(grid_cell_area_centroids_3)

# ==== cluster GenomeAType8_2: Pattern Component
grid_cell_area_centroid = ClusterInput()
grid_cell_curve = ClusterInput()
cell_scale = ClusterInput()
pattern_generator_tool = PatternGeneratorTool_2(grid_cell_curve=grid_cell_curve, grid_cell_area_centroid=grid_cell_area_centroid, cell_scale=cell_scale)  # -> grid_cell_curves_2, grid_cell_2, scaled_grid_cell_2, grid_cell_area_centroids_2, grid_cell_area_centroid_4, x_7, midpoint_2, vertex_2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
explode = Explode(Curve=pattern_generator_tool.scaled_grid_cell_2, Recursive=True)  # -> Segments, Vertices
ln = Line(StartPoint=pattern_generator_tool.midpoint_2, EndPoint=pattern_generator_tool.scaled_vertex_2)
ln_2 = Line(StartPoint=pattern_generator_tool.vertex_2, EndPoint=pattern_generator_tool.scaled_vertex_2)
ln_3 = Line(StartPoint=pattern_generator_tool.scaled_vertex_2, EndPoint=pattern_generator_tool.area_centroid_2)
ln_4 = Line(
    CellAreaCentroid=pattern_generator_tool.grid_cell_area_centroid_4,
    CellAreaCentroids=pattern_generator_tool.grid_cell_area_centroids_2)
srfsplit = SurfaceSplit(GridCell=pattern_generator_tool.grid_cell_2, PatternCurves=[ln_3, ln, ln_2])
move = Move(Geometry=srfsplit, Motion=graft(ln_4))  # -> flatten(Geometry), Transform
area = Area(Geometry=move.Geometry)  # -> Area, Centroid
pattern_area_centroids = Point(area.Centroid)
pattern_curves = Curve(move.Geometry)
pattern_area_centroids_2 = ClusterOutput(pattern_area_centroids)
pattern_curves_2 = ClusterOutput(pattern_curves)

# ==== cluster GenomeAType7_3: Pattern Component
grid_cell_area_centroid = ClusterInput()
grid_cell_curve = ClusterInput()
evaluation_point = ClusterInput()
cell_scale = ClusterInput()
pattern_generator_tool = PATTERNGENERATORTOOL_2(
    grid_cell_curve=grid_cell_curve,
    grid_cell_area_centroid=grid_cell_area_centroid,
    split_eval_point=evaluation_point,
    cell_scale=cell_scale)  # -> grid_cell_curves_2, grid_cell_2, grid_cell_area_centroids_2, grid_cell_area_centroid_4, x_7, midpoint_2, vertex_2, split_midpoint_a_2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
ln = Line(StartPoint=pattern_generator_tool.split_eval_seg_a_2, EndPoint=pattern_generator_tool.scaled_split_vertex_b_2)
ln_2 = Line(StartPoint=pattern_generator_tool.split_eval_seg_gen_2, EndPoint=pattern_generator_tool.area_centroid_2)
ln_3 = Line(StartPoint=pattern_generator_tool.area_centroid_2, EndPoint=pattern_generator_tool.scaled_split_vertex_b_2)
srfsplit = SurfaceSplit(GridCell=pattern_generator_tool.grid_cell_2, PatternCurves=[ln, ln_3])
ln_4 = Line(
    CellAreaCentroid=pattern_generator_tool.grid_cell_area_centroid_4,
    CellAreaCentroids=pattern_generator_tool.grid_cell_area_centroids_2)
move = Move(Geometry=srfsplit, Motion=graft(ln_4))  # -> flatten(Geometry), Transform
area = Area(Geometry=move.Geometry)  # -> Area, Centroid
pattern_area_centroids = Point(area.Centroid)
pattern_curves = Curve(move.Geometry)
pattern_area_centroids_2 = ClusterOutput(pattern_area_centroids)
pattern_curves_2 = ClusterOutput(pattern_curves)

# ==== cluster PATTERNGENERATORTOOL
grid_cell_area_centroid = ClusterInput()
grid_cell_curve = ClusterInput()
grid_cell_curve_2 = Curve(flatten(grid_cell_curve))
grid_cell_area_centroid_2 = Point(flatten(grid_cell_area_centroid))
cell_scale = ClusterInput()
x = ClusterInput()  # INPUT DIV
x_2 = ClusterInput()  # INPUT DIV
item = ListItem(List=grid_cell_curve_2, Index=0, Wrap=True)
item_2 = ListItem(List=grid_cell_area_centroid_2, Index=0, Wrap=True)
split_eval_point = ClusterInput()
cell_scale_2 = Number(cell_scale)
prim_geo = Curve(item)
x_3 = ClusterInput()  # INPUT DIV
eval_point = ClusterInput()
scale = Scale(Geometry=prim_geo, Center=item_2, Factor=cell_scale_2)  # -> Geometry, Transform
scaled_split_eval_point = ClusterInput()
x_4 = ClusterInput()  # INPUT DIV
circle_subdivisions = ClusterInput()
circle_scale = ClusterInput()
explode = Explode(Curve=prim_geo, Recursive=True)  # -> Segments, Vertices
disc = Discontinuity(Curve=prim_geo, Level=1)  # -> Points, Parameters
scaled_eval_point = ClusterInput()
split_eval_point_2 = Number(split_eval_point)
eval_point_2 = Number(eval_point)
dispatch = Dispatch(List=explode.Segments, DispatchPattern=[True, False])  # -> ListA, ListB
scaled_geo = Curve(scale.Geometry)
midpt = CurveMiddle(Curve=explode.Segments)
item_3 = ListItem(List=midpt, Index=0, Wrap=True)
ln = Line(StartPoint=item_3, EndPoint=item_2)
scaled_split_eval_point_2 = Number(scaled_split_eval_point)
len = Length(Curve=ln)
scaled_eval_point_2 = Number(scaled_eval_point)
circle_subdivisions_2 = Number(circle_subdivisions)
explode_2 = Explode(Curve=scaled_geo, Recursive=True)  # -> Segments, Vertices
disc_2 = Discontinuity(Curve=scaled_geo, Level=1)  # -> Points, Parameters
circle_scale_2 = Number(circle_scale)
dispatch_2 = Dispatch(List=midpt, DispatchPattern=[True, False])  # -> ListA, ListB
dispatch_3 = Dispatch(List=disc.Points, DispatchPattern=[True, False])  # -> ListA, ListB
subtraction = Subtraction(A=Slider(1, range=0..1), B=split_eval_point_2)
dispatch_4 = Dispatch(List=explode_2.Segments, DispatchPattern=[True, False])  # -> ListA, ListB
midpt_2 = CurveMiddle(Curve=explode_2.Segments)
eval = EvaluateCurve(Curve=reparameterize(explode.Segments), Parameter=eval_point_2)  # -> Point, Tangent, Angle
circle = CircleCNR(Center=item_2, Normal=Vector(0, 0, 1), Radius=len)
eval_2 = EvaluateCurve(Curve=reparameterize(dispatch.ListA), Parameter=split_eval_point_2)  # -> Point, Tangent, Angle
eval_3 = EvaluateCurve(Curve=reparameterize(dispatch.ListA), Parameter=subtraction)  # -> Point, Tangent, Angle
dispatch_5 = Dispatch(List=midpt_2, DispatchPattern=[True, False])  # -> ListA, ListB
dispatch_6 = Dispatch(List=disc_2.Points, DispatchPattern=[True, False])  # -> ListA, ListB
subtraction_2 = Subtraction(A=Slider(1, range=0..1), B=scaled_split_eval_point_2)
area = Area(Geometry=circle)  # -> Area, Centroid
eval_4 = EvaluateCurve(Curve=reparameterize(explode_2.Segments), Parameter=scaled_eval_point_2)  # -> Point, Tangent, Angle
weave = Weave(Pattern=[0, 1], Stream0=eval_2.Point, Stream1=eval_3.Point, NullGaps=False)
eval_5 = EvaluateCurve(Curve=reparameterize(dispatch_4.ListA), Parameter=scaled_split_eval_point_2)  # -> Point, Tangent, Angle
eval_6 = EvaluateCurve(Curve=reparameterize(dispatch_4.ListA), Parameter=subtraction_2)  # -> Point, Tangent, Angle
scale_2 = Scale(Geometry=circle, Center=area.Centroid, Factor=circle_scale_2)  # -> Geometry, Transform
x_5 = ClusterOutput()  # OUTPUT DIV
weave_2 = Weave(Pattern=[0, 1], Stream0=eval_5.Point, Stream1=eval_6.Point, NullGaps=False)
split_eval_seg_gen = Point(weave)
split_eval_seg_a = Point(eval_2.Point)
split_eval_seg_b = Point(eval_3.Point)
split_midpoint_a = Point(dispatch_2.ListA)
split_midpoint_b = Point(dispatch_2.ListB)
x_6 = ClusterOutput()  # OUTPUT DIV
x_7 = ClusterOutput()  # OUTPUT DIV
divide = DivideCurve(Curve=scale_2.Geometry, Count=circle_subdivisions_2, Kinks=False)  # -> Points, Tangents, Parameters
split_vertex_a = Point(dispatch_3.ListA)
split_vertex_b = Point(dispatch_3.ListB)
grid_cell_area_centroid_3 = Point(item_2)
grid_cell_area_centroids = Point(grid_cell_area_centroid_2)
grid_cell_curves = Curve(grid_cell_curve_2)
eval_seg = Point(eval.Point)
midpoint = Point(midpt)
scaled_split_eval_seg_gen = Point(weave_2)
scaled_split_midpoint_a = Point(dispatch_5.ListA)
scaled_split_midpoint_b = Point(dispatch_5.ListB)
scaled_split_eval_seg_b = Point(eval_6.Point)
vertex = Point(disc.Points)
scaled_split_eval_seg_a = Point(eval_5.Point)
scaled_split_vertex_a = Point(dispatch_6.ListA)
scaled_split_vertex_b = Point(dispatch_6.ListB)
grid_cell = Curve(item)
x_8 = ClusterOutput()  # OUTPUT DIV
x_9 = ClusterOutput()  # OUTPUT DIV
scaled_midpoint = Point(midpt_2)
x_10 = ClusterOutput()  # OUTPUT DIV
scaled_eval_seg = Point(eval_4.Point)
area_centroid = Point(item_2)
scaled_sub_circ = Point(divide.Points)
scaled_vertex = Point(disc_2.Points)
vertex_2 = ClusterOutput(vertex)
split_midpoint_a_2 = ClusterOutput(split_midpoint_a)
split_midpoint_b_2 = ClusterOutput(split_midpoint_b)
midpoint_2 = ClusterOutput(midpoint)
split_vertex_a_2 = ClusterOutput(split_vertex_a)
split_vertex_b_2 = ClusterOutput(split_vertex_b)
split_eval_seg_a_2 = ClusterOutput(split_eval_seg_a)
split_eval_seg_b_2 = ClusterOutput(split_eval_seg_b)
grid_cell_curves_2 = ClusterOutput(grid_cell_curves)
split_eval_seg_gen_2 = ClusterOutput(split_eval_seg_gen)
grid_cell_area_centroids_2 = ClusterOutput(grid_cell_area_centroids)
grid_cell_2 = ClusterOutput(grid_cell)
eval_seg_2 = ClusterOutput(eval_seg)
grid_cell_area_centroid_4 = ClusterOutput(grid_cell_area_centroid_3)
scaled_vertex_2 = ClusterOutput(scaled_vertex)
scaled_split_midpoint_a_2 = ClusterOutput(scaled_split_midpoint_a)
scaled_split_midpoint_b_2 = ClusterOutput(scaled_split_midpoint_b)
scaled_midpoint_2 = ClusterOutput(scaled_midpoint)
scaled_split_vertex_a_2 = ClusterOutput(scaled_split_vertex_a)
scaled_sub_circ_2 = ClusterOutput(scaled_sub_circ)
scaled_split_vertex_b_2 = ClusterOutput(scaled_split_vertex_b)
area_centroid_2 = ClusterOutput(area_centroid)
scaled_split_eval_seg_a_2 = ClusterOutput(scaled_split_eval_seg_a)
scaled_split_eval_seg_b_2 = ClusterOutput(scaled_split_eval_seg_b)
scaled_eval_seg_2 = ClusterOutput(scaled_eval_seg)
scaled_split_eval_seg_gen_2 = ClusterOutput(scaled_split_eval_seg_gen)

# ==== cluster PatternGeneratorTool
grid_cell_area_centroid = ClusterInput()
grid_cell_curve = ClusterInput()
grid_cell_curve_2 = Curve(flatten(grid_cell_curve))
grid_cell_area_centroid_2 = Point(flatten(grid_cell_area_centroid))
cell_scale = ClusterInput()
x = ClusterInput()  # INPUT DIV
x_2 = ClusterInput()  # INPUT DIV
item = ListItem(List=grid_cell_curve_2, Index=0, Wrap=True)
item_2 = ListItem(List=grid_cell_area_centroid_2, Index=0, Wrap=True)
split_eval_point = ClusterInput()
cell_scale_2 = Number(cell_scale)
prim_geo = Curve(item)
x_3 = ClusterInput()  # INPUT DIV
eval_point = ClusterInput()
scale = Scale(Geometry=prim_geo, Center=item_2, Factor=cell_scale_2)  # -> Geometry, Transform
scaled_split_eval_point = ClusterInput()
x_4 = ClusterInput()  # INPUT DIV
circle_subd = ClusterInput()
circle_scale = ClusterInput()
explode = Explode(Curve=prim_geo, Recursive=True)  # -> Segments, Vertices
disc = Discontinuity(Curve=prim_geo, Level=1)  # -> Points, Parameters
scaled_eval_point = ClusterInput()
split_eval_point_2 = Number(split_eval_point)
dispatch = Dispatch(List=explode.Segments, DispatchPattern=[True, False])  # -> ListA, ListB
eval_point_2 = Number(eval_point)
scaled_geo = Curve(scale.Geometry)
midpt = CurveMiddle(Curve=explode.Segments)
item_3 = ListItem(List=midpt, Index=0, Wrap=True)
ln = Line(StartPoint=item_3, EndPoint=item_2)
scaled_split_eval_point_2 = Number(scaled_split_eval_point)
len = Length(Curve=ln)
scaled_eval_point_2 = Number(scaled_eval_point)
explode_2 = Explode(Curve=scaled_geo, Recursive=True)  # -> Segments, Vertices
disc_2 = Discontinuity(Curve=scaled_geo, Level=1)  # -> Points, Parameters
circle_subd_2 = Number(circle_subd)
circle_scale_2 = Number(circle_scale)
dispatch_2 = Dispatch(List=midpt, DispatchPattern=[True, False])  # -> ListA, ListB
dispatch_3 = Dispatch(List=disc.Points, DispatchPattern=[True, False])  # -> ListA, ListB
subtraction = Subtraction(A=Slider(1, range=0..1), B=split_eval_point_2)
dispatch_4 = Dispatch(List=explode_2.Segments, DispatchPattern=[True, False])  # -> ListA, ListB
midpt_2 = CurveMiddle(Curve=explode_2.Segments)
eval = EvaluateCurve(Curve=reparameterize(explode.Segments), Parameter=eval_point_2)  # -> Point, Tangent, Angle
circle = CircleCNR(Center=item_2, Normal=Vector(0, 0, 1), Radius=len)
eval_2 = EvaluateCurve(Curve=reparameterize(dispatch.ListA), Parameter=split_eval_point_2)  # -> Point, Tangent, Angle
eval_3 = EvaluateCurve(Curve=reparameterize(dispatch.ListB), Parameter=subtraction)  # -> Point, Tangent, Angle
dispatch_5 = Dispatch(List=midpt_2, DispatchPattern=[True, False])  # -> ListA, ListB
dispatch_6 = Dispatch(List=disc_2.Points, DispatchPattern=[True, False])  # -> ListA, ListB
subtraction_2 = Subtraction(A=Slider(1, range=0..1), B=scaled_split_eval_point_2)
area = Area(Geometry=circle)  # -> Area, Centroid
eval_4 = EvaluateCurve(Curve=reparameterize(explode_2.Segments), Parameter=scaled_eval_point_2)  # -> Point, Tangent, Angle
weave = Weave(Pattern=[0, 1], Stream0=eval_2.Point, Stream1=eval_3.Point, NullGaps=False)
eval_5 = EvaluateCurve(Curve=reparameterize(dispatch_4.ListA), Parameter=scaled_split_eval_point_2)  # -> Point, Tangent, Angle
eval_6 = EvaluateCurve(Curve=reparameterize(dispatch_4.ListA), Parameter=subtraction_2)  # -> Point, Tangent, Angle
scale_2 = Scale(Geometry=circle, Center=area.Centroid, Factor=circle_scale_2)  # -> Geometry, Transform
x_5 = ClusterOutput()  # OUTPUT DIV
weave_2 = Weave(Pattern=[0, 1], Stream0=eval_5.Point, Stream1=eval_6.Point, NullGaps=False)
split_eval_seg_gen = Point(weave)
split_eval_seg_a = Point(eval_2.Point)
split_eval_seg_b = Point(eval_3.Point)
split_midpoint_a = Point(dispatch_2.ListA)
split_midpoint_b = Point(dispatch_2.ListB)
x_6 = ClusterOutput()  # OUTPUT DIV
x_7 = ClusterOutput()  # OUTPUT DIV
divide = DivideCurve(Curve=scale_2.Geometry, Count=circle_subd_2, Kinks=False)  # -> Points, Tangents, Parameters
split_vertex_a = Point(dispatch_3.ListA)
split_vertex_b = Point(dispatch_3.ListB)
grid_cell_area_centroid_3 = Point(item_2)
grid_cell_area_centroids = Point(grid_cell_area_centroid_2)
scaled_grid_cell = Curve(scale.Geometry)
eval_seg = Point(eval.Point)
grid_cell_curves = Curve(grid_cell_curve_2)
midpoint = Point(midpt)
scaled_split_eval_seg_gen = Point(weave_2)
scaled_split_midpoint_a = Point(dispatch_5.ListA)
scaled_split_midpoint_b = Point(dispatch_5.ListB)
scaled_split_eval_seg_b = Point(eval_6.Point)
vertex = Point(disc.Points)
scaled_split_eval_seg_a = Point(eval_5.Point)
grid_cell = Curve(item)
scaled_split_vertex_a = Point(dispatch_6.ListA)
scaled_split_vertex_b = Point(dispatch_6.ListB)
x_8 = ClusterOutput()  # OUTPUT DIV
x_9 = ClusterOutput()  # OUTPUT DIV
scaled_midpoint = Point(midpt_2)
x_10 = ClusterOutput()  # OUTPUT DIV
scaled_eval_seg = Point(eval_4.Point)
area_centroid = Point(item_2)
scaled_sub_circ = Point(divide.Points)
scaled_vertex = Point(disc_2.Points)
vertex_2 = ClusterOutput(vertex)
split_midpoint_a_2 = ClusterOutput(split_midpoint_a)
split_midpoint_b_2 = ClusterOutput(split_midpoint_b)
midpoint_2 = ClusterOutput(midpoint)
split_vertex_a_2 = ClusterOutput(split_vertex_a)
split_vertex_b_2 = ClusterOutput(split_vertex_b)
split_eval_seg_a_2 = ClusterOutput(split_eval_seg_a)
split_eval_seg_b_2 = ClusterOutput(split_eval_seg_b)
split_eval_seg_gen_2 = ClusterOutput(split_eval_seg_gen)
grid_cell_curves_2 = ClusterOutput(grid_cell_curves)
grid_cell_area_centroids_2 = ClusterOutput(grid_cell_area_centroids)
eval_seg_2 = ClusterOutput(eval_seg)
grid_cell_area_centroid_4 = ClusterOutput(grid_cell_area_centroid_3)
grid_cell_2 = ClusterOutput(grid_cell)
scaled_grid_cell_2 = ClusterOutput(scaled_grid_cell)
scaled_vertex_2 = ClusterOutput(scaled_vertex)
scaled_split_midpoint_a_2 = ClusterOutput(scaled_split_midpoint_a)
scaled_split_midpoint_b_2 = ClusterOutput(scaled_split_midpoint_b)
scaled_midpoint_2 = ClusterOutput(scaled_midpoint)
scaled_split_vertex_a_2 = ClusterOutput(scaled_split_vertex_a)
scaled_sub_circ_2 = ClusterOutput(scaled_sub_circ)
scaled_split_vertex_b_2 = ClusterOutput(scaled_split_vertex_b)
area_centroid_2 = ClusterOutput(area_centroid)
scaled_split_eval_seg_a_2 = ClusterOutput(scaled_split_eval_seg_a)
scaled_split_eval_seg_b_2 = ClusterOutput(scaled_split_eval_seg_b)
scaled_eval_seg_2 = ClusterOutput(scaled_eval_seg)
scaled_split_eval_seg_gen_2 = ClusterOutput(scaled_split_eval_seg_gen)

# ==== cluster PATTERNGENERATORTOOL_2
grid_cell_area_centroid = ClusterInput()
grid_cell_curve = ClusterInput()
grid_cell_curve_2 = Curve(flatten(grid_cell_curve))
grid_cell_area_centroid_2 = Point(flatten(grid_cell_area_centroid))
cell_scale = ClusterInput()
x = ClusterInput()  # INPUT DIV
x_2 = ClusterInput()  # INPUT DIV
item = ListItem(List=grid_cell_curve_2, Index=0, Wrap=True)
item_2 = ListItem(List=grid_cell_area_centroid_2, Index=0, Wrap=True)
split_eval_point = ClusterInput()
cell_scale_2 = Number(cell_scale)
prim_geo = Curve(item)
x_3 = ClusterInput()  # INPUT DIV
eval_point = ClusterInput()
scale = Scale(Geometry=prim_geo, Center=item_2, Factor=cell_scale_2)  # -> Geometry, Transform
scaled_split_eval_point = ClusterInput()
x_4 = ClusterInput()  # INPUT DIV
circle_subdivisions = ClusterInput()
circle_scale = ClusterInput()
explode = Explode(Curve=prim_geo, Recursive=True)  # -> Segments, Vertices
disc = Discontinuity(Curve=prim_geo, Level=1)  # -> Points, Parameters
scaled_eval_point = ClusterInput()
split_eval_point_2 = Number(split_eval_point)
dispatch = Dispatch(List=explode.Segments, DispatchPattern=[True, False])  # -> ListA, ListB
eval_point_2 = Number(eval_point)
scaled_geo = Curve(scale.Geometry)
midpt = CurveMiddle(Curve=explode.Segments)
item_3 = ListItem(List=midpt, Index=0, Wrap=True)
ln = Line(StartPoint=item_3, EndPoint=item_2)
scaled_split_eval_point_2 = Number(scaled_split_eval_point)
len = Length(Curve=ln)
scaled_eval_point_2 = Number(scaled_eval_point)
circle_subdivisions_2 = Number(circle_subdivisions)
explode_2 = Explode(Curve=scaled_geo, Recursive=True)  # -> Segments, Vertices
disc_2 = Discontinuity(Curve=scaled_geo, Level=1)  # -> Points, Parameters
circle_scale_2 = Number(circle_scale)
dispatch_2 = Dispatch(List=midpt, DispatchPattern=[True, False])  # -> ListA, ListB
dispatch_3 = Dispatch(List=disc.Points, DispatchPattern=[True, False])  # -> ListA, ListB
subtraction = Subtraction(A=Slider(1, range=0..1), B=split_eval_point_2)
dispatch_4 = Dispatch(List=explode_2.Segments, DispatchPattern=[True, False])  # -> ListA, ListB
midpt_2 = CurveMiddle(Curve=explode_2.Segments)
eval = EvaluateCurve(Curve=reparameterize(explode.Segments), Parameter=eval_point_2)  # -> Point, Tangent, Angle
circle = CircleCNR(Center=item_2, Normal=Vector(0, 0, 1), Radius=len)
eval_2 = EvaluateCurve(Curve=reparameterize(dispatch.ListB), Parameter=subtraction)  # -> Point, Tangent, Angle
eval_3 = EvaluateCurve(Curve=reparameterize(dispatch.ListA), Parameter=split_eval_point_2)  # -> Point, Tangent, Angle
dispatch_5 = Dispatch(List=midpt_2, DispatchPattern=[True, False])  # -> ListA, ListB
dispatch_6 = Dispatch(List=disc_2.Points, DispatchPattern=[True, False])  # -> ListA, ListB
subtraction_2 = Subtraction(A=Slider(1, range=0..1), B=scaled_split_eval_point_2)
area = Area(Geometry=circle)  # -> Area, Centroid
eval_4 = EvaluateCurve(Curve=reparameterize(explode_2.Segments), Parameter=scaled_eval_point_2)  # -> Point, Tangent, Angle
weave = Weave(Pattern=[0, 1], Stream0=eval_3.Point, Stream1=eval_2.Point, NullGaps=False)
eval_5 = EvaluateCurve(Curve=reparameterize(dispatch_4.ListA), Parameter=scaled_split_eval_point_2)  # -> Point, Tangent, Angle
eval_6 = EvaluateCurve(Curve=reparameterize(dispatch_4.ListA), Parameter=subtraction_2)  # -> Point, Tangent, Angle
scale_2 = Scale(Geometry=circle, Center=area.Centroid, Factor=circle_scale_2)  # -> Geometry, Transform
x_5 = ClusterOutput()  # OUTPUT DIV
weave_2 = Weave(Pattern=[0, 1], Stream0=eval_5.Point, Stream1=eval_6.Point, NullGaps=False)
split_eval_seg_gen = Point(weave)
split_eval_seg_a = Point(eval_3.Point)
split_eval_seg_b = Point(eval_2.Point)
split_midpoint_a = Point(dispatch_2.ListA)
split_midpoint_b = Point(dispatch_2.ListB)
x_6 = ClusterOutput()  # OUTPUT DIV
x_7 = ClusterOutput()  # OUTPUT DIV
divide = DivideCurve(Curve=scale_2.Geometry, Count=circle_subdivisions_2, Kinks=False)  # -> Points, Tangents, Parameters
split_vertex_a = Point(dispatch_3.ListA)
split_vertex_b = Point(dispatch_3.ListB)
grid_cell_area_centroid_3 = Point(item_2)
grid_cell_area_centroids = Point(grid_cell_area_centroid_2)
grid_cell_curves = Curve(grid_cell_curve_2)
eval_seg = Point(eval.Point)
midpoint = Point(midpt)
scaled_split_eval_seg_gen = Point(weave_2)
scaled_split_midpoint_a = Point(dispatch_5.ListA)
scaled_split_midpoint_b = Point(dispatch_5.ListB)
scaled_split_eval_seg_b = Point(eval_6.Point)
vertex = Point(disc.Points)
scaled_split_eval_seg_a = Point(eval_5.Point)
scaled_split_vertex_a = Point(dispatch_6.ListA)
scaled_split_vertex_b = Point(dispatch_6.ListB)
grid_cell = Curve(item)
x_8 = ClusterOutput()  # OUTPUT DIV
x_9 = ClusterOutput()  # OUTPUT DIV
scaled_midpoint = Point(midpt_2)
x_10 = ClusterOutput()  # OUTPUT DIV
scaled_eval_seg = Point(eval_4.Point)
area_centroid = Point(item_2)
scaled_sub_circ = Point(divide.Points)
scaled_vertex = Point(disc_2.Points)
vertex_2 = ClusterOutput(vertex)
split_midpoint_a_2 = ClusterOutput(split_midpoint_a)
split_midpoint_b_2 = ClusterOutput(split_midpoint_b)
midpoint_2 = ClusterOutput(midpoint)
split_vertex_a_2 = ClusterOutput(split_vertex_a)
split_vertex_b_2 = ClusterOutput(split_vertex_b)
split_eval_seg_a_2 = ClusterOutput(split_eval_seg_a)
split_eval_seg_b_2 = ClusterOutput(split_eval_seg_b)
grid_cell_curves_2 = ClusterOutput(grid_cell_curves)
split_eval_seg_gen_2 = ClusterOutput(split_eval_seg_gen)
grid_cell_area_centroids_2 = ClusterOutput(grid_cell_area_centroids)
grid_cell_2 = ClusterOutput(grid_cell)
eval_seg_2 = ClusterOutput(eval_seg)
grid_cell_area_centroid_4 = ClusterOutput(grid_cell_area_centroid_3)
scaled_vertex_2 = ClusterOutput(scaled_vertex)
scaled_split_midpoint_a_2 = ClusterOutput(scaled_split_midpoint_a)
scaled_split_midpoint_b_2 = ClusterOutput(scaled_split_midpoint_b)
scaled_midpoint_2 = ClusterOutput(scaled_midpoint)
scaled_split_vertex_a_2 = ClusterOutput(scaled_split_vertex_a)
scaled_sub_circ_2 = ClusterOutput(scaled_sub_circ)
scaled_split_vertex_b_2 = ClusterOutput(scaled_split_vertex_b)
area_centroid_2 = ClusterOutput(area_centroid)
scaled_split_eval_seg_a_2 = ClusterOutput(scaled_split_eval_seg_a)
scaled_split_eval_seg_b_2 = ClusterOutput(scaled_split_eval_seg_b)
scaled_eval_seg_2 = ClusterOutput(scaled_eval_seg)
scaled_split_eval_seg_gen_2 = ClusterOutput(scaled_split_eval_seg_gen)

# ==== cluster PatternGeneratorTool_2
grid_cell_area_centroid = ClusterInput()
grid_cell_curve = ClusterInput()
grid_cell_curve_2 = Curve(flatten(grid_cell_curve))
grid_cell_area_centroid_2 = Point(flatten(grid_cell_area_centroid))
cell_scale = ClusterInput()
x = ClusterInput()  # INPUT DIV
x_2 = ClusterInput()  # INPUT DIV
item = ListItem(List=grid_cell_curve_2, Index=0, Wrap=True)
item_2 = ListItem(List=grid_cell_area_centroid_2, Index=0, Wrap=True)
split_eval_point = ClusterInput()
cell_scale_2 = Number(cell_scale)
prim_geo = Curve(item)
x_3 = ClusterInput()  # INPUT DIV
eval_point = ClusterInput()
scale = Scale(Geometry=prim_geo, Center=item_2, Factor=cell_scale_2)  # -> Geometry, Transform
scaled_split_eval_point = ClusterInput()
x_4 = ClusterInput()  # INPUT DIV
circle_subd = ClusterInput()
circle_scale = ClusterInput()
explode = Explode(Curve=prim_geo, Recursive=True)  # -> Segments, Vertices
disc = Discontinuity(Curve=prim_geo, Level=1)  # -> Points, Parameters
scaled_eval_point = ClusterInput()
split_eval_point_2 = Number(split_eval_point)
dispatch = Dispatch(List=explode.Segments, DispatchPattern=[True, False])  # -> ListA, ListB
eval_point_2 = Number(eval_point)
scaled_geo = Curve(scale.Geometry)
midpt = CurveMiddle(Curve=explode.Segments)
item_3 = ListItem(List=midpt, Index=0, Wrap=True)
ln = Line(StartPoint=item_3, EndPoint=item_2)
scaled_split_eval_point_2 = Number(scaled_split_eval_point)
len = Length(Curve=ln)
scaled_eval_point_2 = Number(scaled_eval_point)
explode_2 = Explode(Curve=scaled_geo, Recursive=True)  # -> Segments, Vertices
disc_2 = Discontinuity(Curve=scaled_geo, Level=1)  # -> Points, Parameters
circle_subd_2 = Number(circle_subd)
circle_scale_2 = Number(circle_scale)
dispatch_2 = Dispatch(List=midpt, DispatchPattern=[True, False])  # -> ListA, ListB
dispatch_3 = Dispatch(List=disc.Points, DispatchPattern=[True, False])  # -> ListA, ListB
subtraction = Subtraction(A=Slider(1, range=0..1), B=split_eval_point_2)
dispatch_4 = Dispatch(List=explode_2.Segments, DispatchPattern=[True, False])  # -> ListA, ListB
midpt_2 = CurveMiddle(Curve=explode_2.Segments)
eval = EvaluateCurve(Curve=reparameterize(explode.Segments), Parameter=eval_point_2)  # -> Point, Tangent, Angle
circle = CircleCNR(Center=item_2, Normal=Vector(0, 0, 1), Radius=len)
eval_2 = EvaluateCurve(Curve=reparameterize(dispatch.ListB), Parameter=subtraction)  # -> Point, Tangent, Angle
eval_3 = EvaluateCurve(Curve=reparameterize(dispatch.ListA), Parameter=split_eval_point_2)  # -> Point, Tangent, Angle
dispatch_5 = Dispatch(List=midpt_2, DispatchPattern=[True, False])  # -> ListA, ListB
dispatch_6 = Dispatch(List=disc_2.Points, DispatchPattern=[True, False])  # -> ListA, ListB
subtraction_2 = Subtraction(A=Slider(1, range=0..1), B=scaled_split_eval_point_2)
area = Area(Geometry=circle)  # -> Area, Centroid
eval_4 = EvaluateCurve(Curve=reparameterize(explode_2.Segments), Parameter=scaled_eval_point_2)  # -> Point, Tangent, Angle
weave = Weave(Pattern=[0, 1], Stream0=eval_3.Point, Stream1=eval_2.Point, NullGaps=False)
eval_5 = EvaluateCurve(Curve=reparameterize(dispatch_4.ListA), Parameter=scaled_split_eval_point_2)  # -> Point, Tangent, Angle
eval_6 = EvaluateCurve(Curve=reparameterize(dispatch_4.ListA), Parameter=subtraction_2)  # -> Point, Tangent, Angle
scale_2 = Scale(Geometry=circle, Center=area.Centroid, Factor=circle_scale_2)  # -> Geometry, Transform
x_5 = ClusterOutput()  # OUTPUT DIV
weave_2 = Weave(Pattern=[0, 1], Stream0=eval_5.Point, Stream1=eval_6.Point, NullGaps=False)
split_eval_seg_gen = Point(weave)
split_eval_seg_a = Point(eval_3.Point)
split_eval_seg_b = Point(eval_2.Point)
split_midpoint_a = Point(dispatch_2.ListA)
split_midpoint_b = Point(dispatch_2.ListB)
x_6 = ClusterOutput()  # OUTPUT DIV
x_7 = ClusterOutput()  # OUTPUT DIV
divide = DivideCurve(Curve=scale_2.Geometry, Count=circle_subd_2, Kinks=False)  # -> Points, Tangents, Parameters
split_vertex_a = Point(dispatch_3.ListA)
split_vertex_b = Point(dispatch_3.ListB)
grid_cell_area_centroid_3 = Point(item_2)
grid_cell_area_centroids = Point(grid_cell_area_centroid_2)
scaled_grid_cell = Curve(scale.Geometry)
eval_seg = Point(eval.Point)
grid_cell_curves = Curve(grid_cell_curve_2)
midpoint = Point(midpt)
scaled_split_eval_seg_gen = Point(weave_2)
scaled_split_midpoint_a = Point(dispatch_5.ListA)
scaled_split_midpoint_b = Point(dispatch_5.ListB)
scaled_split_eval_seg_b = Point(eval_6.Point)
vertex = Point(disc.Points)
scaled_split_eval_seg_a = Point(eval_5.Point)
grid_cell = Curve(item)
scaled_split_vertex_a = Point(dispatch_6.ListA)
scaled_split_vertex_b = Point(dispatch_6.ListB)
x_8 = ClusterOutput()  # OUTPUT DIV
x_9 = ClusterOutput()  # OUTPUT DIV
scaled_midpoint = Point(midpt_2)
x_10 = ClusterOutput()  # OUTPUT DIV
scaled_eval_seg = Point(eval_4.Point)
area_centroid = Point(item_2)
scaled_sub_circ = Point(divide.Points)
scaled_vertex = Point(disc_2.Points)
vertex_2 = ClusterOutput(vertex)
split_midpoint_a_2 = ClusterOutput(split_midpoint_a)
split_midpoint_b_2 = ClusterOutput(split_midpoint_b)
midpoint_2 = ClusterOutput(midpoint)
split_vertex_a_2 = ClusterOutput(split_vertex_a)
split_vertex_b_2 = ClusterOutput(split_vertex_b)
split_eval_seg_a_2 = ClusterOutput(split_eval_seg_a)
split_eval_seg_b_2 = ClusterOutput(split_eval_seg_b)
split_eval_seg_gen_2 = ClusterOutput(split_eval_seg_gen)
grid_cell_curves_2 = ClusterOutput(grid_cell_curves)
grid_cell_area_centroids_2 = ClusterOutput(grid_cell_area_centroids)
eval_seg_2 = ClusterOutput(eval_seg)
grid_cell_area_centroid_4 = ClusterOutput(grid_cell_area_centroid_3)
grid_cell_2 = ClusterOutput(grid_cell)
scaled_grid_cell_2 = ClusterOutput(scaled_grid_cell)
scaled_vertex_2 = ClusterOutput(scaled_vertex)
scaled_split_midpoint_a_2 = ClusterOutput(scaled_split_midpoint_a)
scaled_split_midpoint_b_2 = ClusterOutput(scaled_split_midpoint_b)
scaled_midpoint_2 = ClusterOutput(scaled_midpoint)
scaled_split_vertex_a_2 = ClusterOutput(scaled_split_vertex_a)
scaled_sub_circ_2 = ClusterOutput(scaled_sub_circ)
scaled_split_vertex_b_2 = ClusterOutput(scaled_split_vertex_b)
area_centroid_2 = ClusterOutput(area_centroid)
scaled_split_eval_seg_a_2 = ClusterOutput(scaled_split_eval_seg_a)
scaled_split_eval_seg_b_2 = ClusterOutput(scaled_split_eval_seg_b)
scaled_eval_seg_2 = ClusterOutput(scaled_eval_seg)
scaled_split_eval_seg_gen_2 = ClusterOutput(scaled_split_eval_seg_gen)

# ==== cluster Pattern12: Pattern Component
grid_cell_curves = ClusterInput()
grid_cell_area_centroids = ClusterInput()
grid_cell_curves_2 = Curve(grid_cell_curves)
item = ListItem(List=flatten(grid_cell_curves_2), Index=0, Wrap=True)
area = Area(Geometry=item)  # -> Area, Centroid
grid_eval_tool = GridEvalTool(grid_cell_curves=item, grid_cell_area_centroids=area.Centroid, grid_cell_scale=Slider(1, range=0..1))  # -> grid_cell_curves_5, grid_cell_vertices_2, grid_cell_midpoints_2, grid_cell_area_centroids_3
grid_cell_area_centroids_2 = Point(flatten(grid_cell_area_centroids))
pt = Point(grid_eval_tool.grid_cell_midpoints_2)
pt_2 = Point(grid_eval_tool.grid_cell_vertices_2)
pattern_area_centroid = Point(grid_eval_tool.grid_cell_area_centroids_3)
voronoi = Voronoi(Points=flatten([pt_2, pt]), BruteForceOverride=False)
bbx = BrepBrep(BrepA=item, BrepB=voronoi)  # -> flatten(Curves), Points
ln = Line(StartPoint=pattern_area_centroid, EndPoint=grid_cell_area_centroids_2)
move = Move(Geometry=bbx.Curves, Motion=graft(ln))  # -> Geometry, Transform
area_2 = Area(Geometry=move.Geometry)  # -> Area, Centroid
pattern_curves = Curve(move.Geometry)
pattern_area_centroids = Point(area_2.Centroid)
avr = Average(Input=area_2.Centroid)
pattern_curves_2 = ClusterOutput(pattern_curves)
pattern_area_centroids_2 = ClusterOutput(pattern_area_centroids)
grid_cell_area_centroids_3 = Point(avr)
grid_cell_area_centroids_4 = ClusterOutput(grid_cell_area_centroids_3)

# ==== cluster GridEvalTool: Grid Gen
grid_cell_area_centroids = ClusterInput()
grid_cell_curves = ClusterInput()
grid_cell_scale = ClusterInput()
grid_cell_area_centroids_2 = Point(grid_cell_area_centroids)
grid_cell_curves_2 = Curve(grid_cell_curves)
grid_cell_scale_2 = Number(grid_cell_scale)
scale = Scale(Geometry=grid_cell_curves_2, Center=grid_cell_area_centroids_2, Factor=grid_cell_scale_2)  # -> Geometry, Transform
grid_cell_curves_3 = Curve(scale.Geometry)
grid_cell_curves_4 = Curve(scale.Geometry)
disc = Discontinuity(Curve=grid_cell_curves_3, Level=1)  # -> Points, Parameters
explode = Explode(Curve=grid_cell_curves_3, Recursive=True)  # -> Segments, Vertices
grid_cell_vertices = Point(disc.Points)
midpt = CurveMiddle(Curve=explode.Segments)
grid_cell_midpoints = Point(midpt)
grid_cell_curves_5 = ClusterOutput(grid_cell_curves_4)
grid_cell_vertices_2 = ClusterOutput(grid_cell_vertices)
grid_cell_area_centroids_3 = ClusterOutput(grid_cell_area_centroids_2)
grid_cell_midpoints_2 = ClusterOutput(grid_cell_midpoints)
